# Grasshopper definition design tool.gh (Grasshopper 1.0.7)
# plug-ins: Human UI, GH_CPython

method = ValueList({"random": 0, "manual": 1, "sample": 2}, selected="manual")
nozzle_diameter = Slider(0.6, range=0..2)
list = ValueList({"Stacker S4": 0, "MakerBot 2X": 1, "Modix Big 60": 2}, selected="Modix Big 60")
write_gcode_files = BooleanToggle(False)
list_2 = ValueList({"Random": 0, "All Top": 1, "All Bottom": 2}, selected="All Bottom")
write_inp_files = BooleanToggle(False)
toggle = BooleanToggle(True)
toggle_2 = BooleanToggle(True)
button = Button()
toggle_3 = BooleanToggle(True)
gcode_save_path = FilePath("C:\Users\13426\Desktop\")
inp_save_path = FilePath("C:\Users\humph\OneDrive\Desktop\test")
genmode = Integer(method)

batch_size = Number(Slider(800, range=1..1000))
grid_x_count = Integer(Slider(3, range=2..10))
grid_y_count = Integer(Slider(3, range=2..10))

length_lower_bound = Number(Slider(40, range=15..250))
length_upper_bound = Number(Slider(75, range=15..250))
jitter_lower_bound = Number(Slider(0, range=0..250))
jitter_upper_bound = Number(Slider(30, range=0..250))
minimum_actuator_length = Number(Slider(10, range=0..250))
actuator_directions = Integer(list_2)
randomize = Boolean(Toggle(True))
vertices_cull = Number(Slider(0, range=0..1))

print_offset = Point("{0, 0, 0}")
nozzle_diameter_2 = Number(nozzle_diameter)
fillamentdia = Number(Slider(2.85, range=1..3))
machine = Integer(list)
grid_height = Number(Slider(4, range=0..10))

machine_prm = PythonScript(machine=machine)  # -> buildShift, platform, header, footer, FRA, machineMode
# ---------- machine_prm: Python ----------
import rhinoscriptsyntax as rs

if(machine == 0): # Stacker S4
    machineMode = "absolute"
    w, h = 510, 360
    xShift, yShift = 5, 20
    buildShift = rs.AddPoint(w / 2 + xShift, h / 2 + yShift, 0)
    platform = rs.AddRectangle(rs.PlaneFromFrame([xShift, yShift, 0], [1, 0, 0],
                                                 [0, 1, 0]), w, h)
    FRA = 0.97
    header = """G90
M82
M106 S0
M140 S0
M104 S200 T0
M109 S200 T0
G21; set mm units
G28 ;home all axis
G90; set absolute coordinates
G92 E0; reset extruder distance
G92 E0
G1 E-4.4000 F1200
G1 Z0.200 F1000
; process Constrain_bigx
; layer 1, Z = 0.200
T0
; tool H0.200 W0.800
; **** end of start.gcode ****"""

    footer = """; **** start of end.gcode ****
G28 X0 Y0
G1 E-50
M104 S0 ; turn off extruder
M140 S0 ; turn off bed
M84 ; disable motors"""

if(machine == 1): # MakerBot
    machineMode = "relative"
    w , h = 246, 152
    buildShift = rs.AddPoint(0, 0, 0)
    platform = rs.AddRectangle(rs.PlaneFromFrame([-w / 2, -h / 2, 0], [1, 0, 0], [0, 1, 0]), w, h)
    FRA = 0.95
    header = """G90
M83
; **** Replicator 2X start.gcode ****
M73 P0 ; Enable build progress
G162 X Y F3000 ; Home XY maximum
G161 Z F1200 ; Home Z minimum
G92 Z-5 ; Set Z to -5
G1 Z0 ; Move Z to 0
G161 Z F100 ; Home Z slowly
M132 X Y Z A B ; Recall home offsets
M135 T0 ; Load right extruder offsets
G1 X-130 Y-75 Z30 F9000 ; Move to wait position off table
G130 X20 Y20 Z20 A20 B20 ; Lower stepper Vrefs while heating
M127 ; Set fan speed
M140 S0 T0 ; Heat buildplate
M104 S200 T0 ; Heat right extruder
M133 T0 ; Stabilize extruder temperature
G130 X127 Y127 Z40 A127 B127 ; Default stepper Vref
G92 A0 B0 ; Zero extruders
G1 X100 Y-70 F9000 ; Move to front right corner of bed
G1 Z0.3 F6000 ; Move down to purge
G1 X-90 Y-70 E24 F2000 ; Extrude a line of filament across the front edge of the bed
G1 X-100 Y-70 F180 ; Wait for ooze
G1 X-110 Y-70 F5000 ; Fast wipe
G1 Z0.5 F100 ; Lift
G92 A0 B0 ; Zero extruders
M73 P1 ;@body (notify GPX body has started)
; **** end of start.gcode ****"""

    footer = """; **** Replicator 2X end.gcode ****
M73 P100 ; end build progress
G1 Z155 F1000 ; send Z axis to bottom of machine
M140 S0 T0 ; cool down HBP
M104 S0 T0 ; cool down right extruder
M104 S0 T1 ; cool down left extruder
M127 ; stop blower fan
G162 X Y F3000 ; home XY maximum
M18 ; disable stepper
M72 P1 ; play Ta-Da song
; **** end of end.gcode ****"""

if(machine == 2): # Modeix Big 60
    machineMode = "absolute"
    w , h = 610, 610
    buildShift = rs.AddPoint(0, 0, 0)
    platform = rs.AddRectangle(rs.PlaneFromFrame([0, 0, 0], [1, 0, 0], [0, 1, 0]), w, h)
    FRA = 1.02

    header = """G90
M82
M106 S0
M107
G28 ; home all axes
; **** end of start.gcode ****"""

    footer = """; **** start of end.gcode ****
G92 E0
M107
G28 X0 Y0
M140 S0 ; turn off bed
M84 ; disable motors"""
# ---------- end machine_prm ----------
blocktocode = PythonScript(FRAdjust=machine_prm.FRA, machineMode=machine_prm.machineMode)  # -> blockToCode
# ---------- blocktocode: Python ----------
import math
import rhinoscriptsyntax as rs

epsilon = 0.0001

zSpeed = 1500
moveSpeed = 3000

swapExt = False

if(not swapExt): retraction = [1, 3]
else: retraction = [3, 1]
retractSpeed = 1800

if(not swapExt): filDia = [2.85, 1.75]
else: filDia = [1.75, 2.85]

if(not swapExt): extTemp = [210, 240]
else: extTemp = [240, 210]

if(not swapExt): restTemp = [170, 225]
else: restTemp = [225, 170]

def changeNozzle(cur, tar, rest, curH, skirt):
    
    # move nozzle to temp change position
    xOff = -10
    if(tar == None): yOff = 2 * 2
    else: yOff = tar * 2
    skirtStartPt = rs.CurveStartPoint(skirt)
    zOff = curH - skirtStartPt[2]
    
    changePt = rs.VectorAdd(rs.CurveStartPoint(skirt), [xOff, yOff, zOff])
    codes = initMove(cur, changePt, True)
    
    if(tar == None): # end of code, turn off all extruders
        for t in rest:
            codes += ["M104 S%d T%d" % (0, t)] # turn off
        return codes
    
    # M104, set tartget temp
    codes += ["M104 S%d T%d" % (extTemp[tar], tar)]
    for t in rest:
        if (t == tar): continue
        codes += ["M104 S%d T%d" % (restTemp[t], t)]
    
    # M109, set and wait for temperature change
    codes += ["M109 S%d T%d" % (extTemp[tar], tar)]
    for t in rest:
        if (t == tar): continue
        codes += ["M109 S%d T%d" % (restTemp[t], t)]
    codes += ["T%d" % tar]
    
    return codes

def matSweep(mat, curPt, skirt, layerHeight, nozzleDia, speed, extFactor):
    
    result = []
    
    # get movement
    skirtMove = curPt[2] - rs.CurveStartPoint(skirt)[2]
    yOff = mat * 2
    skirtAtHeight = rs.CopyObject(skirt, [0, yOff, skirtMove])
    sweepStart = rs.CurveStartPoint(skirtAtHeight)
    sweepEnd = rs.CurvePoints(skirtAtHeight)[1]
    
    # calculate extrusion
    sweepLength = rs.Distance(sweepStart, sweepEnd)
    sweepVol = sweepLength * layerHeight * nozzleDia
    E = (sweepVol / extFactor) * 3
    
    # make move
    result += initMove(mat, sweepStart)
    result += ["G1 X%.3f Y%.3f E%.3f F%d" % (sweepEnd[0], sweepEnd[1], E, int(speed / 2))]
    
    return result

def initMove(mat, startPt, changeMat=False):
    
    # determine retraction mode
    if(swapExt): toolCFPLA = 0
    else: toolCFPLA = 1
    if(changeMat and mat == toolCFPLA): retract = 0 # override CFPLA toolchange retraction to 0
    else: retract = retraction[mat]
    
    # move to start
    result = ["G1 Z%.3f F%d" % (startPt[2], zSpeed)] # move to z height
    result += ["G1 X%.3f Y%.3f F%d" % (startPt[0], startPt[1], moveSpeed)] # planar move
    
    # handle retraction
    if(retract != 0):
        result = ["G1 E%.3f F%d" % (-retract, retractSpeed)] + result # retract
        if(machineMode == "relative"): putBackE = retract
        elif(machineMode == "absolute"): putBackE = 0
        result += ["G1 E%.3f F%d" % (putBackE, retractSpeed)]
    
    # handle reset 
    if(machineMode == "absolute"):
        result = ["G92 E0"] + result # reset extrusion
        
    return result

def getParams(index, speeds, layerHeights, FRAs, mats):
    
    # print speed
    if(isinstance(speeds, list)): speed = speeds[index] # list
    else: speed = speeds # scalar
    
    # layer height
    if(isinstance(layerHeights, list)): layerHeight = layerHeights[index] # list
    else: layerHeight = layerHeights # scalar
    
    # flow rate adjustment
    if(isinstance(FRAs, list)): FRA = FRAs[index] # list
    else: FRA = FRAs # scalar
    
    # material
    if(isinstance(mats, list)): mat = mats[index] # list
    else: mat = mats
    
    return speed, layerHeight, FRA, mat

def swapMat(tool, swap):
    
    if(not swap):
        return tool
    else:
        if(tool == 0): return 1
        elif(tool == 1): return 0

def blockToCode(block, nozzleDia, fillamentDia, layerHeights, FRAs=FRAdjust, speeds=5000, mats=0, zShift=0.0):
    # parameters:
    #   blocks: list<Curves> as print paths
    #   nozzleDia: Float, nozzle diameter
    #   fillamentDia: Float, fillament diameter
    #   layerheights: list<Float> or Float, the layerheight for each curve
    #   speeds: list<Float> or Float, speed for each curve
    #   zShift: Float, z offset of the print
    # return:
    #   String, the compiled gcode
    
    skirt = rs.OffsetCurve(block[0],
                           rs.CurveAreaCentroid(block[0])[0],
                           nozzleDia)
    fanOn = False
    
    # handle materials
    allMats = list(set(mats))
    if(isinstance(mats, list)): prevMat = mats[0]
    else: prevMat = mats
    
    # swap material if need be
    prevMat = swapMat(prevMat, swapExt)
    
    # pre-extrusion
    result = changeNozzle(prevMat, prevMat, allMats, 0, skirt)
    result += ["G1 E5.000 F1200"] # pre-extrusion
    
    # extrusion movements
    for i in range(len(block)):
        curve = block[i]
        
        speed, layerHeight, FRA, mat = getParams(i, speeds, layerHeights, 
                                                 FRAs, mats)
        extFactor = (((filDia[mat] / 2) ** 2) * math.pi) / FRA
        mat = swapMat(mat, swapExt)
        
        # check if the print is at the bottom layer ( to turn on/off fans)
        pt = rs.CurveStartPoint(curve)
        isFirstLayer = abs(pt[2] - layerHeight - zShift) < epsilon
        
        # check material
        if(mat != prevMat):
            result += changeNozzle(prevMat, mat, allMats, pt[2], skirt)
            result += matSweep(mat, pt, skirt, layerHeight, nozzleDia, speed, extFactor)
            prevMat = mat
        
        # check cooling fan status
        if(isFirstLayer and fanOn == True): # fan off
            result += ["M107"]
            fanOn = False
        elif(not isFirstLayer and fanOn == False): # fan on
            result += ["M106"]
            fanOn = True
        
        # initialize next extrusion move
        result += initMove(mat, pt)
        
        # break curve into straight segments
        segments, extSum = rs.ExplodeCurves(curve), 0.
        if(len(segments) == 0):  segments = [curve]
        # extrude along curves
        
        for j in range(len(segments)):
            segment = segments[j]
            # compute extrusion volume
            crossSec = layerHeight * nozzleDia
            volume = rs.CurveLength(segment) * crossSec
            extrusion = volume / extFactor
            extSum += extrusion
            if(machineMode == "relative"): E = extrusion
            elif(machineMode == "absolute"): E = extSum
            # add gcode line
            pt = rs.CurveEndPoint(segment)
            newLine = "G1 X%.3f Y%.3f E%.3f" % (pt[0], pt[1], E)
            if (j == 0): newLine += " F%d ;extFactor %.3f" % (int(speed), extFactor) # first line, add speed
            result += [newLine]
    
    # end of code
    if(mat == 0): # add one more retraction
        result += ["G1 E%.3f F%d" % (-1, retractSpeed)]
    result += changeNozzle(prevMat, None, allMats, pt[2], skirt) # cool nozzles
    
    return '\n'.join(result) # compile and return
# ---------- end blocktocode ----------

grid_generator = GhPythonScript(
    batchSize=batch_size,
    gridX=grid_x_count,
    gridY=grid_y_count,
    len0=length_lower_bound,
    len1=length_upper_bound,
    jit0=jitter_lower_bound,
    jit1=jitter_upper_bound,
    lenMin=minimum_actuator_length,
    direction=actuator_directions,
    genMode=genmode)  # -> nodes, edges, cells, actLens, fixedNodeID
# ---------- grid_generator: Python ----------
__author__ = "humph"
__version__ = "2019.01.24"

# general import
import Rhino
import rhinoscriptsyntax as rs
import time as t
import random as r
import math as m
import System

# data tree import
import clr
clr.AddReference("Grasshopper")
from Grasshopper.Kernel.Data import GH_Path
from Grasshopper import DataTree

def writeFile(path, code):
    # write a text file to the specified path
    # parameters:
    #   path: String, the filepath to write file to
    #   code: String, the text file to write
    
    with open(path, "wt") as f:
        f.write(code)

def sampleActLen(l0, l1):
    # sample an actuator length and side
    # parameters:
    #   l0: Float, the lower bound of the actuator length
    #   l1: Float, the upper bound of the actuator length
    # return:
    #   Float, the length of the actuator (positive-top, negative-bottom)
    
    # sample length
    #length = r.uniform(l0, l1)
    length = r.choice([0.25, 0.5, 0.75, 1])
    if(r.uniform(0, 1) < 0.33): length = 0
    # else: length = 1
    # sample direction
    sampDir = r.randint(0, 1)
    if(direction == 0): # random sampling
        if(sampDir == 1): actLen = length
        else: actLen = -length
    elif(direction == 1): # all top
        actLen = length
    elif(direction == 2): # all bottom
        actLen = -length
    
    return actLen

def sampleJitter(jit0, jit1):
    # uniformly jitter a point on the 2D plane
    # parameters:
    #   jit0: Float, the lower bound of the movement distance
    #   jit1: Float, the upper bound of the movement distance
    # return:
    #   a tuple<Float, Float> as the movement in 2D
    
    # uniform sampling
    # https://stackoverflow.com/questions/5837572/generate-a-random-point-within-a-circle-uniformly
    radius = r.uniform(jit0, jit1) *  (r.uniform(0., 1.) ** 0.5)
    theta = r.uniform(0., 2. * m.pi)
    x = radius * m.cos(theta)
    y = radius * m.sin(theta)
    
    return (x, y)
    

def genGrid(nodeX, nodeY):
    # generate a grid design with random sampling
    # parameters:
    #   nodeX: Int, the number of nodes along the x direction
    #   nodeY: Int, the number of nodes along the y direction
    # returns:
    #   edges: list<Line>, the edges of the grid
    #   cells: list<Surface>, the cells of the grid
    #   nodes: list<Point3D>, the nodes (vertices) of the grid
    #   centerID: list<Int>, the index of the vertex that should be fixed
    #   actLens: list<Float>, the lengths of actuators for each edge
    
    nodes = [] # vertices
    edges = [] # edges of the grid
    cells = [] # cells of the grid
    actLens = [] # actuator length of each edge
    
    # uniformly sample edge reference length
    refLen = r.uniform(len0, len1)
    # sample vertices
    for j in range(nodeY):
        for i in range(nodeX):
            xShift, yShift = sampleJitter(jit0, jit1)
            x, y = (i * refLen) + xShift, (j * refLen) + yShift
            nodes += [rs.AddPoint(x, y, 0.)]
    
    # position grid center to origin
    centerID = int(nodeY / 2) * nodeX + int(nodeX / 2)
    shift = rs.VectorScale(nodes[centerID], -1.)
    centerID = [centerID]
    for i in range(len(nodes)):
        nodes[i] = rs.VectorAdd(nodes[i], shift)
    
    # sample edges
    for i in range(nodeX):
        for j in range(nodeY):
            curID = i + (j * nodeX)
            rowEdge = i + 1 < nodeX # check row bound
            colEdge = j + 1 < nodeY # check column bound
            
            if(rowEdge): # add row edge
                nexID = (i + 1) + (j * nodeX)
                newEdge = rs.AddLine(nodes[curID], nodes[nexID])
                newActLen = sampleActLen(0, 1)
                edges += [newEdge] # 0-based ID
                actLens += [newActLen]
            
            if(colEdge): # add column edge
                nexID = i + ((j + 1) * nodeX)
                newEdge = rs.AddLine(nodes[curID], nodes[nexID])
                newActLen = sampleActLen(0, 1)
                edges += [newEdge] # 0-based ID
                actLens += [newActLen]
            
            if(rowEdge and colEdge): # add cell
                cells += [rs.AddSrfPt([nodes[curID],
                                       nodes[(i + 1) + (j * nodeX)],
                                       nodes[(i + 1) + ((j + 1) * nodeX)],
                                       nodes[i + ((j + 1) * nodeX)]])]
            
    return edges, cells, nodes, centerID, actLens

# initialize result containers
edgeTree = DataTree[Rhino.Geometry.Line]()
cellTree = DataTree[Rhino.Geometry.Surface]()
nodeTree = DataTree[Rhino.Geometry.Vector3d]()
fixedTree = DataTree[System.Int32]()
actLenTree = DataTree[System.Double]()

if(genMode == 0):
    
    # sample grid designs
    for i in range(int(batchSize)):
        edges, cells, nodes, cenID, actLens = genGrid(gridX, gridY)
        
        # save grid into the tree
        path = GH_Path(i)
        for elem in edges:
            edgeTree.Add(rs.coerceline(elem), GH_Path(i))
        for elem in cells:
            cellTree.Add(rs.coercesurface(elem), GH_Path(i))
        for elem in nodes:
            nodeTree.Add(elem, GH_Path(i))
        for elem in cenID:
            fixedTree.Add(elem, GH_Path(i))
        for elem in actLens:
            actLenTree.Add(elem, GH_Path(i))
    
    # convert
    nodes = nodeTree
    edges = edgeTree
    cells = cellTree
    actLens = actLenTree
    fixedNodeID = fixedTree
# ---------- end grid_generator ----------

# ---- group: Input / Grid Input
actuator_ratio = Panel("""0:1
1:-1
2:0.5
3:-0.5""")
fixedid = Panel("8")
crv = Curve([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])

# ----
branch = GhPythonScript(
    nodes=grid_generator.nodes,
    edges=grid_generator.edges,
    cells=grid_generator.cells,
    actLens=grid_generator.actLens,
    fixedID=grid_generator.fixedNodeID,
    index=Slider(1, range=0..1),
    randomize=randomize,
    cull=vertices_cull,
    genMode=genmode)  # -> edges, actLens, fixedID, index; inputs nodes: tree, edges: tree, cells: tree, actLens: tree, fixedID: tree
# ---------- branch: Python ----------
__author__ = "humph"
__version__ = "2019.03.18"

import rhinoscriptsyntax as rs
import random
# data tree import
import clr
clr.AddReference("Grasshopper")
from Grasshopper.Kernel.Data import GH_Path
from Grasshopper import DataTree

epsilon = 0.0001

index = int(index * nodes.BranchCount)

def cleanEdges(nodes, edges, actLen):
    # written as a recursive function
    
    nodesDegree = []
    # get node neighbor
    for node in nodes:
        neighbor = 0
        for edge in edges:
            start, end = rs.CurveStartPoint(edge), rs.CurveEndPoint(edge)
            dist = min(rs.Distance(start, node), rs.Distance(end, node))
            if(dist < epsilon): neighbor += 1
        nodesDegree += [neighbor]
    
    if(1 in nodesDegree or 0 in nodesDegree): cleaned = False
    else: cleaned = True
    
    if(cleaned):
        # base case
        return nodes, edges, actLen
    else:
        # remove non-cleaned edges and vertices
        newNodes = []
        for i in range(len(nodes)):
            if(nodesDegree[i] <= 1):
                for j in range(len(edges)):
                    start, end = rs.CurveStartPoint(edges[j]), rs.CurveEndPoint(edges[j])
                    dist = min(rs.Distance(start, nodes[i]), rs.Distance(end, nodes[i]))
                    if(dist < epsilon):
                        edges.pop(j)
                        actLen.pop(j)
                        break
            else: newNodes += [nodes[i]]
        # call recursion
        return cleanEdges(newNodes, edges, actLen)

def cullVertices(nodes, edges, actLen, cull):
    removal = int(len(nodes) * cull)
    randID = range(len(nodes))
    random.shuffle(randID)
    removal = randID[:removal]
    # remove nodes
    newNodes, removed = [], []
    for i in range(len(nodes)):
        if(i not in removal): newNodes += [nodes[i]]
        else: removed += [nodes[i]]
    
    newEdges, newActLen = [], []
    for i in range(len(edges)):
        valid = True
        for j in range(len(removed)):
            start, end = rs.CurveStartPoint(edges[i]), rs.CurveEndPoint(edges[i])
            dist = min(rs.Distance(start, removed[j]), rs.Distance(end, removed[j]))
            if(dist < epsilon): valid = False
        if(valid):
            newEdges += [edges[i]]
            newActLen += [actLen[i]]
            
    newNodes, newEdges, newActLen = cleanEdges(newNodes, newEdges, newActLen)
    newFixed = [random.randint(0, len(newNodes) - 1)]
    
    return newNodes, newEdges, newActLen, newFixed

if(genMode == 0 and index < nodes.BranchCount):
    
    nodes = nodes.Branch(index)
    edges = edges.Branch(index)
    cells = cells.Branch(index)
    actLens = actLens.Branch(index)
    fixedID = fixedID.Branch(index)
    
    if(cull > 0):
        nodes, edges, actLens, fixedID = cullVertices(nodes, edges, actLens, cull)
    
    if (randomize):
        # shuffle nodes
        nodesID = range(len(nodes))
        random.shuffle(nodesID)
        nodes = [nodes[id] for id in nodesID]
        fixedID = nodes[nodesID.index(fixedID[0])]
        # shuffle edges
        edgesID = range(len(edges))
        random.shuffle(edgesID)
        edges = [edges[id] for id in edgesID]
        actLens = ["%d:%.3f"% (id, actLens[id]) for id in edgesID]
        # shuffle cells
        random.shuffle(cells)
else:
    nodes = None
    edges = None
    cells = None
    actLens = None
    fixedID = None
# ---------- end branch ----------

checkbox = CreateCheckbox(Label="View toolpath", StartingValue=False)
toggle_4 = CreateToggle(Default=False, OnLabel="Enable toolpath generation", OffLabel="Disable toolpath generation")
filepicker = CreateFilePicker(ButtonLabelText="Browse...", DialogType=1, MustExist=False, Filter="All Files|*.*")
button_2 = CreateButton(ButtonName="Make!", ButtonStyle=0)
merge = Merge(Data1=toggle_4, Data2=checkbox)
stack = CreateStack(UIElements=merge, Horizontal=True)
merge_2 = Merge(Data1=stack, Data2=filepicker, Data3=button_2)
expander = CreateExpander(UIElements=merge_2, Header="Output Gcode File", Open=False)

button_3 = CreateButton(ButtonName="Set optimization target points", ButtonStyle=0)

panel = Panel("""ex: beam1_pt1 to goal1
beam1_pt12 to goal1
joint2_pt6 to goal0""")
textbox = CreateTextBox(DefaultText=panel, UpdateButton=True, showLabel=True)
values = ValueListener(Elements=textbox, SomeProperty=True)  # -> Values, Indices
textwrap = GhPythonScript(x=values.Values)  # -> out, a
# ---------- textwrap: Python ----------
__author__ = "humph"
__version__ = "2020.01.28"

import rhinoscriptsyntax as rs

lines = x.split(",")
a = '\n'.join(lines)
# ---------- end textwrap ----------
settextbox = SetTextBoxContents(TextBoxToModify=textbox, NewTextBoxContents=textwrap.a)

textbox_2 = CreateTextBox(Label="# of iterations", DefaultText="10", UpdateButton=False, showLabel=True)
tb = CreateTextBlock(Text="0/0", TextSize=12, Justification=0)
button_4 = CreateButton(ButtonName="Auto-optimize!", ButtonStyle=0)
merge_3 = Merge(Data1=button_4, Data2=textbox_2, Data3=tb)
stack_2 = CreateStack(UIElements=merge_3, Horizontal=True)

panel_2 = Panel("""Format: Point {subject index} to point (target index}
==use , to add a new line (objective)==""")
tb_2 = CreateTextBlock(Text=panel_2, TextSize=12, Justification=0)

button_5 = CreateButton(ButtonName="   Take a step!   ", ButtonStyle=0)

checkbox_2 = CreateCheckbox(Label="Show update window", StartingValue=False)

timestep = Slider(11, range=0..11)
checkbox_3 = CreateCheckbox(Label="Flat model", StartingValue=False)
checkbox_4 = CreateCheckbox(Label="Simulated model", StartingValue=False)
button_6 = CreateButton(ButtonName="Simulate!", ButtonStyle=0)
slider = CreateSlider(Slider=timestep, SnapValue=1, ShowBounds=False, ShowTicks=False, ShowTooltip=False, ShowValLabel=True, showLabel=True)
tb_3 = CreateTextBlock(Text="View ", TextSize=12, Justification=0)
merge_4 = Merge(Data1=button_6, Data2=slider, Data3=tb_3, Data4=checkbox_3, Data5=checkbox_4)
stack_3 = CreateStack(UIElements=merge_4, Horizontal=False)

filepicker_2 = CreateFilePicker(ButtonLabelText="Browse Design Tool Folder", DialogType=2, MustExist=True, Filter="All Files|*.*")
values_2 = ValueListener(Elements=filepicker_2, SomeProperty=True)  # -> Values, Indices
checker = GhPythonScript(path=values_2.Values)  # -> out, load
# ---------- checker: Python ----------
__author__ = "MorphingMatterLab"
__version__ = "2020.02.13"

import rhinoscriptsyntax as rs
import os

load = False
if(len(path) > 0):
    files = os.listdir(path)
    if("parameters.py" in files and "toolForward.py" in files):
        load = True
# ---------- end checker ----------

checkbox_5 = CreateCheckbox(Label="Clear single result", StartingValue=False)

checkbox_6 = CreateCheckbox(Label="Cue update", StartingValue=False)

tb_4 = CreateTextBlock(Text="View ", TextSize=12, Justification=0)
checkbox_7 = CreateCheckbox(Label="Design ", StartingValue=True)
checkbox_8 = CreateCheckbox(Label="Warnings ", StartingValue=False)
checkbox_9 = CreateCheckbox(Label="Indices ", StartingValue=False)
merge_5 = Merge(Data1=tb_4, Data2=checkbox_7, Data3=checkbox_8, Data4=checkbox_9)
stack_4 = CreateStack(UIElements=merge_5, Horizontal=True)

textbox_3 = CreateTextBox(Label="Grid Span", DefaultText="65", UpdateButton=False, showLabel=True)
button_7 = CreateButton(ButtonName="Generate", ButtonStyle=0)

checkbox_10 = CreateCheckbox(Label="Load single result", StartingValue=False)

checkbox_11 = CreateCheckbox(Label="Load iteration", StartingValue=False)

checkbox_12 = CreateCheckbox(Label="Load batch result", StartingValue=False)

checkbox_13 = CreateCheckbox(Label="Clear batch result", StartingValue=False)

checkbox_14 = CreateCheckbox(Label="Auto run", StartingValue=False)

textbox_4 = CreateTextBox(Label="Current Iteration", DefaultText="0", UpdateButton=False, showLabel=True)

checkbox_15 = CreateCheckbox(Label="Iteration Done", StartingValue=False)

toggle_5 = BooleanToggle(True)

width = Number(7.2)
wcount = Integer(8)
hcount = Integer(4)
lcount = Integer(1)

number_slider = Slider(5, range=0..10)  # disabled
number_slider_2 = Slider(1, range=0..10)  # disabled
length = Slider(75, range=0..100)  # disabled
width_2 = Slider(7.2, range=0..10)  # disabled
build_shift = Panel("{300, 300, 0}")  # disabled
actuator_ratio_2 = Panel("""1
-0.1
0.5
0
4
-1""")  # disabled
units = ExtentX(number_slider_2)  # disabled
width_3 = Number(width_2)  # disabled
length_2 = Number(length)  # disabled
units_2 = ExtentX(number_slider)  # disabled
int = Integer(genmode)  # disabled
sample = Sample(shift=build_shift, width=width_3, length=length_2, x_extent=units_2, y_extent=units, ratio=actuator_ratio_2, genmode=int)  # disabled

simulearn = GhPythonScript(wid=width, minActLen=minimum_actuator_length, toolFolder=values_2.Values)  # -> SML, toolFolder, saveFolder
# ---------- simulearn: Python ----------
__author__ = "Humphrey Yang"
__version__ = "2020.02.04"

import rhinoscriptsyntax as rs
import math as m
import os
import Rhino
import scriptcontext as sc
# data tree import
import clr
clr.AddReference("Grasshopper")
from Grasshopper.Kernel.Data import GH_Path
from Grasshopper import DataTree

CORNER = True
FRAME_COUNT = 3
COOR_LEN = 3
EDGE_PT_COUNT = 13
NODE_PT_COUNT = 9
EPSILON = 0.0001
ACTSTRESS = 0.158
CONSTRESS = 0.118
TOOL_FOLDER = toolFolder.replace('\\', '/') + '/'
SIM_FOLDER = "simulation/"
SINGLE_FOLDER = "single/"
BATCH_FOLDER = "batch/"
SAVE_FOLDER = "saves/"
HISTORY_FOLDER = "iteration_history/"
CONDUIT_NAME = "conduit.json"
SETTING_NAME = "setting.json"
RANKING_NAME = "ranking.json"
ITER_NAME = "iteration.json"

def readFile(path):
    with open(path, "rt") as f:
        return f.read()

def writeJSON(path,  json):
    
    strForm = str(json)
    strForm = strForm.replace("'", '"')
    
    with open(path, "wt") as f:
        f.write(strForm)

def toFrame(frame):
    
    if(CORNER):
        
        pt0 = rs.AddPoint(frame[0],  frame[1],  frame[2])
        pt1 = rs.AddPoint(frame[3],  frame[4],  frame[5])
        pt2 = rs.AddPoint(frame[6],  frame[7],  frame[8])
        pt3 = rs.AddPoint(frame[9], frame[10], frame[11])
        
        ordered = [pt0, pt1, pt3, pt2, pt0]
        
    else:
        
        ptCen = rs.AddPoint(frame[0], frame[1], frame[2])
        xVec = rs.AddPoint(frame[3], frame[4], frame[5])
        yVec = rs.AddPoint(frame[6], frame[7], frame[8])
        
        vec0 = rs.VectorAdd(rs.VectorScale(xVec,  1), rs.VectorScale(yVec,  1))
        vec1 = rs.VectorAdd(rs.VectorScale(xVec,  1), rs.VectorScale(yVec, -1))
        vec2 = rs.VectorAdd(rs.VectorScale(xVec, -1), rs.VectorScale(yVec, -1))
        vec3 = rs.VectorAdd(rs.VectorScale(xVec, -1), rs.VectorScale(yVec,  1))
        
        pt0 = rs.PointAdd(ptCen, vec0)
        pt1 = rs.PointAdd(ptCen, vec1)
        pt2 = rs.PointAdd(ptCen, vec2)
        pt3 = rs.PointAdd(ptCen, vec3)
        
        ordered = [pt0, pt1, pt2, pt3, pt0]
    
    return rs.AddPolyline(ordered)

def toBeam(vec):
    
    shift = 3 if CORNER else 0
    frameLen = 12 if CORNER else 9
    
    frames = []
    for i in range(FRAME_COUNT):
        start = shift + (i * frameLen)
        end = shift + ((i + 1) * frameLen)
        frames +=[vec[start:end]]
    
    frames = [toFrame(frame) for frame in frames]
    
    return rs.AddLoftSrf(frames)

def toBeams(matrix):
    result = []
    for vec in matrix:
        beam = toBeam(vec)
        result += beam
    
    return result

def toJoint(vec):
    if(CORNER):
        cen = rs.AddPoint(vec[0], vec[1], vec[2])
        #order = [0, 1, 3, 2, 4, 5, 7, 6]
        order = [2, 3, 1, 0, 6, 7, 5, 4]
        pts = []
        for i in range(8):
            s = 3 + i * 3
            pt = rs.AddPoint(vec[s + 0], vec[s + 1], vec[s + 2])
            pts += [pt]
        pts = [pts[i] for i in order]
        block = rs.AddBox(pts)
    else:
        cen = rs.AddPoint(vec[0], vec[1], vec[2])
        pt0 = rs.PointAdd(cen, rs.AddPoint(vec[3], vec[4], vec[5]))
        pt1 = rs.PointAdd(cen, rs.AddPoint(vec[6], vec[7], vec[8]))
        pt2 = rs.PointAdd(cen, rs.AddPoint(vec[9], vec[10], vec[11]))
        pt3 = rs.PointAdd(cen, rs.AddPoint(vec[12], vec[13], vec[14]))
        srf = rs.AddSrfPt([pt0, pt1, pt2, pt3])
        block = rs.OffsetSurface(srf, 2., both_sides=True, create_solid=True)
    return block

def toJoints(matrix):
    result = []
    for vec in matrix:
        joint = toJoint(vec)
        result += [joint]
    
    return result

def graphToGeo(graphs, mode):
    tree = DataTree[Rhino.Geometry.Brep]()
    geos = []
    
    hasNodeTar = "nodes_delta" in graphs[0].keys()
    hasEdgeTar = "edges_delta" in graphs[0].keys()
    
    if(mode == "tar" and ((not hasNodeTar) or (not hasEdgeTar))):
        return geos

    for graph in graphs:
        edges = graph["edges"] if mode == "out" else graph["edges_delta"]
        nodes = graph["nodes"] if mode == "out" else graph["nodes_delta"]
        beams = toBeams(edges)
        joints = toJoints(nodes)
        geos += [beams + joints]
        
    return geos

def geosToTree(geos):
    
    blocks = DataTree[Rhino.Geometry.Brep]()
    
    for i in range(len(geos)):
        graph = geos[i]
        for elem in graph:
            blocks.Add(rs.coercebrep(elem), GH_Path(i))
            
    return blocks

def orientStress(stress, angle, add):
    # orients a planar stress field from the beam's local to global space
    # parameter:
    #   stress: the stress field (six numbers) at its local space
    #   add: float, 
    #   [sigma11, sigma22, sigma33, sigma12, sigma13, sigma23]
    # return:
    #   the oriented stress field in global space
    
    # theta is the negative value of the beam.angle (w.r.t. x-axis)
    # sigma11 = .5 * stress + .5 * stress * (2 * ((m.cos(theta)) ** 2) - 1)
    
    ang = -1 * (angle + add)
    sigma11 = stress * (m.cos(m.radians(ang)) ** 2)
    sigma22 = stress - sigma11
    sigma12 = -1. * stress * (m.sin(m.radians(ang)) * m.cos(m.radians(ang)))
    
    return [sigma11, sigma22, 0., sigma12, 0., 0.]

def vectorAngleIn2D(vector):
    # get the angle of a vector w.r.t. the global x-axis
    # parameter:
    #   the vector to measure
    # return:
    #   the angle w.r.t. the globla x-axis in degrees
    
    # check the angle against x and y vectors
    unitVec = rs.VectorUnitize(vector)
    xAbsAngle = rs.VectorAngle([1., 0., 0.], unitVec)
    yAbsAngle = rs.VectorAngle([0., 1., 0.], unitVec)
    
    # check posi-negativity
    if(yAbsAngle >=90.): angle = -xAbsAngle
    else: angle = xAbsAngle
    
    return angle % 360.

def getAngle(edge):
    vec = rs.VectorUnitize(rs.VectorCreate(edge.end, edge.start))
    angle = vectorAngleIn2D(vec)
    
    return angle

def getFixedCenter(graph):
    cenSrfCorners = graph.vertices[graph.fixed].corners
    cenSrf = rs.AddSrfPt(cenSrfCorners)
    uv = (0.5, 0.5)
    coor = rs.SurfaceParameter(cenSrf, uv)
    refPt = rs.EvaluateSurface(cenSrf, coor[0], coor[1])
    
    return refPt

def getJSON(graph):
    
    center = getFixedCenter(graph)
    
    json = {}
    json["adjMat"] = getAdjMat(graph)
    
    json["nodes"] = getNodes(graph, center)
    json["edges"] = getEdges(graph, center)
    
    return json

def getAdjMat(graph):
    
    adjMat = [[0] * len(graph.vertices) for i in range(len(graph.edges))]
    for edge in graph.adjEV:
        for vertex in graph.adjEV[edge]:
            adjMat[edge][vertex] = 1
    
    return adjMat

def getNodes(graph, center):
    
    nodes = []
    for i in range(len(graph.vertices)):
        node = graph.vertices[i]
        isFixed = i == graph.fixed
        nodeVec = getNodeVec(node, center, isFixed)
        nodes += [nodeVec]
    
    return nodes

def getNodeVec(node, center, isFixed):
    
    vec = []
    # get geometry
    # get surface
    srf = rs.AddSrfPt(node.corners)
    # get center
    coor = rs.SurfaceParameter(srf, (0.5, 0.5))
    cenPt = rs.EvaluateSurface(srf, coor[0], coor[1])
    vec += [cenPt[i] for i in range(len(cenPt))]
    # get eight corners
    for k in [0, 1]: # height
        for i in [0, 1]: # length
            for j in [0, 1]: # width
                coor = rs.SurfaceParameter(srf, (i, j))
                pt = rs.EvaluateSurface(srf, coor[0], coor[1])
                z = -2 if k == 0 else 2
                ptCoor = [pt[0], pt[1], z]
                vec += ptCoor
    
    # get bc
    # get fixed end condition
    fixedBC = 1 if isFixed else 0
    vec += [fixedBC]
    # get vector pointing to center
    cenVec = [center[0] - cenPt[0], center[1] - cenPt[1], center[2] - cenPt[2]]
    vec += cenVec
    
    return vec

def getEdges(graph, center):
    
    edges = []
    for edge in graph.edges:
        edgeVec = getEdgeVec(edge, center)
        edges += [edgeVec]
        
    return edges

def getEdgeVec(edge, center):
    
    vec = []
    # get geometry
    srf = rs.AddSrfPt(edge.corners)
    length = rs.Distance(edge.start, edge.end)
    ratio = edge.actLen / length
    # get center
    coor = rs.SurfaceParameter(srf, (0.5, 0.5))
    cenPt = rs.EvaluateSurface(srf, coor[0], coor[1])
    vec += [cenPt[i] for i in range(len(cenPt))]
    # get three frames
    for i in [0, 0.5, 1]: # frame
        for k in [0, 1]: # height
            for j in [0, 1]: # width
                coor = rs.SurfaceParameter(srf, (i, j))
                pt = rs.EvaluateSurface(srf, coor[0], coor[1])
                z = -2 if k == 0 else 2
                ptCoor = [pt[0], pt[1], z]
                vec += ptCoor
    
    # get stress fields
    angle = getAngle(edge)
    actStress = orientStress(ACTSTRESS, angle, 0)
    conStress = orientStress(CONSTRESS, angle, 90)
    actTop = edge.actLen > 0
    for i in [0, 0.5, 0.5, 1]: # frame
        isEnd = i == 0 or i == 1
        for offset in [(0, 0), (1, 0), (0, 1), (1, 1)]:
            j, k = offset
            isAct = getStressGroup(i, j, k, ratio)
            
            if(isAct): vec += actStress
            else: vec += conStress
    
    # get bc
    # get actuator length assignment
    vec += [ratio]
    # get vector pointing to center
    cenVec = [center[0] - cenPt[0], center[1] - cenPt[1], center[2] - cenPt[2]]
    vec += cenVec
    
    return vec

def getStressGroup(i, j, k, ratio):
    
    actOnTop = ratio > 0
    sampOnTop = k == 1
    isFullAct = abs((1 - abs(ratio))) < EPSILON
    
    if (i == 0 or i == 1): # head, tail
        if(isFullAct):
            if(actOnTop == sampOnTop):
                return True
            else:
                return False
        else:
            return False
    
    else: # center
        if(abs(ratio) < EPSILON): # passive beam
            return False
        else:
            if(actOnTop == sampOnTop):
                return True
            else:
                return False
    
    assert(False) # no assignment error

def getModel(json):
    
    geos = graphToGeo(json, "out")
    blocks = geosToTree(geos)
    
    return blocks

class OptimPt(object):
    def __init__(self, source, coor, tag, txt):
        self.source = source
        self.coor = coor
        self.tag = tag
        self.txt = txt
    
    def __eq__(self, other):
        
        if(isinstance(other, OptimPt)):
            return self.txt == other.txt
        elif(isinstance(other, str)):
            return self.txt == other
        
    def __hash__(self):
        return hash(self.txt)

class Corner(object):
    def __init__(self, e0, e1, cen, ang):
        self.e0 = e0
        self.e1 = e1
        self.cen = cen
        self.ang = ang
    
    def split(self, maxAdd):
        
        add = min(int(round(self.ang / 90)), maxAdd + 1)
        angStep = self.ang / add
        
        edges = []
        for i in range(add + 1):
            newE = rs.RotateObject(self.e0, self.cen, angStep * i, copy=True)
            edges += [newE]
        
        newCorners = []
        for i in range(add):
            newC = Corner(edges[i], edges[i + 1], self.cen, angStep)
            newCorners += [newC]
        
        return newCorners
        
    def pt(self):
        
        e0ref = rs.RotateObject(self.e0, self.cen, self.ang * 0.01, copy=True)
        e0ref = rs.CurveMidPoint(e0ref)
        e0off = rs.OffsetCurve(self.e0, e0ref, wid * .5)
        
        e1ref = rs.RotateObject(self.e1, self.cen, self.ang * -0.01, copy=True)
        e1ref = rs.CurveMidPoint(e1ref)
        e1off = rs.OffsetCurve(self.e1, e1ref, wid * .5)
        
        intPt = rs.LineLineIntersection(e0off, e1off)[0]
        
        return intPt

class HalfedgeBase(object):
    def __init__(self, nxt=None, prev=None, twin=None, edge=None,
                 isOutline=False, isReal=True, face=None, vertex=None):
        self.next = nxt
        self.prev = prev
        self.twin = twin
        self.edge = edge
        self.isOutline = isOutline
        self.isReal = isReal
        self.face = face
        self.vertex = vertex
        
    def vec(self):
        
        return rs.VectorSubtract(self.twin.vertex.pt, self.vertex.pt)
    
    def render(self):
        
        edge = self.edge.edge
        base = self.vertex.pt
        rotated = rs.RotateObject(edge, base, -1, copy=True)
        refPt = rs.CurveMidPoint(rotated)
        off = rs.OffsetCurve(edge, refPt, 5)[0]
        
        cen = rs.CurveMidPoint(off)
        vec = rs.VectorUnitize(rs.PointSubtract(self.twin.vertex.pt, base))
        vec = rs.VectorScale(vec, 5)
        
        return cen, vec

class VertexBase(object):
    def __init__(self, pt=None, deg=None, halfedge=None):
        self.pt = pt
        self.deg = deg
        self.halfedge = halfedge
        
    def adjHalfedges(self):
        start = self.halfedge
        adj = [start]
        next = start.twin.next
        
        while next != start:
            adj += [next]
            next = next.twin.next
            
        return adj

class EdgeBase(object):
    def __init__(self, edge=None, halfedge=None, start=None, end=None, mid=None):
        self.edge = edge
        self.halfedge = halfedge
        self.start = start
        self.end = end
        self.mid = mid

class FaceBase(object):
    def __init__(self, face=None, area=None, halfedge=None):
        self.face = face
        self.halfedge = halfedge
        if(area == None): self.area = area
        else: self.area = rs.SurfaceArea(face)[0]

    def adjHalfedges(self):
        start = self.halfedge
        adj = [start]
        next = start.next
        
        while next != start:
            adj += [next]
            next = next.next
            
        return adj

class Halfedge(HalfedgeBase):
    def __init__(self, e, v, index):
        super(Halfedge, self).__init__(edge=e, vertex=v)
        self.index = index
    
    def __eq__(self, other):
        
        eq = isinstance(other, Halfedge) and self.index == other.index
        return eq

class Vertex(VertexBase):
    def __init__(self, p, index):
        super(Vertex, self).__init__(pt=p)
        self.index = index
        self.corners = None
        self.srf = None
        self.axis = None
        self.mat = 0
        
    def __eq__(self, other):
        return isinstance(other, Vertex) and self.index == other.index
        
    def setCorners(self, corners):
        
        # sort along curve
        pairs = []
        unitCir = rs.AddCircle(self.pt, 1)
        for c in corners: 
            # get points
            tar = c.pt()
            line = rs.AddLine(self.pt, tar)
            intPrm = rs.CurveCurveIntersection(unitCir, line)[0][5]
            pairs += [(tar, intPrm)]
            
        pairs = sorted(pairs, key=lambda x:x[1])
        self.corners = [pair[0] for pair in pairs]

class Edge(EdgeBase):
    def __init__(self, e, index):
        eStart = rs.CurveStartPoint(e)
        eEnd = rs.CurveEndPoint(e)
        eMid = rs.CurveMidPoint(e)
        super(Edge, self).__init__(edge=e, start=eStart, end=eEnd, mid=eMid)
        self.index = index
        self.corners = None
        self.srf = None
        self.actLen = 0
        self.actRatio = 0
        self.mat = 0
        
    def __eq__(self, other):
        return isinstance(other, Edge) and self.index == other.index

class Face(FaceBase):
    def __init__(self, f, index):
        super(Face, self).__init__(face=f)
        self.index = index
        
    def __eq__(self, other):
        return isinstance(other, Face) and self.index == other.index

class Graph(object):
    def __init__(self, edges, vertices=None):
        self.edges = edges
        self.vertices = None
        self.halfedges = None
        self.faces = None
        self.outline = None
        self.adjVE = {} # dict[vertexID] = [edgeID, edgeID, ...]
        self.adjEV = {} # dict[edgeID] = [vertexID, vertexID, ...]
        self.fixed = None
        self.wasted = None
        if(vertices == None): # for normal construction
            self.newInit()
        else: # for reconstruction with existing vertices
            self.reconMode(vertices)
    
    def newInit(self):
        self.getVertices()
        self.getAdj()
        self.getHalfEdges()
        self.getFaces()
    
    def reconMode(self, vertices):
        
        self.vertices = vertices
        self.getAdj()
        self.getHalfEdges()
        self.getFaces()
        pass
    def getVertices(self):
        
        # get unique vertices
        vertices = []
        for edge in self.edges:
            vertices += [rs.CurveStartPoint(edge), rs.CurveEndPoint(edge)]
        vertices = rs.CullDuplicatePoints(vertices, EPSILON)
                
        # construct vertices
        self.vertices = []
        for i in range(len(vertices)):
            self.vertices += [Vertex(vertices[i], i)]
    
    def getAdj(self):
                
        VE, EV = {}, {}
        # get vertex-edge adjacency
        for i in range(len(self.vertices)):
                    
            v = self.vertices[i]
            # check edge-vertex adjacency
            for j in range(len(self.edges)):
                e = self.edges[j]
                CP = rs.EvaluateCurve(e, rs.CurveClosestPoint(e, v.pt))
                CPDist = rs.Distance(v.pt, CP)
                if(CPDist < EPSILON):
                    VE[i] = VE.get(i, []) + [j]
                    EV[j] = EV.get(j, []) + [i]
                    
            # sort vertex adjaceny edges
            vCircle = rs.AddCircle(v.pt, 1)
            intPrm = [rs.CurveCurveIntersection(vCircle, edge)[0][5]\
                        for edge in [self.edges[eID] for eID in VE[i]]]
            pairs = [(VE[i][index], intPrm[index]) for index in range(len(VE[i]))]
            pairs = sorted(pairs, key=lambda x:x[1])
            VE[i] = [pairs[index][0] for index in range(len(intPrm))]
            v.deg = len(VE[i])
                    
        self.adjVE = VE
        self.adjEV = EV
    
    def getHalfEdges(self):
        
        HE, edges, heID = [], [], 0
        for i in range(len(self.edges)):
            # make edge
            e = self.edges[i]
            edge = Edge(e, i)
            # make halfedge
            points = [self.vertices[vID] for vID in self.adjEV[i]]
            he0 = Halfedge(edge, points[0], heID)
            he1 = Halfedge(edge, points[1], heID + 1)
            he0.twin, he1.twin = he1, he0
            heID += 2
            # assign halfedge
            points[0].halfedge = he0
            points[1].halfedge = he1
            edge.halfedge = he0
            # dump
            HE += [he0, he1]
            edges += [edge]
                
        for edge in edges:
            he0 = edge.halfedge
            he1 = edge.halfedge.twin
            # halfedge 0
            # find next edge
            he0NextAdj = self.adjVE[he1.vertex.index]
            he0NEID = (he0NextAdj.index(edge.index) - 1) % len(he0NextAdj)
            he0NEID = self.adjVE[he1.vertex.index][he0NEID]
            he0NE = edges[he0NEID]
            # find next halfedges
            he0NEhe0 = he0NE.halfedge
            he0NEhe1 = he0NEhe0.twin
            # find correct halfedge
            if(he0NEhe0.vertex == he1.vertex): 
                he0.next = he0NEhe0
                he0NEhe0.prev = he0
            else: 
                he0.next = he0NEhe1
                he0NEhe1.prev = he0
            # halfedge 1
            # find next edge
            he1NextAdj = self.adjVE[he0.vertex.index]
            he1NEID = (he1NextAdj.index(edge.index) - 1) % len(he1NextAdj)
            he1NEID = self.adjVE[he0.vertex.index][he1NEID]
            he1NE = edges[he1NEID]
            # find next halfedges
            he1NEhe0 = he1NE.halfedge
            he1NEhe1 = he1NEhe0.twin
            # find correct halfedge
            if(he1NEhe0.vertex == he0.vertex): 
                he1.next = he1NEhe0
                he1NEhe0.prev = he1
            else: 
                he1.next = he1NEhe1
                he1NEhe1.prev = he1
                    
        self.halfedges = HE
        self.edges = edges
    
    def getFaces(self):
        faces = self.recursiveFaces()
        # sort cells
        pairs = [(f, f.area) for f in faces]
        pairs = sorted(pairs, key=lambda x:x[1])
        faces = [pair[0] for pair in pairs]
        self.outline = faces.pop()
        self.faces = faces
        
        for he in self.outline.adjHalfedges():
            he.isOutline = True
    
    def recursiveFaces(self, heIndices=None, fIndex=0):
        if(heIndices == None): # input check
            heIndices = set(range(len(self.halfedges)))
                    
        if(len(heIndices) == 0): # base case
            return []
        else: # recursion case
            # get consecutive halfedges
            faceIDs = [heIndices.pop()]
            nextID = self.halfedges[faceIDs[0]].next.index
            while (nextID != faceIDs[0]):
                heIndices.remove(nextID)
                faceIDs += [nextID]
                nextID = self.halfedges[nextID].next.index
                        
            # convert into polyline surface
            corners = [self.halfedges[id].vertex.pt for id in faceIDs]
            corners += [corners[0]]
            outline = rs.AddPolyline(corners)
            face = Face(rs.AddPlanarSrf(outline)[0], fIndex)
            face.halfedge = self.halfedges[faceIDs[0]]
            for id in faceIDs: self.halfedges[id].face = face
            
            return [face] + self.recursiveFaces(heIndices, fIndex + 1)
    
    def getCorners(self):
        
        result = []
        # get joint corners
        for v in self.vertices:
            corners = []
            for he in v.adjHalfedges():
                # get angle
                vec0 = he.vec()
                vec1 = he.prev.twin.vec()
                vec0Ang = vectorAngleIn2D(vec0)
                vec1Ang = vectorAngleIn2D(vec1)
                ang = (vec1Ang - vec0Ang) % 360 # in degrees
                # construct corner
                newCorner = Corner(he.edge.edge, he.prev.edge.edge, he.vertex.pt, ang)
                corners += [newCorner]
                
            corners = self.expandCorners(corners)
            
            v.setCorners(corners)
            v.srf = rs.AddSrfPt(v.corners)
            
        # get edge corners
        for e in self.edges:
            corners = []
            # head
            vHead = e.halfedge.vertex
            cHead = vHead.corners
            for i in range(len(cHead)):
                line = rs.AddLine(cHead[i], cHead[(i + 1)% len(cHead)])
                intEvent = rs.CurveCurveIntersection(e.edge, line)
                if(intEvent != None):
                    corners += [cHead[i], cHead[(i + 1)% len(cHead)]]
            # tail
            vTail = e.halfedge.twin.vertex
            cTail = vTail.corners
            for i in range(len(cTail)):
                line = rs.AddLine(cTail[i], cTail[(i + 1)% len(cTail)])
                intEvent = rs.CurveCurveIntersection(e.edge, line)
                if(intEvent != None):
                    corners += [cTail[i], cTail[(i + 1)% len(cTail)]]
                    
            corners = corners[1:] + [corners[0]]
            corners.reverse()
            e.corners = corners
            e.srf = rs.AddSrfPt(e.corners)
    
    def expandCorners(self, corners, depth=0):
        if(len(corners) >= 4 or depth >= 4): # base case
            return corners
        # supplement, recursion case
        # find max
        maxC, maxA, maxIndex = corners[0], corners[0].ang, 0
        for i in range(len(corners)):
            c = corners[i]
            if(c.ang > maxA):
                maxC, maxA, maxIndex = c, c.ang, i
        #split max into multiple
        toAdd = 4 - len(corners)
        
        corners = corners[:maxIndex] + maxC.split(toAdd) + corners[maxIndex + 1:]
        
        return self.expandCorners(corners, depth + 1)
    
    def setActLens(self, actLens):
        
        for line in actLens:
            if(not ':' in line): continue
            items = line.split(':')
            try:
                id, actLen = int(items[0]), float(items[1])
                edgeLen = rs.CurveLength(self.edges[id].edge)
                setLen = abs(actLen * edgeLen)
                if(setLen != 0 and setLen < minActLen): setLen = minActLen
                
                if(actLen < 0): setLen *= -1
                
                self.edges[id].actRatio = actLen
                self.edges[id].actLen = setLen
    
            except: continue
    
    def setWasted(self, edges):
        
        wasted = []
        for i in range(len(edges)): wasted += [Edge(edges[i], i)]
        self.wasted = wasted
    
    def setFixed(self, fixedID):
        
        if(isinstance(fixedID, int) or \
           (isinstance(fixedID, str) and fixedID.isnumeric())):
            self.fixed = int(fixedID)
        else: # random
            nodes = [v.pt for v in self.vertices]
            self.fixed = rs.PointArrayClosestPoint(nodes, fixedID)
    
    def showHalfedges(self):
    
        base, vec = [], []
        for he in self.halfedges:
            
            pt, v = he.render()
            base += [pt]
            vec += [v]
            
        return base, vec
    
    def output(self):
        
        jointCens, jointSrfs, jointAxes = [], [], []
        edges, edgeSrfs, actLens = [], [], []
        cells = []
        
        for v in self.vertices:
            jointCens += [v.pt]
            jointSrfs += [v.srf]
            jointAxes += [v.axis]
        for e in self.edges:
            edges += [e.edge]
            edgeSrfs += [e.srf]
            actLens += [e.actLen]
        for f in self.faces:
            cells += [f.face]
        fixed = self.fixed
        
        return jointAxes, jointSrfs, jointCens, edges, edgeSrfs, actLens, cells, fixed

def vectorAngleIn2D(vector):
    # get the angle of a vector w.r.t. the global x-axis
    # parameter:
    #   the vector to measure
    # return:
    #   the angle w.r.t. the globla x-axis in degrees
    
    # check the angle against x and y vectors
    unitVec = rs.VectorUnitize(vector)
    xAbsAngle = rs.VectorAngle([1., 0., 0.], unitVec)
    yAbsAngle = rs.VectorAngle([0., 1., 0.], unitVec)
    
    # check posi-negativity
    if(yAbsAngle >= 90.): angle = -xAbsAngle
    else: angle = xAbsAngle
    
    return angle % 360.

def flattenCurves(curves):
            
    flat = []
            
    for curve in curves:
        if(curve == None): continue
        segments = rs.ExplodeCurves(curve)
        if(len(segments) == 0): segments = [curve]
        flat += segments
        
    return flat

def clean(edges):
    nodes = []
    for edge in edges:
        nodes += [rs.CurveStartPoint(edge), rs.CurveEndPoint(edge)]
    nodes = rs.CullDuplicatePoints(nodes, EPSILON)
            
    nodes, edges, cleaned = cleanEdges(nodes, edges)
            
    return edges, cleaned

def cleanEdges(nodes, edges, cleaned=None):
    # written as a recursive function
    if(cleaned == None): cleaned = []
    # check degree
    nodesDegree = []
    # get node neighbor
    for node in nodes:
        neighbor = 0
        for edge in edges:
            start, end = rs.CurveStartPoint(edge), rs.CurveEndPoint(edge)
            dist = min(rs.Distance(start, node), rs.Distance(end, node))
            if(dist < EPSILON): neighbor += 1
        nodesDegree += [neighbor]
            
    if(1 in nodesDegree or 0 in nodesDegree): clean = False
    else: clean = True
            
    if(clean):
        # base case
        return nodes, edges, cleaned
    else:
        # remove non-cleaned edges and vertices
        newNodes = []
        for i in range(len(nodes)):
            if(nodesDegree[i] <= 1):
                for j in range(len(edges)):
                    start, end = rs.CurveStartPoint(edges[j]), rs.CurveEndPoint(edges[j])
                    dist = min(rs.Distance(start, nodes[i]), rs.Distance(end, nodes[i]))
                    if(dist < EPSILON):
                        cleaned += [edges.pop(j)]
                        break
            else: newNodes += [nodes[i]]
        # call recursion
        return cleanEdges(newNodes, edges, cleaned)

def reconstructGraph(graph, newVertices):
    
    newEdges = []
    for i in range(len(graph.edges)):
        e = graph.edges[i]
        start = newVertices[e.halfedge.vertex.index].pt
        end = newVertices[e.halfedge.twin.vertex.index].pt
        newEdge = rs.AddLine(start, end)
        newEdges += [newEdge]
    
    newGraph = Graph(newEdges, newVertices)
    
    return newGraph

def copyConfig(graph, source):
    
    graph.wasted = source.wasted
    actAssignments = []
    for i in range(len(source.edges)):
        actAssignments += ["%d:%f" % (i, source.edges[i].actRatio)]
    graph.setActLens(actAssignments)
    graph.setFixed(source.fixed)
    graph.getCorners()
    
    return graph

def addConfig(graph, actRats, fixed):
    
    actAssignments = []
    if(not isinstance(actRats[0], str) or ':' not in actRats[0]):
        for i in range(len(actRats)):
            if(isinstance(actRats[i], str)): 
                assignment = "%d:%s" % (i, actRats[i])
            else:
                assignment = "%d:%f" % (i, actRats[i])
            actAssignments += [assignment]
    else:
        actAssignments = actRats
    graph.setActLens(actAssignments)
    graph.setFixed(fixed)
    graph.getCorners()
    
    return graph

def permutate(graph, amp):
    
    import copy
    
    movements = [[ 1, 0, 0], [ 1,  1, 0], [ 0,  1, 0], [-1,  1, 0],
                 [-1, 0, 0], [-1, -1, 0], [ 0, -1, 0], [ 1, -1, 0]]
    
    graphs = [graph]
    actions = ["No changes"]
    # nodes
    for i in range(len(graph.vertices)):
        if(i == graph.fixed): continue
        for movement in movements:
            vec = rs.AddPoint(movement)
            vec = rs.VectorScale(vec, amp)
            newVertices = [Vertex(graph.vertices[k].pt, k) for k in range(len(graph.vertices))]
            newVertices[i].pt = rs.PointAdd(newVertices[i].pt, vec)
            new = reconstructGraph(graph, newVertices)
            new = copyConfig(new, graph)
            graphs += [new]
            actions += ["Move joint%d by (%s)" % (i, str(rs.coerce3dpoint(vec)))]
            
    # edges
    for i in range(len(graph.edges)):
        for mod in [0.25, -0.25]:
            new = copy.deepcopy(graph)
            length = rs.Distance(new.edges[i].start, new.edges[i].end)
            ratio = new.edges[i].actLen / length
            if(-1 <= ratio + mod <= 1):
                new.edges[i].actLen = (ratio + mod) * length
                graphs += [new]
                actions += ["Change beam%d actuator ratio by %s" % (i, str(mod))]
    
    return graphs, actions

def batchJSON(graphs):
    
    jsons = []
    for graph in graphs:
        jsons += [getJSON(graph)]
        
    return jsons

def selectResult(graphs, id):
    
    seq = []
    for i in range(len(graphs)):
        new = {}
        new["adjMat"] = graphs[i]["adjMat"][id]
        new["nodes"] = graphs[i]["nodes"][id]
        new["edges"] = graphs[i]["edges"][id]
        seq += [new]
    
    return seq

def getRankedActions(rankingFP, count=5):
    
    ranking = eval(readFile(rankingFP))
    
    ranked = []
    indices = []
    for obj in ranking:
        actions = []
        ids = []
        for act in obj[:count]:
            actions += [[str(item) for item in act]]
            ids += [act[0]]
        #actions = '\n'.join(actions)
        ranked += [actions]
        indices += [ids]
    
    return ranked, indices

class SimuLearn(object):
    def __init__(self):
        
        self.name = "SimuLearn"
        
        self.getModel = getModel
        self.getJSON = getJSON
        self.readFile = readFile
        self.writeJSON = writeJSON
        
        self.toolFolder = TOOL_FOLDER
        self.saveFolder = TOOL_FOLDER + SAVE_FOLDER
        
        self.singleFolder = self.toolFolder + SIM_FOLDER + SINGLE_FOLDER
        self.singleConduit = self.singleFolder + CONDUIT_NAME
        self.singleResult = self.singleConduit.replace(".json", "_result.json")
        
        self.batchFolder = self.toolFolder + SIM_FOLDER + BATCH_FOLDER
        self.batchConduit = self.batchFolder + CONDUIT_NAME
        self.batchResult = self.batchConduit.replace(".json", "_result.json")
        self.batchSetting = self.batchFolder + SETTING_NAME
        self.batchRanking = self.batchFolder + RANKING_NAME
        self.batchUpdate = self.batchFolder + ITER_NAME
        
        self.iterHistory = self.toolFolder + SIM_FOLDER + HISTORY_FOLDER
    
    def genGraph(self, edges, actLens, fixedID):
        
        edgesFlat, edgesInvalid = clean(flattenCurves(edges))
    
        graph = Graph(edgesFlat)
        graph.setWasted(edgesInvalid)
        graph.setActLens(actLens)
        graph.setFixed(fixedID)
        graph.getCorners()
        
        return graph
        
    def permutate(self, graph, amp):
        
        return permutate(graph, amp)
        
    def batchJSON(self, graphs):
        
        return batchJSON(graphs)
        
    def writeSettings(self, mode, iteration, optimGoals, optimRepr, goalCoors, actions):
        
    
        if(mode == 1): # interactive mode
            iter = 1
        elif(mode == 2): # auto mode
            iter = iteration
        
        settings = {}
        settings["iter"] = iter
        settings["goals"] = optimGoals
        settings["goalPts"] = goalCoors
        settings["optimRepr"] = optimRepr
        settings["actions"] = actions
        
        writeJSON(self.batchSetting, settings)
    
    def getConduits(self, mode):
    
        
        conduitPath = []
        resultPath = []
        settingPath = []
        rankingPath = []
        if(mode == 0):
            conduitPath = self.singleConduit
            resultPath = self.singleResult
        elif(mode == 1 or mode == 2):
            conduitPath = self.batchConduit
            resultPath = self.batchResult
            settingPath = self.batchSetting
            rankingPath = self.batchRanking
            
        return conduitPath, resultPath, settingPath, rankingPath
    
    def selectResult(self, results, selection):
        
        return selectResult(results, selection)
    
    def getRankedActions(self, count=5):
        
        return getRankedActions(self.batchRanking, count)
    
    def saveGraph(self, graph, path):
        
        dictForm = {}
        
        # vertices
        vertices = []
        for v in graph.vertices:
            pt = v.pt
            vertices += [[pt[0], pt[1], pt[2]]]
        dictForm["vertices"] = vertices
        # connectivity and actLen
        
        edges, actRatios = [], []
        for e in graph.edges:
            startID = e.halfedge.vertex.index
            endID = e.halfedge.twin.vertex.index
            edges += [(startID, endID)]
            actRatios += [e.actRatio]
        
        dictForm["edges"] = edges
        dictForm["actRatio"] = actRatios
        # fixed
        dictForm["fixed"] = graph.fixed
        
        writeJSON(path, dictForm)
    
    def loadGraph(self, edges, vTopo, actRats, fixed):
        
        # vertices
        vertices = []
        for i in range(len(vTopo)):
            eID, pointer = vTopo[i]
            e = edges[eID]
            pt = rs.CurveStartPoint(e) if pointer == 0 else rs.CurveEndPoint(e)
            vertices += [Vertex(pt, i)]
        # construct
        graph = Graph(edges, vertices)
        graph = addConfig(graph, actRats, fixed)
        
        return graph
        
    def getGraphInfo(self, dict):
        
        vertices = [rs.AddPoint(pt) for pt in dict["vertices"]]
        fixed = dict["fixed"]
        
        edges, actLens = [], []
        for i in range(len(dict["edges"])):
            e = dict["edges"][i]
            edges += [rs.AddLine(vertices[e[0]], vertices[e[1]])]
            actLens += ["%d:%.2f" % (i, dict["actRatio"][i])]
        
        return vertices, edges, actLens, fixed
        
    def bakeObject(self, objects, layer=None):
        
        # check target layer
        if(layer == None):
            sc.doc = Rhino.RhinoDoc.ActiveDoc
            layer = rs.CurrentLayer()
            sc.doc = ghdoc
        # create target layer if need be
        sc.doc = Rhino.RhinoDoc.ActiveDoc
        if(not rs.IsLayer(layer)):
            sc.doc = Rhino.RhinoDoc.ActiveDoc
            rs.AddLayer(layer)
            sc.doc = ghdoc
        # convert input to list
        if(not isinstance(objects, list)):
            objects = [objects]
        
        # add objects
        guids = []
        sc.doc = ghdoc
        for object in objects:
            sc.doc = ghdoc
            objGeo = rs.coercerhinoobject(object, True, True).Geometry
            sc.doc = Rhino.RhinoDoc.ActiveDoc
            guids += [sc.doc.Objects.Add(objGeo)]
            
            sc.doc = ghdoc
            
        return guids
    
    def genSquareGrid(self, size=3, span=65, mode=0):
        
        shifts = [((size // 2) - i) for i in range(size)]
        
        # vertices
        vertices = []
        for xShift in shifts:
            for yShift in shifts:
                vertices += [rs.AddPoint(xShift * span, yShift * span)]
        
        # edges
        edges = []
        for j in range(size):
            for i in range(size):
                # x edge
                if(i < size - 1):
                    index0 = i * size + j
                    index1 = (i + 1) * size + j
                    xEdge = [rs.AddLine(vertices[index0], vertices[index1])]
                else: xEdge = []
                # y edge
                if(j < size - 1):
                    index2 = i * size + j
                    index3 = i * size + j + 1
                    yEdge = [rs.AddLine(vertices[index2], vertices[index3])]
                else: yEdge = []
                    
                edges += xEdge + yEdge
        
        # fixed
        fixed = len(vertices) // 2
        
        return vertices, edges, fixed
    
    def getActRatio(self, size, mode=0):
        # mode 0, 1: flat, 2: cone, 3:saddle, 4: developable
        
        actRats = ["0.00"] * ((size * (size - 1)) * 2)
        
        if(mode == 2):
            tars = [3, 5, 7, 8]
            for tar in tars: actRats[tar] = "-0.50"
        elif(mode == 3):
            tarsUp = [0, 2, 5, 7, 10, 11]
            tarsDown =  [1, 3, 4, 6, 8, 9]
            for tar in tarsUp: actRats[tar] = "0.25"
            for tar in tarsDown: actRats[tar] = "-1.00"
        elif(mode == 4):
            tars = [0, 2, 5, 7, 10, 11]
            for tar in tars: actRats[tar] = "-1.00"
            
        actRats = ["%d:%s" % (i, actRats[i]) for i in range(len(actRats))]
            
        return actRats
        
    def sortRefCrvs(self, crvs, ref):
        
        sorted = []
        sc.doc = Rhino.RhinoDoc.ActiveDoc
        crvMid = [rs.CurveMidPoint(crv) for crv in crvs]
        sc.doc = ghdoc
        refMid = [rs.CurveMidPoint(crv) for crv in ref]
        
        for i in range(len(refMid)):
            ref = refMid[i]
            index = rs.PointArrayClosestPoint(crvMid, ref)
            sorted += [crvs[index]]
        
        return sorted
    
    def getObjects(self, prompt, filter):
        
        sc.doc = Rhino.RhinoDoc.ActiveDoc
        result = Rhino.Input.RhinoGet.GetMultipleObjects(prompt, False, filter)
        result = [obj.ObjectId for obj in result[1]]
        sc.doc = ghdoc
        
        return result
    
    def getActions(self, selection, actions):
        
        mods = []
        
        for path in selection.Paths:
            selected = selection.Branch(path)[0]
            if(selected): mods += actions.Branch(path)
        
        return mods
    
    def getUpdates(self, mods):
        
        graphUpdate = {}
        
        nodeUpdate, edgeUpdate = {}, {}
        
        # assign modifications
        for mod in mods:
            items = mod.split(' ')
            if(mod.startswith("Move")): # move node
                subject = int(items[1][len("joint"):])
                mov = eval(items[3])
                nodeUpdate[subject] = nodeUpdate.get(subject, []) + [mov]
            elif(mod.startswith("Change")): # change actuator ratio
                subject = int(items[1][len("beam"):])
                delta = eval(items[5])
                edgeUpdate[subject] = edgeUpdate.get(subject, []) + [delta]
        
        # average
        for node in nodeUpdate.keys():
            allMods = nodeUpdate[node]
            count = len(allMods)
            mov = (0, 0, 0)
            for pt in allMods:
                mov = (mov[0] + pt[0], mov[1] + pt[1], mov[2] + pt[2])
            avg = (mov[0] / count, mov[1] / count, mov[2] / count)
            nodeUpdate[node] = avg
            if(rs.Distance(avg, (0, 0, 0)) < EPSILON): nodeUpdate.pop(node)
        
        for edge in edgeUpdate.keys():
            allMods = edgeUpdate[edge]
            avg = sum(allMods) / len(allMods)
            edgeUpdate[edge] = avg
            
            if(abs(avg) < EPSILON): edgeUpdate.pop(edge)
        
        graphUpdate["nodes"] = nodeUpdate
        graphUpdate["edges"] = edgeUpdate
        
        if(len(nodeUpdate.keys()) == 0 and len(edgeUpdate.keys()) == 0):
            graphUpdate = None
        
        return graphUpdate

    def getNewGraph(self, graph, graphUpdate):
    
        # new vertices
        vertices = []
        for i in range(len(graph.vertices)):
            v = graph.vertices[i]
            pt = v.pt
            # move vertices
            if(i in graphUpdate["nodes"]):
                mov = graphUpdate["nodes"][i]
                pt = rs.PointAdd(pt, mov)
            vertices += [Vertex(pt, i)]
        
        # new edges
        edges, actRats = [], []
        for i in range(len(graph.edges)):
            # reconstruct edge
            e = graph.edges[i]
            sID = e.halfedge.vertex.index
            eID = e.halfedge.twin.vertex.index
            edge = rs.AddLine(vertices[sID].pt, vertices[eID].pt)
            edges += [edge]
            # change actuator ratio
            actRat = e.actRatio
            if(i in graphUpdate["edges"]):
                actRat += graphUpdate["edges"][i]
            actRats += [actRat]
            
        fixed = graph.fixed
        
        newGraph = Graph(edges, vertices)
        newGraph = addConfig(newGraph, actRats, fixed)
        
        return newGraph
    
    def getModelPoints(self, json):
    
        pts = []
        # beams
        for i in range(len(json["edges"])):
            edgeVec = json["edges"][i]
            for j in range(EDGE_PT_COUNT):
                coor = edgeVec[j * COOR_LEN:(j + 1) * COOR_LEN]
                tag = ('e', i, j)
                txt = self.tagToTxt(tag)
                pts += [OptimPt("model", coor, tag, txt)]
        # joints
        for i in range(len(json["nodes"])):
            nodeVec = json["nodes"][i]
            for j in range(NODE_PT_COUNT):
                coor = nodeVec[j * COOR_LEN:(j + 1) * COOR_LEN]
                tag = ('n', i, j)
                txt = self.tagToTxt(tag)
                pts += [OptimPt("model", coor, tag, txt)]
        
        return pts
        
    def getTargetPoints(self, points):
        
        pts = []
        for i in range(len(points)):
            pt = rs.coerce3dpoint(points[i])
            if(pt == None): continue
            coor = [pt[0], pt[1], pt[2]]
            tag = ('g', i)
            txt = self.tagToTxt(tag)
            pts += [OptimPt("goal", coor, tag, txt)]
        
        return pts
    
    def tagToTxt(self, tag):
        
        if(tag[0] == 'e'):
            txt = "beam%d_pt%d" % (tag[1], tag[2])
        elif(tag[0] == 'n'):
            txt = "joint%d_pt%d" % (tag[1], tag[2])
        elif(tag[0] == 'g'):
            txt = "goal%d" % tag[1]
        
        return txt
    
    def cleanLines(self, args):
        
        lines = []
        if(',' in args): lines = args.split(',')
        elif('\n' in args): lines = args.splitlines()
        else: lines = [args]
        
        cleaned = []
        
        validGoals = []
        for line in lines:
            line = line.strip()
            if(line.startswith('#') or line.startswith("Ex")): continue
            line = line.split(' ')
            if (not (len(line) == 3 and line[1] == "to")): continue
            validGoals += [' '.join(line)]
            subject, target = line[0], line[2]
            cleaned += [(subject, target)]
        
        return cleaned, validGoals
    
    def findPts(self, objectives, allPts):
        
        pairs = []
        for obj in objectives:
            sub, tar = obj[0], obj[1]
            if((sub not in allPts) or (tar not in allPts)): continue
            subTag = allPts[sub].tag
            tarTag = allPts[tar].tag
            pairs += [(subTag, tarTag)]
        
        return pairs
    
    def getAllPts(self, pts):
        
        all = {}
        for pt in pts:
            all[pt.txt] = pt
            
        return all
    
    def goalToArray(self, goalPts):
        
        pts = []
        for pt in goalPts:
            pts += [pt.coor]
        
        return pts
    
    def getRep(self, objectives, allPts):
        
        reps = []
        for obj in objectives:
            if(obj[0] in allPts and obj[1] in allPts):
                start = allPts[obj[0]].coor
                end = allPts[obj[1]].coor
                line = rs.AddLine(start, end)
                reps += [line]
        
        return reps

SML = SimuLearn()
toolFolder = SML.toolFolder
saveFolder = SML.saveFolder.replace('/', '\\')
# ---------- end simulearn ----------

filepicker_3 = CreateFilePicker(ButtonLabelText="Browse...", DialogType=1, MustExist=False, Filter="JSON file|*.json", StartingPath=simulearn.saveFolder)
button_8 = CreateButton(ButtonName="Save!", ButtonStyle=0)
merge_6 = Merge(Data1=filepicker_3, Data2=button_8)  # -> graft(Result)
simplegrid = CreateSimpleGrid(UIElements=merge_6, RowDefinitions="Auto", ColumnDefinitions=["3*", "1*"])

filepicker_4 = CreateFilePicker(ButtonLabelText="Browse...", DialogType=0, MustExist=False, Filter="JSON file|*.json", StartingPath=simulearn.saveFolder)
button_9 = CreateButton(ButtonName="Load!", ButtonStyle=0)
merge_7 = Merge(Data1=filepicker_4, Data2=button_9)  # -> graft(Result)
simplegrid_2 = CreateSimpleGrid(UIElements=merge_7, RowDefinitions="Auto", ColumnDefinitions=["3*", "1*"])

textbox_5 = CreateTextBox(Label="Fixed Joint Index\t\t\t", DefaultText="8", UpdateButton=False, showLabel=True)

merge_8 = Merge(
    Data1=checkbox_10,
    Data2=checkbox_5,
    Data3=checkbox_11,
    Data4=checkbox_12,
    Data5=checkbox_13,
    Data6=checkbox_14,
    Data7=textbox_4,
    Data8=checkbox_6,
    Data9=checkbox_15)
expander_2 = CreateExpander(UIElements=merge_8, Header="Hidden", Open=False)  # -> flatten(Expander)
simplegrid_3 = CreateSimpleGrid(UIElements=expander_2, RowDefinitions="Auto", ColumnDefinitions="Auto")

python = GhPythonScript(toolFolder=simulearn.toolFolder)  # -> out, shapeImage
# ---------- python: Python ----------
__author__ = "MorphingMatterLab"
__version__ = "2020.03.08"

import rhinoscriptsyntax as rs

shapeImage = toolFolder + "images/shapes_white.png"
# ---------- end python ----------

button_10 = CreateButton(ButtonName="Reset All", ButtonStyle=0)

panel_3 = Panel("""-1.00
-0.75
-0.50
-0.25
0.00
0.25
0.50
0.75
1.00""")
series = Series(Start=0, Step=1, Count=12)
format = Format(Format="Beam{0}", Culture=127, Data0=series)
default_0_00 = SelectedIndex(4)
pulldown = CreatePulldownMenu(Label=format, ListItems=panel_3, SelectedIndex=default_0_00, showLabel=True)
columns = Integer(3)
cluster = Cluster(data=pulldown, int=columns)
simplegrid_4 = CreateSimpleGrid(UIElements=cluster, RowDefinitions="Auto", ColumnDefinitions="Auto")
scrollviewer = CreateScrollViewer(UIElements=simplegrid_4, HorizontalScrollBarVisibility=0, VerticalScrollBarVisibility=0)
merge_9 = Merge(Data1=button_10, Data2=scrollviewer)  # -> flatten(Result)
expander_3 = CreateExpander(UIElements=merge_9, Header="Actuator Ratios", Open=False)

merge_10 = Merge(Data1=flatten(simplegrid), Data2=flatten(simplegrid_2))
expander_4 = CreateExpander(UIElements=merge_10, Header="Save/Load Design", Open=False)

label = CreateLabel(LabelText="System Message", LabelSize=12, Justification=0)
tb_5 = CreateTextBlock(Text="Nothing to report", TextSize=8, Justification=0)
merge_11 = Merge(Data1=label, Data2=tb_5)
stack_5 = CreateStack(UIElements=merge_11, Horizontal=False)

# ---- group: View
label_2 = CreateLabel(LabelText="Display Color", LabelSize=12, Justification=0)
colorpicker = CreateColorPicker(DefaultColor=ColourSwatch(SwatchColor=RGBA(156, 156, 156, 156)))
merge_12 = Merge(Data1=label_2, Data2=colorpicker)
expander_5 = CreateExpander(UIElements=merge_12, Header="View", Open=False)

# ----
indexshift = Number(0)  # disabled
addition = Addition(A=indexshift)  # disabled
index = Integer(addition)  # disabled

merge_13 = Merge(Data1=stack_3, Data2=stack_5)  # -> graft(Result)
simplegrid_5 = CreateSimpleGrid(UIElements=merge_13, RowDefinitions="Auto", ColumnDefinitions="Auto")  # -> flatten(SimpleGrid)
expander_6 = CreateExpander(UIElements=simplegrid_5, Header="Simulation", Open=True)

object_picker = CSharpScript(run=False, allowMultiple=True, allowNone=True, msg="Pick object(s)", clear=False)  # -> pickedGeometry; inputs run: Boolean, allowMultiple: Boolean, allowNone: Boolean, msg: String, clear: Boolean; disabled
# ---------- object_picker: C# usings ----------
using System.IO;
using System.Linq;
using System.Data;
using System.Drawing;
using System.Reflection;
using System.Windows.Forms;
using System.Xml;
using System.Xml.Linq;
using System.Runtime.InteropServices;

using Rhino.DocObjects;
using Rhino.Collections;
using GH_IO;
using GH_IO.Serialization;
# ---------- object_picker: C# ----------
    // written by Andrew Heumann. Retrieved from https://discourse.mcneel.com/t/set-geometry-in-human-ui/50843/17

    if(run) getNewGeometry(msg, allowMultiple, allowNone);
    pickedGeometry = objIDs;
    if(clear) objIDs.Clear();
# ---------- object_picker: C# additional code ----------
  static List<Guid> objIDs = new List<Guid>();


  void getNewGeometry(string msg, bool allowMultiple, bool allowNone){
    ObjectType filter = ObjectType.AnyObject;

    ObjRef[] rhObjects = new ObjRef[1];


    try{
      Rhino.Commands.Result result = Rhino.Commands.Result.Cancel;
      if(!allowMultiple) {
        ObjRef rhObject;
        result = Rhino.Input.RhinoGet.GetOneObject(msg, allowNone, filter, out rhObject);
        rhObjects[0] = rhObject;

      } else {
        result = Rhino.Input.RhinoGet.GetMultipleObjects(msg, allowNone, filter, out rhObjects);
      }

      if(result == Rhino.Commands.Result.Cancel){

      } else if(result == Rhino.Commands.Result.Success){
        objIDs = rhObjects.Select(o => o.ObjectId).ToList();
        return;
      }
    } catch {

    }
  }
# ---------- end object_picker ----------

values_3 = ValueListener(Elements=pulldown, SomeProperty=True)  # -> flatten(Values), Indices
values_4 = ValueListener(Elements=button_10, SomeProperty=True)  # -> Values, Indices
values_5 = ValueListener(Elements=textbox_5, SomeProperty=True)  # -> Values, Indices
format_2 = Format(Format="{0}:{1}", Culture=127, Data0=series, Data1=values_3.Values)
actuator_assignment = Text(format_2)
fixed_joint_id = Integer(values_5.Values)
reset = Boolean(values_4.Values)

values_6 = ValueListener(Elements=checkbox_7, SomeProperty=True)  # -> Values, Indices
values_7 = ValueListener(Elements=checkbox_8, SomeProperty=True)  # -> Values, Indices
values_8 = ValueListener(Elements=checkbox_9, SomeProperty=True)  # -> Values, Indices
view_warnings = Boolean(values_7.Values)
view_indices = Boolean(values_8.Values)
view_design = Boolean(values_6.Values)

face_display = Boolean(view_design)
text_display = Boolean(view_indices)
check = Boolean(view_warnings)

values_9 = ValueListener(Elements=filepicker_3, SomeProperty=True)  # -> Values, Indices
values_10 = ValueListener(Elements=button_8, SomeProperty=True)  # -> Values, Indices
values_11 = ValueListener(Elements=filepicker_4, SomeProperty=True)  # -> Values, Indices
values_12 = ValueListener(Elements=button_9, SomeProperty=True)  # -> Values, Indices
save_path = FilePath(values_9.Values)
load_path = FilePath(values_11.Values)
save = Boolean(values_10.Values)
load = Boolean(values_12.Values)

values_13 = ValueListener(Elements=button_6, SomeProperty=True)  # -> Values, Indices
values_14 = ValueListener(Elements=slider, SomeProperty=True)  # -> Values, Indices
values_15 = ValueListener(Elements=checkbox_3, SomeProperty=True)  # -> Values, Indices
values_16 = ValueListener(Elements=checkbox_4, SomeProperty=True)  # -> Values, Indices
view_simulated_model = Boolean(values_16.Values)
view_flat_model = Boolean(values_15.Values)
select_timestep = Integer(values_14.Values)

values_17 = ValueListener(Elements=colorpicker, SomeProperty=True)  # -> Values, Indices
display_color = Shader(values_17.Values)

values_18 = ValueListener(Elements=toggle_4, SomeProperty=True)  # -> Values, Indices
values_19 = ValueListener(Elements=checkbox, SomeProperty=True)  # -> Values, Indices
values_20 = ValueListener(Elements=filepicker, SomeProperty=True)  # -> Values, Indices
values_21 = ValueListener(Elements=button_2, SomeProperty=True)  # -> Values, Indices
and = GateAnd(A=values_18.Values, B=values_21.Values)
generate_toolpath = Boolean(values_18.Values)
view_toolpath = Boolean(values_19.Values)
gcode_path = FilePath(values_20.Values)
save_gcode = Boolean(and)

geninp = Boolean(write_inp_files)
gengcode = Boolean(generate_toolpath)

inp_save_path_2 = Text(inp_save_path)
gcode_save_path_2 = FilePath(gcode_path)
save_gcode_2 = Boolean(save_gcode)

values_22 = ValueListener(Elements=checkbox_10, SomeProperty=True)  # -> Values, Indices
values_23 = ValueListener(Elements=checkbox_5, SomeProperty=True)  # -> Values, Indices
values_24 = ValueListener(Elements=checkbox_11, SomeProperty=True)  # -> Values, Indices
values_25 = ValueListener(Elements=checkbox_12, SomeProperty=True)  # -> Values, Indices
values_26 = ValueListener(Elements=checkbox_13, SomeProperty=True)  # -> Values, Indices
values_27 = ValueListener(Elements=checkbox_14, SomeProperty=True)  # -> Values, Indices
values_28 = ValueListener(Elements=textbox_4, SomeProperty=True)  # -> Values, Indices
values_29 = ValueListener(Elements=checkbox_15, SomeProperty=True)  # -> Values, Indices
clear_single_result = Boolean(values_23.Values)
clear_batch_result = Boolean(values_26.Values)
load_single_result = Boolean(values_22.Values)
load_batch_result = Boolean(values_25.Values)
current_iteration = Integer(values_28.Values)
iteration_done = Boolean(values_29.Values)
load_iteration = Boolean(values_24.Values)
auto_run = Boolean(values_27.Values)

values_30 = ValueListener(Elements=checkbox_6, SomeProperty=True)  # -> Values, Indices
run_simulation = Boolean(values_13.Values)
cue_update = Boolean(values_30.Values)
panel_4 = Panel(save_path)
panel_5 = Panel(actuator_assignment)
panel_6 = Panel(view_flat_model)
panel_7 = Panel(view_toolpath)
panel_8 = Panel(load_iteration)
panel_9 = Panel(auto_run)
panel_10 = Panel(current_iteration)
panel_11 = Panel(cue_update)
panel_12 = Panel(view_design)
panel_13 = Panel(view_warnings)
panel_14 = Panel(view_indices)
panel_15 = Panel(save)
panel_16 = Panel(load_path)
panel_17 = Panel(load)
panel_18 = Panel(reset)
panel_19 = Panel(fixed_joint_id)
panel_20 = Panel(run_simulation)
panel_21 = Panel(select_timestep)
panel_22 = Panel(view_simulated_model)
panel_23 = Panel(generate_toolpath)
panel_24 = Panel(gcode_path)
panel_25 = Panel(save_gcode)
panel_26 = Panel(load_single_result)
panel_27 = Panel(clear_single_result)
panel_28 = Panel(load_batch_result)
panel_29 = Panel(clear_batch_result)
panel_30 = Panel(iteration_done)

dispatch = Dispatch(List=pulldown, DispatchPattern=reset)  # -> ListA, ListB
setlist = SetListContents(ListToModify=dispatch.ListA, NewListContents=panel_3, SelectedIndex=default_0_00)

pt = Point([Point(75.12278898, 0.5311549093, -11.48657912), Point(74.71227723, -66.18053899, -11.48657912)])
readbatchresult = GhPythonScript(SML=simulearn.SML, readResult=load_batch_result, clearResult=clear_batch_result, autoRun=auto_run)  # -> out, json, default, blocks, actions, optimGoals, optimRepr, goalPts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
# ---------- readbatchresult: Python ----------
__author__ = "humph"
__version__ = "2019.02.19"

import rhinoscriptsyntax as rs
import Rhino
# data tree import
import clr
import System
clr.AddReference("Grasshopper")
from Grasshopper.Kernel.Data import GH_Path
from Grasshopper import DataTree

class Result(object):
    def __init__(self, result):
        self.result = result

class BatchResult(object):
    def __init__(self, path):
        
        self.json = []
        self.default = []
        self.blocks = []
        self.actions = []
        self.optimGoals = []
        self.goalPts = []
        self.optimRepr = []
        
        self._getItems(path)
    
    def _getItems(self, path):
        
        results = eval(SML.readFile(SML.batchResult))
        res = Result(results)
        
        rankedActions, indices = SML.getRankedActions(5)
        # get all top-ranked results into a tree
        blocksAll = DataTree[Rhino.Geometry.Brep]()
        actionsAll = DataTree[System.String]()
        for i in range(len(indices)):
            for j in range(len(indices[i])):
                graphs = SML.selectResult(res.result, indices[i][j])
                blocks = SML.getModel(graphs)
                actionsAll.AddRange(rankedActions[i][j], GH_Path((i, j)))
                for k in range(len(blocks.Branches)):
                    path =  GH_Path((i, j, k))
                    blocksAll.AddRange(blocks.Branch(k), path)
        
        self.json = SML.selectResult(res.result, 0)
        self.default = SML.getModel(self.json)
        self.blocks = blocksAll
        self.actions = actionsAll
        
        # get optim goals
        setting = eval(SML.readFile(SML.batchSetting))
        pts = []
        for pt in setting["goalPts"]:
            newPt = rs.coerce3dpoint(rs.AddPoint(pt))
            pts += [newPt]
        self.optimGoals = setting["goals"]
        self.goalPts = pts
        self.optimRepr = setting["optimRepr"]

json = []
default = []
blocks = []
actions = []
rankedActions = []
optimGoals = []
optimRepr = []
goalPts = []
resetLoad = []
openWindow = []
resetClear = []

if(clearResult):
    if("res" in locals()):
        del res
    resetClear = False
else:
    if(readResult):
        res = BatchResult(SML.batchResult)
        json = res.json
        default = res.default
        blocks = res.blocks
        actions = res.actions
        optimGoals = res.optimGoals
        optimRepr = res.optimRepr
        goalPts = res.goalPts
        resetLoad = False
        if(not autoRun): openWindow = True
    else:
        if("res" in locals()):
            json = res.json
            default = res.default
            blocks = res.blocks
            actions = res.actions
            optimGoals = res.optimGoals
            optimRepr = res.optimRepr
            goalPts = res.goalPts
            if(not autoRun): openWindow = True
# ---------- end readbatchresult ----------
setcheckbox = SetCheckBox(CheckBoxToModify=checkbox_12, NewCheckBoxLabel="Load batch result", NewValue=readbatchresult.resetLoad)
setcheckbox_2 = SetCheckBox(CheckBoxToModify=checkbox_13, NewCheckBoxLabel="Clear batch result", NewValue=readbatchresult.resetClear)
setcheckbox_3 = SetCheckBox(CheckBoxToModify=checkbox_2, NewCheckBoxLabel="Show update window", NewValue=readbatchresult.openWindow)
view_batch = GhPythonScript(
    SML=simulearn.SML,
    default=readbatchresult.default,
    ranked=readbatchresult.blocks,
    actions=readbatchresult.actions,
    optimGoals=readbatchresult.optimGoals,
    goalPts=readbatchresult.goalPts,
    step=select_timestep,
    rankedColor=ColourSwatch(SwatchColor=RGBA(255, 140, 0, 159)),
    defaultColor=ColourSwatch(SwatchColor=RGBA(140, 140, 140, 75)),
    goalColor=ColourSwatch(SwatchColor=RGBA(255, 0, 0, 213)),
    otherGoalColor=ColourSwatch(SwatchColor=RGBA(176, 125, 125, 213)),
    autoRun=auto_run)  # -> out, actionTags, shapes, colors, camPos, tarPts, cueUpdate, avgDist; inputs default: tree, ranked: tree, actions: tree, optimGoals: list, goalPts: list
# ---------- view_batch: Python ----------
__author__ = "Humphrey Yang"
__version__ = "2020.02.07"

import rhinoscriptsyntax as rs
import Rhino
import System
# data tree import
import clr
clr.AddReference("Grasshopper")
from Grasshopper.Kernel.Data import GH_Path
from Grasshopper import DataTree

def getActionCount(actions):
    
    result = {}
    
    for path in actions.Paths:
        goalID, actionID = path.Indices
        result[goalID] = result.get(goalID, []) + [actionID]
        
    for goal in result:
        result[goal] = len(result[goal])
    
    return result

actionTags = []
shapes = []
colors = []
camPos = []
tarPts = []
cueUpdate = []
avgDist = []

if(default.DataCount != 0):
    count = getActionCount(actions)
    actionTags = DataTree[System.String]()
    shapes = DataTree[System.Guid]()
    colors = DataTree[type(rankedColor)]()
    tarPts = DataTree[System.Guid]()
    camPos = DataTree[Rhino.Geometry.Point3d]()
    distSum, pairCount = 0, 0
    for goalID in count:
        for actionID in range(count[goalID]):
            # get and unpack information
            path = GH_Path((goalID, actionID))
            ranking = list(actions.Branch(path))
            id, dist, actionTxt = int(ranking[0]), float(ranking[1]), ranking[2]
            distSum += dist
            pairCount += 1
            actionTags.Add(actionTxt, path)
            cols = []
            # get default grid
            defaultShapes = list(default.Branch(GH_Path(step)))
            cols += [defaultColor] * len(defaultShapes)
            # get ranked grid
            rankedShapes = list(ranked.Branch(GH_Path((goalID, actionID, step))))
            cols += [rankedColor] * len(rankedShapes)
            # get target goal point
            tarPt = None
            goalShapes, goalColors = [], []
            for pt in optimGoals[goalID]:
                if(pt[0] == 'g'): 
                    tarID = pt[1]
                    tarPt = goalPts[tarID]
            
            for i in range(len(goalPts)):
                goalShapes += [rs.AddSphere(goalPts[i], 1)] 
                if(i == tarID): goalColors += [goalColor]
                else: goalColors += [otherGoalColor]
            cols += goalColors
            # get camera position
            camPt = rs.PointAdd(tarPt, rs.VectorScale(rs.AddPoint(1, 1, 1), dist * 3))
            # add to Branch
            shapes.AddRange(defaultShapes + rankedShapes + goalShapes, path)
            colors.AddRange(cols, path)
            tarPts.Add(tarPt, path)
            camPos.Add(camPt, path)
    if(autoRun):
        avgDist = distSum / pairCount
        cueUpdate = True
# ---------- end view_batch ----------
button_11 = Button(ExpressionNormal="True", ExpressionPressed="False")
setcheckbox_4 = SetCheckBox(CheckBoxToModify=checkbox_6, NewCheckBoxLabel="Cue update", NewValue=view_batch.cueUpdate)
division = Division(A=view_batch.avgDist, B=3)

button_12 = CreateButton(ButtonName="Click to (re)center on goal points", ButtonStyle=0)

button_13 = CreateButton(ButtonName="Apply update!", ButtonStyle=0)

tb_6 = CreateTextBlock(Text="Select updates to apply (0 selected)", TextSize=18, Justification=0)
merge_14 = Merge(Data1=button_12, Data2=tb_6, Data3=button_13)
stack_6 = CreateStack(UIElements=merge_14, Horizontal=True)

readsingleresult = GhPythonScript(SML=simulearn.SML, readResult=load_single_result, clearLoad=clear_single_result)  # -> json, blocks, resetLoad, resetClear
# ---------- readsingleresult: Python ----------
__author__ = "humph"
__version__ = "2019.02.19"

import Rhino
# data tree import
import clr
import System
clr.AddReference("Grasshopper")
from Grasshopper.Kernel.Data import GH_Path
from Grasshopper import DataTree

class Result(object):
    def __init__(self, result):
        self.result = result

json = []
blocks = []
resetLoad = []
resetClear = []

if(clearLoad):
    if("res" in locals()):
        del res
    resetClear = False
else:
    if(readResult):
        results = eval(SML.readFile(SML.singleResult))
        res = Result(results)
        json = res.result
        blocks = SML.getModel(res.result)
        resetLoad = False
    elif("res" in locals()):
        json = res.result
        blocks = SML.getModel(res.result)
# ---------- end readsingleresult ----------
setcheckbox_5 = SetCheckBox(CheckBoxToModify=checkbox_10, NewCheckBoxLabel="Load single result", NewValue=readsingleresult.resetLoad)
setcheckbox_6 = SetCheckBox(CheckBoxToModify=checkbox_5, NewCheckBoxLabel="Clear single result", NewValue=readsingleresult.resetClear)
python_2 = GhPythonScript(singleResult=readsingleresult.blocks, batchResult=readbatchresult.default)  # -> out, simResult; inputs singleResult: tree, batchResult: tree
# ---------- python_2: Python ----------
__author__ = "Humphrey Yang"
__version__ = "2020.02.08"

import rhinoscriptsyntax as rs

simResult = []

if(singleResult.DataCount > 0):
    simResult = singleResult
elif(batchResult.DataCount > 0):
    simResult = batchResult
# ---------- end python_2 ----------
tstat = TreeStatistics(Tree=python_2.simResult)  # -> Paths, Length, Count

item = ListItem(List=tstat.Paths, Index=-1, Wrap=True)
branch_2 = TreeBranch(Tree=python_2.simResult, Path=item, MaintainPaths=True)

item_2 = ListItem(List=tstat.Paths, Index=select_timestep, Wrap=True)
branch_3 = TreeBranch(Tree=python_2.simResult, Path=item_2, MaintainPaths=True)

values_31 = ValueListener(Elements=button_13, SomeProperty=True)  # -> Values, Indices

view_terminal_model = Boolean()
terminal_model = Brep(branch_2)
dispatch_2 = Dispatch(List=terminal_model, DispatchPattern=view_terminal_model)  # -> ListA, ListB
preview = CustomPreview(Geometry=dispatch_2.ListA, Material=display_color)

view_timestep_model = Boolean(view_simulated_model)
timestep_model = Brep(branch_3)
dispatch_3 = Dispatch(List=timestep_model, DispatchPattern=view_timestep_model)  # -> ListA, ListB
preview_2 = CustomPreview(Geometry=dispatch_3.ListA, Material=display_color)

step_size_in_mm_interactive_mode = Slider(5, range=0.01..10)
tb_7 = CreateTextBlock(Text="View ", TextSize=12, Justification=0)
merge_15 = Merge(Data1=button_5, Data2=checkbox_2)
slider_2 = CreateSlider(
    Slider=step_size_in_mm_interactive_mode,
    ShowBounds=False,
    ShowTicks=False,
    ShowTooltip=False,
    ShowValLabel=True,
    showLabel=True)
stack_7 = CreateStack(UIElements=merge_15, Horizontal=True)
merge_16 = Merge(Data1=stack_7, Data2=stack_2)
stack_8 = CreateStack(UIElements=merge_16, Horizontal=False)

checkbox_16 = CreateCheckbox(Label="Arrows ", StartingValue=True)
checkbox_17 = CreateCheckbox(Label="Beam Pts ", StartingValue=False)
checkbox_18 = CreateCheckbox(Label="Joint Pts ", StartingValue=False)
checkbox_19 = CreateCheckbox(Label="Target Pts ", StartingValue=False)
merge_17 = Merge(Data1=tb_7, Data2=checkbox_17, Data3=checkbox_18, Data4=checkbox_19, Data5=checkbox_16)
stack_9 = CreateStack(UIElements=merge_17, Horizontal=True)

merge_18 = Merge(Data1=button_3, Data2=stack_9, Data3=tb_2, Data4=textbox)
expander_7 = CreateExpander(UIElements=merge_18, Header="Goals", Open=True)
merge_19 = Merge(Data1=expander_7, Data2=slider_2, Data3=stack_8)  # -> flatten(Result)
expander_8 = CreateExpander(UIElements=merge_19, Header="Optimization", Open=True)

values_32 = ValueListener(Elements=button_3, SomeProperty=True)  # -> Values, Indices
values_33 = ValueListener(Elements=checkbox_17, SomeProperty=True)  # -> Values, Indices
values_34 = ValueListener(Elements=checkbox_18, SomeProperty=True)  # -> Values, Indices
values_35 = ValueListener(Elements=checkbox_19, SomeProperty=True)  # -> Values, Indices
values_36 = ValueListener(Elements=checkbox_16, SomeProperty=True)  # -> Values, Indices
values_37 = ValueListener(Elements=textbox, SomeProperty=True)  # -> Values, Indices
values_38 = ValueListener(Elements=slider_2, SomeProperty=True)  # -> Values, Indices
values_39 = ValueListener(Elements=button_5, SomeProperty=True)  # -> Values, Indices
values_40 = ValueListener(Elements=textbox_2, SomeProperty=True)  # -> Values, Indices
values_41 = ValueListener(Elements=button_4, SomeProperty=True)  # -> Values, Indices
values_42 = ValueListener(Elements=checkbox_2, SomeProperty=True)  # -> Values, Indices
show_update_window = Boolean(values_42.Values)
optimization_goals = Text(values_37.Values)
view_beam_pts = Boolean(values_33.Values)
view_joint_pts = Boolean(values_34.Values)
view_goal_pts = Boolean(values_35.Values)
view_arrows = Boolean(values_36.Values)
set_targets = Boolean(values_32.Values)
iterations = Integer(values_40.Values)
optimize = Boolean(values_41.Values)
stepsize = Number(values_38.Values)
step = Boolean(values_39.Values)

panel_31 = Panel(stepsize)
panel_32 = Panel(iterations)
panel_33 = Panel(show_update_window)
panel_34 = Panel(set_targets)
panel_35 = Panel(view_beam_pts)
panel_36 = Panel(view_joint_pts)
panel_37 = Panel(view_goal_pts)
panel_38 = Panel(view_arrows)
panel_39 = Panel(optimization_goals)
panel_40 = Panel(step)
panel_41 = Panel(optimize)
target_fetcher = GhPythonScript(SML=simulearn.SML, reference=set_targets)  # -> out, tarPts
# ---------- target_fetcher: Python ----------
__author__ = "Humphrey Yang"
__version__ = "2020.02.06"

import rhinoscriptsyntax as rs
import Rhino

class TarPts(object):
    def __init__(self, pts):
        self.pts = pts

if(reference):
    print("reference points")
    prompt = "select points"
    filter = Rhino.DocObjects.ObjectType.Point
    points = SML.getObjects(prompt, filter)
    targets = TarPts(points)
    tarPts = targets.pts
else:
    print("do nothing")
    if("targets" in locals()): tarPts = targets.pts
    else: tarPts = []
# ---------- end target_fetcher ----------
format_3 = Format(Format="{0}/{1}", Culture=127, Data0=current_iteration, Data1=iterations)
settextblock = SetTextBlockContents(TextBlockToModify=tb, NewTextBlockContents=format_3)
pt_2 = Point(target_fetcher.tarPts)

refresh = Boolean(show_update_window)
actiontags = Text(view_batch.actionTags)
shapes = Brep(view_batch.shapes)
colors = Colour(view_batch.colors)
campos = Text(view_batch.camPos)
tarpos = Point(view_batch.tarPts)
actions = Text(readbatchresult.optimRepr)
mesh = Mesh(shapes)
tstat_2 = TreeStatistics(Tree=mesh)  # -> Paths, Length, Count
ma = MassAddition(Input=tstat_2.Length)  # -> Result, PartialResults
and_2 = GateAnd(A=refresh, B=ma.Result)
dispatch_4 = Dispatch(List=actiontags, DispatchPattern=and_2)  # -> ListA, ListB
dispatch_5 = Dispatch(List=mesh, DispatchPattern=and_2)  # -> ListA, ListB
dispatch_6 = Dispatch(List=colors, DispatchPattern=and_2)  # -> ListA, ListB
dispatch_7 = Dispatch(List=campos, DispatchPattern=and_2)  # -> ListA, ListB
dispatch_8 = Dispatch(List=tarpos, DispatchPattern=and_2)  # -> ListA, ListB
dispatch_9 = Dispatch(List=actions, DispatchPattern=and_2)  # -> ListA, ListB

setslider = SetSlider(UISlider=slider_2, Value=division, Range=Domain(0.01, 10))
checkbox_20 = CreateCheckbox(Label=dispatch_4.ListA, StartingValue=False)
_3dview = Create3DView(MeshToDisplay=dispatch_5.ListA, MeshColors=dispatch_6.ListA, ViewWidth=300, ViewHeight=250)
weave = Weave(Pattern=[0, 1], Stream0=checkbox_20, Stream1=_3dview, NullGaps=False)
stack_10 = CreateStack(UIElements=weave, Horizontal=False)
border = CreateBorder(UIElement=stack_10, BorderThickness=1, BorderColor=RGB(69, 69, 69), CornerRadius=0)
trim = TrimTree(Tree=border, Depth=1)
stack_11 = CreateStack(UIElements=trim, Horizontal=True)
tstat_3 = TreeStatistics(Tree=stack_11)  # -> Paths, Length, Count

flatten = FlattenTree(Tree=checkbox_20, Path="{0}")
values_43 = ValueListener(Elements=flatten, SomeProperty=True)  # -> Values, Indices
graft = GraftTree(Tree=values_43.Values, IncludeEmptyLists=True, IncludeNullItems=True)
match = MatchTree(Tree=graft, Guide=actiontags)

dpath = DeconstructPath(Branch=tstat_3.Paths)  # -> flatten(Indices)
panel_42 = Panel(values_43.Values)
format_4 = Format(Format="objective {0}: {1}", Culture=127, Data0=dpath, Data1=dispatch_9.ListA)

ma_2 = MassAddition(Input=flatten(values_43.Values))  # -> Result, PartialResults
format_5 = Format(Format="Select updates to apply ({0} selected)", Culture=127, Data0=ma_2.Result)
settextblock_2 = SetTextBlockContents(TextBlockToModify=tb_6, NewTextBlockContents=format_5)

label_3 = CreateLabel(LabelText=format_4, LabelSize=24, Justification=0)
weave_2 = Weave(Pattern=[0, 1], Stream0=label_3, Stream1=flatten(stack_11), NullGaps=False)
scrollviewer_2 = CreateScrollViewer(UIElements=weave_2, HorizontalScrollBarVisibility=0, VerticalScrollBarVisibility=0)  # -> flatten(ScrollViewer)
merge_20 = Merge(Data1=flatten(stack_6), Data2=flatten(scrollviewer_2))  # -> flatten(Result)
launchwin = LaunchWindow(Show=show_update_window, Name="Control Window", Width=900, Height=300, ChildStatus=1, EnableHorizScroll=True)

winstat = WindowStatus(Window=launchwin)
set_viewport = GhPythonScript(status=winstat)  # -> out, close
# ---------- set_viewport: Python ----------
__author__ = "Humphrey Yang"
__version__ = "2020.02.07"

import rhinoscriptsyntax as rs

if(status == "Hidden"): close = False
else: close = []
# ---------- end set_viewport ----------
and_3 = GateAnd(A=set_viewport.close, B=show_update_window)
setcheckbox_7 = SetCheckBox(CheckBoxToModify=checkbox_2, NewCheckBoxLabel="Show update window", NewValue=and_3)

addelems = AddElements(Window=launchwin, Elements=merge_20, DoVLChecking=False)  # -> AddedElements, ElementNames

values_44 = ValueListener(Elements=button_12, SomeProperty=True)  # -> Values, Indices
set_view = GhPythonScript(status=values_44.Values, camPos=dispatch_7.ListA, tarPos=dispatch_8.ListA)  # -> out, camPosOut, tarPosOut; inputs camPos: tree, tarPos: tree
# ---------- set_view: Python ----------
__author__ = "Humphrey Yang"
__version__ = "2020.02.07"

import rhinoscriptsyntax as rs

if(status): 
    camPosOut, tarPosOut = camPos, tarPos
else: camPosOut, tarPosOut = [], []
# ---------- end set_view ----------
set3dviewprops = Set3DViewProperties(_3DView=_3dview, CameraLocation=set_view.camPosOut, CameraTarget=set_view.tarPosOut)

panel_43 = Panel("""Custom Input
Flat
Cone
Saddle
Developable""")
pulldown_2 = CreatePulldownMenu(Label="Mode", ListItems=panel_43, showLabel=True)

values_45 = ValueListener(Elements=pulldown_2, SomeProperty=True)  # -> Values, Indices
modeswitch = GhPythonScript(mode=values_45.Indices)  # -> out, text
# ---------- modeswitch: Python ----------
__author__ = "Humphrey Yang"
__version__ = "2020.02.05"

import rhinoscriptsyntax as rs

if (mode == 0):
    text = "Set geometry"
else:
    text = "Generate"
# ---------- end modeswitch ----------
setbtn = SetButton(ButtonToModify=button_7, ButtonName=modeswitch.text)

values_46 = ValueListener(Elements=pulldown_2, SomeProperty=True)  # -> Values, Indices
values_47 = ValueListener(Elements=textbox_3, SomeProperty=True)  # -> Values, Indices
values_48 = ValueListener(Elements=button_7, SomeProperty=True)  # -> Values, Indices
regen_retrieve = Boolean(values_48.Values)
init_mode = Integer(values_46.Indices)
span = Number(values_47.Values)

panel_44 = Panel(init_mode)
panel_45 = Panel(span)
panel_46 = Panel(regen_retrieve)
graph_generator = GhPythonScript(
    SML=simulearn.SML,
    span=span,
    mode=init_mode,
    saveName=load_path,
    generate=regen_retrieve,
    loadSave=load,
    loadIter=load_iteration,
    autoRun=auto_run)  # -> out, skeleton, vTopo, actRats, fixed, resetIter, setConfig, setDone
# ---------- graph_generator: Python ----------
__author__ = "Humphrey Yang"
__version__ = "2020.02.06"

import rhinoscriptsyntax as rs
import scriptcontext as sc
import Rhino

EPSILON = 0.0001

class Skeleton(object):
    def __init__(self, crvs):
        self.crvs = crvs
        self.vertices = None
        self.topo = None
    def getTopo(self, crvs, vertices):
        
        topo = []
        for i in range(len(vertices)):
            v = vertices[i]
            print(v)
            checked = False
            for j in range(len(crvs)):
                e = crvs[j]
                sPt = rs.CurveStartPoint(e)
                ePt = rs.CurveEndPoint(e)
                print(rs.coerce3dpoint(v), sPt, ePt)
                if(rs.Distance(v, sPt) < EPSILON):
                    topo += [(j, 0)]
                    checked = True
                elif(rs.Distance(v, ePt) < EPSILON):
                    topo += [(j, 1)]
                    checked = True
                if(checked): break
                
        self.topo = topo

sc.doc = ghdoc

vertices = []
edges = []
actRats = []
fixed = []
resetIter = []
setConfig = []
setDone = []
reference = False

if(loadSave and len(saveName) != 0): # load from save
    print("load save")
    print(saveName)
    graphRep = eval(SML.readFile(saveName))
    vertices, edges, actRats, fixed = SML.getGraphInfo(graphRep)
    reference = True
    setConfig = True
elif(generate): # create
    print("creation")
    if(mode != 0): # library initialization
        print("library initialization")
        vertices, edges, fixed = SML.genSquareGrid(size=3, span=span)
        actRats = SML.getActRatio(size=3, mode=mode)
        reference = True
        setConfig = True
    else:
        print("reference custom grid")
        prompt = "Select grid skeleton"
        filter = Rhino.DocObjects.ObjectType.Curve
        edges = SML.getObjects(prompt, filter)
        sk = Skeleton(edges)
elif(loadIter): # load iteration update
    print("load next iteration")
    graphRep = eval(SML.readFile(SML.batchUpdate))
    vertices, edges, actRats, fixed = SML.getGraphInfo(graphRep)
    reference = True
    setConfig = True
    resetIter = False
    if(autoRun):
        setDone = True
else:
    print("do nothing")

if(reference):
    print("reference")
    vertices = [rs.coerce3dpoint(v) for v in vertices] # convert to Point3D
    guids = SML.bakeObject(edges, "SML_Grid_Geo")
    sc.doc = Rhino.RhinoDoc.ActiveDoc
    rs.UnselectAllObjects()
    rs.SelectObjects(guids)
    sk = Skeleton(rs.SelectedObjects())
    sc.doc = ghdoc
    sk.crvs = SML.sortRefCrvs(sk.crvs, edges)
    sk.getTopo(edges, vertices)
    skeleton = sk.crvs
    vTopo = sk.topo
else:
    if("sk" in locals()): skeleton, vTopo = sk.crvs, sk.topo
    else: skeleton, vTopo = [], []
# ---------- end graph_generator ----------
setcheckbox_8 = SetCheckBox(CheckBoxToModify=checkbox_15, NewCheckBoxLabel="Iteration Done", NewValue=graph_generator.setDone)

fixedid_pt = Data(fixed_joint_id)
edges = Curve(graph_generator.skeleton)
actrats = Text(actuator_assignment)
vtopo = Data(graph_generator.vTopo)

setactratios = GhPythonScript(actLists=panel_3, actRats=graph_generator.actRats, fixed=graph_generator.fixed, set=graph_generator.setConfig)  # -> out, indices, fixedID; inputs actLists: list, actRats: list
# ---------- setactratios: Python ----------
__author__ = "Humphrey Yang"
__version__ = "2020.02.05"

import rhinoscriptsyntax as rs

indices = []
fixedID = []
if(set):
    # set actuator ratio
    for i in range(len(actRats)):
        actRat = actRats[i].split(':')[1]
        if(actRat not in actLists): actRat = "0.00"
        indices += [actLists.index(actRat)]
    # set fixed joint
    fixedID = fixed
# ---------- end setactratios ----------
settextbox_2 = SetTextBoxContents(TextBoxToModify=textbox_5, NewTextBoxContents=setactratios.fixedID)
setlist_2 = SetListContents(ListToModify=pulldown, NewListContents=panel_3, SelectedIndex=setactratios.indices)

graph = GhPythonScript(SML=simulearn.SML, vTopo=vtopo, edges=edges, actRats=actrats, fixedID=fixedid_pt)  # -> graph; inputs vTopo: list, edges: list, actRats: list
# ---------- graph: Python ----------
"""Provides a scripting component.
    Inpu=ts:
        x: The x script variable
        y: The y script variable
    Output:
        a: The a output variable"""
        
__author__ = "humph"
__version__ = "2019.04.08"

if(len(edges) != 0 and edges[0] != None):
    if(len(vTopo) != 0 and vTopo[0] != None):
        print("load mode")
        graph = SML.loadGraph(edges, vTopo, actRats, fixedID)
    else:
        print("auto mode")
        graph = SML.genGraph(edges, actRats, fixedID)\

else:
    graph = []
# ---------- end graph ----------

input_generator = GhPythonScript(
    graph=graph,
    width=width,
    height=grid_height,
    widthCount=wcount,
    heightCount=hcount,
    lengthCountFactor=lcount,
    path=inp_save_path_2,
    jobID=index,
    genMode=genmode,
    writeInp=geninp)  # disabled
# ---------- input_generator: Python ----------
__author__ = "Humphrey"
__version__ = "2019.02.02"

import rhinoscriptsyntax as rs
import math as m
import time
import copy

epsilon = 0.0001
nLen = 3 # digits to use in index coords
lineLen = 10 # maximum number of elements in a line in the input file

###############################################################################
# Model classes
###############################################################################

class IDString(object):
    def __init__(self):
        pass
    
    @staticmethod
    def getID(blockType, selfType, elemID, frame, row, layer):
        # format ABCCCDDDEEEFFF
        #   A -> element parent block type, 1:beam, 2:joint
        #   B -> element type, 0:node, 1:element (voxel), 2:nset, 3:elset
        # CCC -> element index
        # DDD -> frame index (length)
        # EEE -> row index (width)
        # FFF -> layer index (height)
        A   = str(blockType)
        B   = str(selfType)
        CCC = (nLen - len(str(elemID))) * '0' + str(elemID)
        DDD = (nLen - len(str(frame))) * '0' + str(frame)
        EEE = (nLen - len(str(row))) * '0' + str(row)
        FFF = (nLen - len(str(layer))) * '0' + str(layer)
        
        return A + B + CCC + DDD + EEE + FFF

    @staticmethod
    def breakID(id):
        # inverse function of getID, returns a dicitonary of information
        # parameter:
        #   IDString
        # return:
        #   a dictionary of informations as listed below
        
        information = {}
        information["blockType"]  = int(id[0])
        information["selfType"]  = int(id[1])
        information["index"] = int(id[2 + 0 * nLen: 2 + 1 * nLen])
        information["frame"] = int(id[2 + 1 * nLen: 2 + 2 * nLen])
        information["row"]   = int(id[2 + 2 * nLen: 2 + 3 * nLen])
        information["layer"] = int(id[2 + 3 * nLen:])
        
        return information

class Primitive(object):
    def __init__(self, id):
        self.id = id # IDString, ID of this primitive
        self.inpIndex = None # int, index of this primitive in the input file

    def __hash__(self):
        return hash(self.id)

    def __eq__(self, other):
        return self.id == other.id

class Node(Primitive):
    def __init__(self, id, coor):
        super(Node, self).__init__(id)
        self.coor = coor # Point3D, point 3D
        self.interface = False # boolean, indicates if this node is at the 
                               # contacting edge between blocks
    
    def __hash__(self):
        # hashing based on coordinates
        return hash((self.coor[0], self.coor[1], self.coor[2]))
    
    def __eq__(self, other):
        # equality based on coordinates
        if(isinstance(other, Node)):
            eq = self.coor[0] == other.coor[0] and \
                 self.coor[1] == other.coor[1] and \
                 self.coor[2] == other.coor[2]
        elif(isinstance(other, list) and len(other) == 3):
            eq = self.coor[0] == other[0] and \
                 self.coor[1] == other[1] and \
                 self.coor[2] == other[2]
        else:
            assert(False)
        
        return eq

class Voxel(Primitive):
    def __init__(self, id, vertices):
        super(Voxel, self).__init__(id)
        self.vertices = vertices # list, IDStrings of vertex nodes

    def __hash__(self):
        return hash(set(self.vertices))
        
    def __eq__(self, other):
        return set(self.vertices) == set(other.vertices)

class PrimitiveSet(object):
    def __init__(self, name, count):
        self.name = name # string, name of this set
        self.count = count # int, number of primitives in this set

class Elset(PrimitiveSet):
    def __init__(self, name, elems, blockID=None):
        super(Elset, self).__init__(name, len(elems))
        self.elems = elems # list, IDstrings of elements
        self.blockID = blockID # int, index of parent block

class Nset(PrimitiveSet):
    def __init__(self, name, nodes, blockID=None):
        super(Nset, self).__init__(name, len(nodes))
        self.nodes = nodes # list, IDStrings of nodes in this set
        self.blockID = blockID # int, index of parent block

class Part(object):
    def __init__(self, blocks, id, elemType, aName, iName, material):
        # names for input file
        self.id = id # string, name of part
        self.elemType = elemType # string, element type of elements
        self.assemblyName = aName # string, name of assembly
        self.instanceName = iName # string, name of instance
        # FEA parameters
        self.material = material # Mateiral object, material for this part
        self.boundaryConditions = [] # list, containing all boundary conditions
        # geometries and elements
        self.blocks = blocks # list, containing all of its blocks
        self.nodes = {} # map, node[nodeID] = Node class object
        self.elems = {} # map, elems[elemID] = Voxel class object
        self.elsets = {} # map, elsets[elsetID] = Elset class objecct
        self.nsets = {} # map, nsets[nsetID] = Nset class object
        self.nMap = {} # map, nMap[rawNodeID] = targetNodeID
        # nMap connects culled points to existing points
    
    def objectListToDict(self, objects):
        # convert element list into dictionarys
        # parameter:
        #   object: dict[IDString/name] = primitive/set
        # return:
        #   a dictionary of the versioan of the input objects
        
        # convert set to list
        if(isinstance(objects, set)): objects = list(objects)
        # check input type
        if (isinstance(objects[0], Primitive)):
            useID = True
        else: useID = False
        
        # convert to dictionary
        dictionary = {}
        for obj in objects:
            if (useID): dictionary[obj.id] = obj
            else: dictionary[obj.name] = obj
        
        return dictionary

class ElemBlock(object):
    def __init__(self, blockType, index, elemLenCount, elemWidCount, 
                 elemHeiCount):
        self.type = blockType # int, type of this block
        self.id = index # int, index of this block
        # geometry: 3D information: elements
        self.elems = [] # list, element IDstrings of this block
        self.eLen = elemLenCount # int, element count along its length
        self.eWid = elemWidCount # int, element count along its width
        self.eHeight = elemHeiCount # int, element count along its height
        # geometry: 3D information: nodes
        self.nodes = [] # list, node IDstrings of this block
        self.nLen = elemLenCount + 1 # int, node count along its length
        self.nWid = elemWidCount + 1 # int, node count along its width
        self.nHeight = elemHeiCount + 1 # int, node count along its height

class Material(object):
    def __init__(self, name, properties):
        self.name = name
        self.properties = properties

###############################################################################
# Abaqus FEA solver classes
###############################################################################

class BoundaryCondition(object):
    def __init__(self, BCType, name, target):
        self.type = BCType # string, type of this boundary condition
        self.name = name # string, name of this boundary condition
        self.target = target # IDString, target nset/elset to apply to

class Solver(object):
    def __init__(self, inc, saveFreq, stepSetting):
        self.increment = inc # Int, number of increments to perform
        self.step = 1. # Float, total steps
        self.stepSetting = stepSetting # String, stepping informaiton
        self.stepSize = self.step / inc # Float, step size of each increment
        self.saveFreq = saveFreq # Int, interval between filesaves
        self.code = self.genCode() # String, code for input file

    def genCode(self):
        # converts the solver itself into the string for input files
        # WARNING: Potential hard-coding
        # return:
        #   a string for the input file solver part
        
        code = ["**",
                "**STEP: Shrinking",
                "**",
                "*Step, name=shrinking, nlgeom=YES, inc=%d" % (self.increment),
                "%s" % (self.stepSetting),
                "**",
                "** Name: BodyForce  Type: Gravity",
                "*Dload",
                ", GRAV, 2195.2, 0., 0., -1.",
                "**",
                "**",
                "**OUTPUT REQUEST",
                "**",
                "*Restart, write, frequency=0",
                "**",
                "** FIELD OUTPUT: F-Output-1",
                "**",
                "*Output, field, variable=PRESELECT",
                "**",
                "**HISTORY OUTPUT: H-Output-1",
                "**",
                "*Output, history, variable=PRESELECT",
                "**",
                "*FILE FORMAT, ASCII",
                "*node file, frequency=%d" % self.saveFreq,
                "U, COORD",
                "*El file, frequency=%d" % self.saveFreq,
                "S, COORD",
                "*End Step"]

        return "\n".join(code)

class InpCompiler(object):
    def __init__(self):
        self.lineLen = lineLen # int, the number of items per line
        self.code = [] # list of strings, blocks of input file codes
                       # change into a string when compiled

    def write(self, path):
        # save the input file to a directory
        # parameter:
        #   path: the file path to save to
        with open(path, "wt") as f:
            f.write(self.code)

    def listInLen(self, inList):
        # format a list of strings into a list of (linelen) of items per line
        # inList:
        #   the list of strings as input
        # return:
        #   a list of strings, formatted
        
        idLines = []
        lineCount = int(m.ceil(len(inList) / self.lineLen))
            
        for i in range(lineCount):
            start, end = i * self.lineLen, (i + 1) * self.lineLen
            idLines += [", ".join(inList[start:end])]
        
        return idLines # returns a list of lines (of IDStrings)

    def compile(self, part, solver):
        # compile the FEA model into an input file
        # parameters:
        #   part: the model as a part to compile for
        #   solver: the solver to use
        
        # header code
        self.addHeader(part)
        # part code
        self.addPart(part)
        # assembly code
        self.addAssembly(part)
        # boundary condition code
        self.addBoundaryConditions(part)
        # add solver
        self.addSolver(solver)
        # final compile
        self.code = '\n'.join(self.code)

    def addHeader(self, part):
        
        code = ["*Heading"]
        code += [self.addTimeStamp()]
        code += [self.addModelnfo(part)]
        code += ["**",
                 "*Preprint, echo=NO, model=NO,history=NO,contact=NO",
                 "**"]
        self.code += ['\n'.join(code)]
    
    def addPart(self, part):
        
        # part code header, grid as a part
        header = ["**", 
                  "**PARTS",
                  "**",
                  "*Part, name=%s" % part.id,
                  "**"]
        
        code = []
        code += [self.addNodeMap(part)]
        code += [self.addNodes(part)]
        code += [self.addElementMap(part)]
        code += [self.addElements(part)]
        code += [self.addAllNset(part)]
        code += [self.addAllElset(part)]
        code += [self.addSection(part.material)]

        footer = ["**",
                  "*End Part",
                  "**"]

        self.code += ["\n".join(header + code + footer)]

    def addAssembly(self, part):
        
        header = ["**",
                  "**ASSEMBLY",
                  "**", 
                  "*Assembly, name=%s" % part.assemblyName,
                  "**"]

        code = []
        code += [self.addInstance(part)]
        code += [self.addBCElsets(part)]
        code += [self.addBCNsets(part)]

        footer = ["**",
                  "*End Assembly",
                  "**",
                  "**ASSEMBLY END",
                  "**"]
        
        self.code += ['\n'.join(header + code + footer)]

    def addBoundaryConditions(self, part):
        
        header = ["**",
                  "**BOUNDARY CONDITIONS",
                  "**"]
        
        code = []
        code += [self.addGravity()]
        code += [self.addMaterial(part.material)]
        code += [self.addFixed(part)]
        code += [self.addStressFields(part)]
        
        footer = ["**",
                  "**BOUNDARY CONDITIONS END",
                  "**"]

        self.code += ["\n".join(header + code + footer)]

    def addSolver(self, solver):
        
        code = ["** ---------------------------------------------------",
                solver.code]

        self.code += ['\n'.join(code)]

    ###########################################################################
    # for header
    ###########################################################################

    def addTimeStamp(self):
        
        date = time.localtime()
        
        curTime = "%d:%d:%d, %d/%d, %d" % (date.tm_hour, date.tm_min,
                                          date.tm_sec,  date.tm_mon, 
                                          date.tm_mday, date.tm_year)
        code = "**Created time: %s" % curTime 
        
        return code
    
    def addModelnfo(self, part):
        
        header = ["**",
                  "****Model design start"]

        code = []
        for line in part.genModelInfo():
            code += ["**" + line]
        
        footer = ["****Model design end",
                  "**"]

        return '\n'.join(header + code + footer)
    

    ###########################################################################
    # for parts
    ###########################################################################

    def addNodeMap(self, part):
        
        header = ["**",
                  "****Node index map start"]
        
        code = []
        for rawID in part.nMap:
            inpIndex = part.nodes[part.nMap[rawID]].inpIndex
            code += ["%s:%d" % (rawID, inpIndex)]
        
        # list into lines-in-lnegth and add **
        code = self.listInLen(code)
        for i in range(len(code)):
            code[i] = "**" + code[i]
        
        footer = ["****Node index map end",
                  "**"]
        
        return '\n'.join(header + code + footer)
    
    def addNodes(self, part):
        
        header = ["**",
                  "*Node",
                  "****Node code start"]
        
        code = []
        for nodeID in part.nodes:
            inpIndex = part.nodes[nodeID].inpIndex
            coor = part.nodes[nodeID].coor
            code += ["%d, %f, %f, %f" % (inpIndex, coor[0], coor[1], coor[2])]
        
        footer = ["****Node code end",
                  "**"]

        return '\n'.join(header + code + footer)

    def addElementMap(self, part):
        
        header = ["**",
                  "****Element index map start"]
        
        code = []
        for elemID in part.elems:
            code += ["%s:%d" % (elemID, part.elems[elemID].inpIndex)]
        
        # list into lines-in-lnegth and add **
        code = self.listInLen(code)
        for i in range(len(code)):
            code[i] = "**" + code[i]
        
        footer = ["****Element index map end",
                  "**"]
        
        return '\n'.join(header + code + footer)

    def addElements(self, part):
        
        header = ["**",
                  "*Element, type=%s" % part.elemType,
                  "****Element code start"]
        
        code = []
        for elemID in part.elems:
            # get voxel input file index
            inpIndex = [str(part.elems[elemID].inpIndex)]
            # translate vertex index from IDString to input file index
            nodeIndex = []
            for nodeID in part.elems[elemID].vertices:
                nodeIndex += [str(part.nodes[nodeID].inpIndex)]
            
            code += [", ".join(inpIndex + nodeIndex)]
        
        footer = ["****Element code end",
                  "**"]

        return '\n'.join(header + code + footer)

    def addAllNset(self, part):
        
        header = ["**",
                  "****Nset code start",
                  "*Nset, nset=allNodes"]
        
        allNodes = [str(part.nodes[nodeID].inpIndex) for nodeID in part.nodes]
        code = self.listInLen(allNodes)

        footer = ["****Nset code end",
                  "**"]

        return '\n'.join(header + code + footer) 

    def addAllElset(self, part):
        
        header = ["**",
                  "****Elset code start",
                  "*Elset, elset=allElems"]
        
        allElems = [str(part.elems[elemID].inpIndex) for elemID in part.elems]
        code = self.listInLen(allElems)

        footer = ["****Elset code end",
                  "**"]

        return '\n'.join(header + code + footer)
    
    def addSection(self, material):
        
        code = ["**", 
                "**Section",
                "*Solid Section, elset=allElems, material=%s" % material.name,
                ","]

        return '\n'.join(code)
    
    ###########################################################################
    # for assembly
    ###########################################################################
    
    def addInstance(self, part):
        
        code = ["**",
                "*Instance, name=%s, part=%s" % (part.instanceName, part.id),
                "*End Instance",
                "**"]

        return '\n'.join(code)

    def addBCElsets(self, part):
        
        code = []
        # create elsets in the assembly (bot/top of beams/joins)
        iName = part.instanceName
        for elsetID in part.elsets:
            if(len(part.elsets[elsetID].elems) == 0): continue
            code += ["****Elset code start",
                     "*Elset, elset=%s, instance=%s" % (elsetID, iName)]
            
            # get input file index list for current element set
            elset = []
            for elemID in part.elsets[elsetID].elems:
                elset += [str(part.elems[elemID].inpIndex)]
            
            code += self.listInLen(elset)
            code += ["****Elset code end",
                     "**"]

        # create a whole body elset
        code += ["****Elset code start",
                 "*Elset, elset=WholeBody, instance=%s" % (iName)]
        whole = []
        for elemID in part.elems:
            whole += [str(part.elems[elemID].inpIndex)]
        
        code += self.listInLen(whole)
        code += ["****Elset code end",
                 "**"]

        return '\n'.join(code)

    def addBCNsets(self, part):
        
        code = []
        # create Nsets in the assembly
        iName = part.instanceName
        for nsetID in part.nsets:
            code += ["****Nset code start",
                     "*Nset, nset=%s, instance=%s" % (nsetID, iName)]
            
            # get input file index list for current element set
            nset = []
            for nodeID in part.nsets[nsetID].nodes:
                nset += [str(part.nodes[part.nMap[nodeID]].inpIndex)]
                
            code += self.listInLen(nset)
            code += ["****Nset code end",
                     "**"]
        
        return '\n'.join(code)

    ###########################################################################
    # for boundary conditions
    ###########################################################################
    
    def addGravity(self):
        # WARNING: potential hard-coding
        
        code = ["**",
                "**Gravity",
                "*Amplitude, name=gravity",
                "             0.,              0.,            0.02,              1.,              1.,              1.",
                "**"]
        
        return '\n'.join(code)

    def addMaterial(self, material):
        
        code = ["**",
                "** MATERIALS",
                "*Material, name=%s" % material.name,
                material.properties,
                "**"]
        
        return '\n'.join(code)

    def addFixed(self, part):
        # adds the fixed-end boundary condition to the input file
        
        header = ["**"]

        code = []
        for bc in part.boundaryConditions:
            if (bc.type != "fixed"): continue
            code += ["****BC code start",
                     "** Name: %s Type: Displacement/Rotation" % bc.name,
                     "*Boundary",
                     "%s, 1, 1" % bc.target,
                     "%s, 2, 2" % bc.target,
                     "%s, 3, 3" % bc.target,
                     "%s, 4, 4" % bc.target,
                     "%s, 5, 5" % bc.target,
                     "%s, 6, 6" % bc.target]

        footer = ["****BC code end",
                  "**"]
        
        return '\n'.join(header + code + footer)
    
    def addStressFields(self, part):
        
        header = ["**"]

        code = []
        for bc in part.boundaryConditions:
            if(bc.type != "stress"): continue
            if(len(part.elsets[bc.target].elems) == 0): continue
            # get stress field
            lx, ly, lz = bc.stress[0], bc.stress[1], bc.stress[2]
            mx, my, mz = bc.stress[3], bc.stress[4], bc.stress[5]
            # convert into code
            code += ["****BC code start",
                     "** Name: %s Type: Stress" % bc.name,
                     "*Initial Conditions, type=STRESS",
                     "%s, %f, %f, %f, %f, %f, %f" % (bc.target, lx, ly, lz, 
                                                                  mx, my, mz),
                     "****BC code end"]
        
        footer = ["**"]

        return '\n'.join(header + code + footer)

###############################################################################
# SimuLearn specific classes
###############################################################################

class FixedBC(BoundaryCondition):
    def __init__(self, name, nSet):
        super(FixedBC, self).__init__("fixed", name, nSet)

class StressFieldBC(BoundaryCondition):
    def __init__(self, name, elset, stressField):
        super(StressFieldBC, self).__init__("stress", name, elset)
        self.stress = stressField # list of 6 floats, stress field values:
        # [xLoad, yLoad, zLoad, xShear, yShear, zShear]

class PLA(Material):
    def __init__(self):
        name = "PLA" # name of material
        prop = ["*Density",
                "1600e-12,",
                "*Hyperelastic, marlow, test data input, moduli=LONG TERM, poisson=0.406",
                "*Uniaxial Test Data",
                "0,0",
                "0.003428908,0.00105919",
                "0.00544862,0.001941748",
                "0.007323257,0.002950603",
                "0.00911724,0.003914298",
                "0.010872231,0.004956363",
                "0.012499622,0.005971668",
                "0.014063711,0.006950565",
                "0.015658519,0.007969418",
                "0.017218036,0.00896269",
                "0.018691275,0.009927793",
                "0.020157714,0.010888575",
                "0.021626546,0.011829675",
                "0.023118138,0.012876575",
                "0.02446893,0.013958725",
                "0.025807884,0.014946725",
                "0.02715986,0.015916775",
                "0.02851366,0.01694575",
                "0.029767913,0.017911825",
                "0.031023824,0.018884",
                "0.032347701,0.01990355",
                "0.033639197,0.0209641",
                "0.034831091,0.02191505",
                "0.036067771,0.02288195",
                "0.037244475,0.023885375",
                "0.038494529,0.024857025",
                "0.039673247,0.025888675",
                "0.040795385,0.026863875",
                "0.041994161,0.02786965",
                "0.043183784,0.028962425",
                "0.044266182,0.029842075",
                "0.04539923,0.03089195",
                "0.046466585,0.03182125",
                "0.0475809,0.032883725",
                "0.048621926,0.033895725",
                "0.049630085,0.034847475",
                "0.050777203,0.03590405",
                "0.051882083,0.036940575",
                "0.052869472,0.03789585",
                "0.053926137,0.038895625",
                "0.05489156,0.039910725",
                "0.055979514,0.0408748",
                "0.056931899,0.041854725",
                "0.057906588,0.0427651",
                "0.058958293,0.0438849",
                "0.059957454,0.044878475",
                "0.060908117,0.045890575",
                "0.061859814,0.0467424",
                "0.06278604,0.0478625",
                "0.063771384,0.04888575",
                "0.064604147,0.04987465",
                "0.065543983,0.050851875",
                "0.066497962,0.051850525",
                "0.067448357,0.052854225",
                "0.068345441,0.053875",
                "0.069245751,0.05478645",
                "0.070117504,0.0558754",
                "0.071031609,0.0568558",
                "0.071864555,0.057859625",
                "0.072713305,0.058865975",
                "0.073571232,0.059803975",
                "0.07449591,0.060782525",
                "0.075329443,0.061781175",
                "0.076129306,0.062832525",
                "0.076966349,0.0638473",
                "0.077819549,0.06477325",
                "0.078591676,0.0658531",
                "0.079464982,0.06684055",
                "0.080250866,0.067726125",
                "0.081139248,0.068842525",
                "0.08191604,0.069847325",
                "0.082638186,0.070799125",
                "0.083448707,0.0717494",
                "0.084263945,0.072821675",
                "0.085034335,0.073729825",
                "0.085806358,0.074712725",
                "0.086601718,0.0757749",
                "0.087361166,0.076743175",
                "0.088147812,0.077785175",
                "0.088797508,0.078738375",
                "0.089625193,0.079772575",
                "0.090354468,0.080718725",
                "0.091036317,0.081806725",
                "0.091756094,0.0827293",
                "0.092517489,0.0836428",
                "0.093247799,0.084782175",
                "0.093991935,0.085821575",
                "0.094639963,0.086768775",
                "0.09538401,0.087793175",
                "0.096079925,0.0888088",
                "0.096756125,0.089776875",
                "0.097405731,0.090697425",
                "0.098130964,0.091775975",
                "0.098863533,0.09278405",
                "0.099543538,0.093825725",
                "0.100224675,0.0947183",
                "0.100876248,0.09573955",
                "0.101542034,0.096773575",
                "0.102168189,0.0978167",
                "0.10276991,0.098726625",
                "0.103481176,0.0997728",
                "0.104121952,0.100715",
                "0.104788909,0.10180925",
                "0.105346304,0.10279825",
                "0.105987196,0.10374575",
                "0.106655533,0.1046935",
                "0.107226881,0.10580475",
                "0.107833257,0.1067285",
                "0.108521047,0.10767875",
                "0.109115035,0.10874325",
                "0.109693383,0.10980475",
                "0.110280132,0.110704",
                "0.110884734,0.1116775",
                "0.111493795,0.11276575",
                "0.112085957,0.11374425",
                "0.112610575,0.1147825",
                "0.113242451,0.115704",
                "0.113841627,0.1166745",
                "0.114385996,0.11777875",
                "0.114961039,0.118689",
                "0.115562336,0.11978725",
                "0.116122655,0.120804",
                "0.116645751,0.1218005",
                "0.117181487,0.122758",
                "0.117770457,0.1236285",
                "0.118339927,0.1247775",
                "0.118892629,0.12581375",
                "0.119391498,0.1267515",
                "0.119958276,0.12769325",
                "0.120474269,0.128808",
                "0.121008381,0.1297485",
                "0.121482251,0.130749",
                "0.122064752,0.13175375",
                "0.122603836,0.13269125",
                "0.123123764,0.133772",
                "0.12360138,0.1347675",
                "0.124105976,0.13578875",
                "0.124667538,0.13674175",
                "0.12512121,0.13778575",
                "0.12559187,0.13867575",
                "0.12613629,0.13977775",
                "0.126672635,0.14080025",
                "0.127149424,0.1416655",
                "0.127620628,0.1427625",
                "0.128105669,0.143712",
                "0.128614396,0.14471775",
                "0.129064678,0.1457595",
                "0.129548137,0.1467325",
                "0.130054262,0.14769",
                "0.130567636,0.148727",
                "0.131014943,0.1497915",
                "0.131483043,0.1507765",
                "0.131974304,0.15173125",
                "0.132436832,0.1527565",
                "0.13284839,0.153745",
                "0.133276322,0.154741",
                "0.133810631,0.15570575",
                "0.134312749,0.156757",
                "0.134765705,0.157743",
                "0.135151618,0.15867275",
                "0.135617995,0.159744",
                "0.136075834,0.16069625",
                "0.136505043,0.1617385",
                "0.136902268,0.1626345",
                "0.137408462,0.163712",
                "0.137870904,0.1647355",
                "0.138301837,0.16576725",
                "0.138664988,0.16667725",
                "0.139159228,0.1677425",
                "0.139562839,0.16869925",
                "0.139978092,0.169577",
                "0.140330171,0.17067725",
                "0.140775335,0.171673",
                "0.141211939,0.172732",
                "0.141618323,0.17373825",
                "0.141992045,0.17464675",
                "0.142398802,0.17565325",
                "0.142818462,0.176716",
                "0.143220375,0.17763725",
                "0.14357966,0.17858725",
                "0.144041323,0.17964375",
                "0.144435581,0.180732",
                "0.144885172,0.18167325",
                "0.145234251,0.18262225",
                "0.145641724,0.1837175",
                "0.146052901,0.18469425",
                "0.14640204,0.185714",
                "0.146743258,0.186669",
                "0.147194735,0.187706",
                "0.147620842,0.18869325",
                "0.147992977,0.18969875",
                "0.148339,0.1906995",
                "0.148742568,0.19169475",
                "0.149143312,0.19265775",
                "0.14946335,0.19363275",
                "0.14982609,0.19469275",
                "0.150193172,0.19565325",
                "0.150647114,0.19671325",
                "0.150959977,0.1977155",
                "0.151305087,0.19862275",
                "*Viscoelastic, frequency=TABULAR, preload=UNIAXIAL",
                "0.620318385,2.496939959,0.01,0.0095",
                "0.673855917,3.234052221,0.0316228,0.0095",
                "0.787531959,3.793608711,0.1,0.0095",
                "0.914540813,4.229978443,0.158489,0.0095",
                "0.992118664,4.448708544,0.251189,0.0095",
                "1.19299232,4.544688076,0.398107,0.0095",
                "1.287099878,5.122955212,0.630957,0.0095",
                "1.511954785,5.448614981,1,0.0095",
                "1.647200323,5.64237332,1.25893,0.0095",
                "1.807335838,5.859576763,1.58489,0.0095",
                "1.992424941,6.082223469,1.99526,0.0095",
                "2.204230557,6.309150269,2.51189,0.0095",
                "2.409320697,6.582694661,3.16228,0.0095",
                "2.757535019,6.851586381,3.98107,0.0095",
                "3.053461307,7.164960188,5.01187,0.0095",
                "3.478290232,7.455624958,6.30957,0.0095",
                "3.94031327,7.969390796,7.94328,0.0095",
                "4.453088598,8.31036258,10,0.0095",
                "4.850710298,8.791959555,12.5893,0.0095",
                "5.738198369,9.305252856,15.8489,0.0095",
                "6.697393927,9.75080071,19.9526,0.0095",
                "7.571223861,10.41262511,25.1189,0.0095",
                "8.710746804,11.11361555,31.6228,0.0095",
                "10.18489863,11.90057138,39.8107,0.0095",
                "11.84241298,12.76822198,50.1187,0.0095",
                "13.68830602,13.46694062,63.0957,0.0095",
                "16.51816646,15.04276059,79.4328,0.0095",
                "20.20377321,16.70908958,100,0.0095"]
        prop = '\n'.join(prop)
        super(PLA, self).__init__(name, prop)

class StaticSolver(Solver):
    def __init__(self):
        inc = 100 # Int, number of increments
        step = 1 # Float, total step
        totalFrames = 10 # Int, number of frames to write into the .fil file
        saveFreq = int(round(inc / totalFrames)) # interval between output
        stepSetting = '\n'.join(["*Static, direct",
                                 "%.5f, %.1f," % (step / inc, step)])
        super(StaticSolver, self).__init__(inc, saveFreq, stepSetting)

class AutoSolver(Solver):
    def __init__(self):
        inc = 5000 # int, number of increments
        step = 1 # Float, total step
        totalFrames = 10 # Int, number of frames to write into the .fil file
        saveFreq = int(round(inc / totalFrames)) # interval between output
        stepSetting = '\n'.join(["*Static", "0.001, %.3f, 1e-20, 1." % (step)])
        super(AutoSolver, self).__init__(inc, saveFreq, stepSetting)

class GridMesh(Part):
    def __init__(self, beams, joints, width, height):
        
        # input file info
        name = "grid2x2" # string, name of this gridmesh
        elemType = "C3D8" # string, the element type to use
        aName = "gridAssembly" # string, assembly name
        iName = "gridInstance" # string, instance name
        material = PLA() # Material, the material to use for this model
        super(GridMesh, self).__init__(beams + joints, name, elemType, 
                                       aName, iName, material)
        # blocks
        self.beams = beams # list, Beam objects in this grid
        self.joints = joints # list, Joint objects in this grid
        # geometry: dimensions
        self.width = width # float, beam width used for this grid
        self.height = height # float, beam height used for this grid
    
    def cullNodes(self, nodeSoup):
        # culls duplicated points and create an indexing map
        # parameter:
        #   nodeSoup: a list of Nodes to process
        # return:
        #   nodeSet: a set of unique nodes
        #   indexMap: a dictionary mapping an IDString to another
        
        indexMap = {}
        nodeInterface, nodeInterfaceID = [], []
        nodeSet = set()
        # joints first
        for node in nodeSoup:
            info = IDString.breakID(node.id)
            if ((info["blockType"] == 1 and not node.interface) or\
                info["blockType"] == 2):
                # new node, point to self
                nodeSet.add(node)
                indexMap[node.id] = node.id
                # add interfaces to a temporary list
                if(node.interface):
                    nodeInterface += [node.coor]
                    nodeInterfaceID += [node.id]
            else:
                # existing node, point to previously seen one
                CPID = rs.PointArrayClosestPoint(nodeInterface, node.coor)
                indexMap[node.id] = nodeInterfaceID[CPID]
        return nodeSet, indexMap
    
    def genNodes(self):
        # generate a clean set of nodes to itself and create an indexing map
        
        # create node soup
        nodeSoup = []
        for block in self.joints + self.beams:
            nodeSoup += block.genNodes()
        
        # cull points
        nSet, indexMap = self.cullNodes(nodeSoup)

        # convert to dictionary
        self.nodes = self.objectListToDict(nSet)
        self.nMap = indexMap
    
    def genElements(self):
        # generate elements: 8-vertices cubic voxel
        
        voxels = []
        for block in self.blocks:
            voxels += block.genVoxels(self.nMap)
        # convert to dictionary
        self.elems = self.objectListToDict(voxels)
    
    def genElsets(self):
        # generate element sets (with boundary conditions)
        
        # boundary condition: stress field
        elsets, bcs = [], []
        for block in self.blocks:
            newElsets, newBCs = block.genElsets() # TODO: need to consider returning more than 2 blocks
            
            # add to lists
            elsets += newElsets
            bcs += newBCs

        # convert to dictionary
        self.elsets = self.objectListToDict(elsets)
        self.boundaryConditions += bcs
    
    def genNsets(self):
        # generate nsets (with boundary conditions)
        
        # boundary condition: fixed points
        nsets, bcs = [], []
        for joint in self.joints:
            if(joint.fixed):
                nset = joint.genNset() # returns a list
                nsets += [nset]
                name = "fixed_" + nset.name
                bcs += [FixedBC(name, nset.name)]
        
        # convert to dictionary
        self.nsets = self.objectListToDict(nsets)
        self.boundaryConditions += bcs
    
    def shift(self):
        # shift the whole model to recenter it around the origin
        
        # find center
        for block in self.blocks:
            if(block.type == 1): continue # skip beams
            if(block.fixed):
                shift = rs.VectorReverse(block.cenCoor)
       
        # shift nodes
        for nodeID in self.nodes:
            self.nodes[nodeID].coor = rs.VectorAdd(self.nodes[nodeID].coor,
                                                  shift)
        
        # shift corner points
        for block in self.blocks:
            for i in range(len(block.corners)):
                block.corners[i] = rs.VectorAdd(block.corners[i], shift)
        
        # shift surfaces
        for block in self.blocks:
            block.surface = rs.MoveObject(block.surface, shift)
    
    def assignIndex(self):
        # assign input file indices to primitives
        
        # assign input file index to nodes
        i = 1
        for nodeID in self.nodes:
            self.nodes[nodeID].inpIndex = i
            i += 1

        # assign input file index to elements
        i = 1
        for elemID in self.elems:
            self.elems[elemID].inpIndex = i
            i += 1
    
    def genModelInfo(self):
        # generate the model design information for the input file
        # return:
        #   the model design as a string
        
        # TODO: need to change this implementation to also save sampling frame index (along the length)
        
        # vertices information
        vHeader = ["Joints",
                   "vertexID, x, y, z"]
        vCode = []
        for joint in self.joints:
            vCode += ["%d, %f, %f, %f" % (joint.id, 
                                          joint.cenCoor[0],
                                          joint.cenCoor[1],
                                          joint.cenCoor[2])]
        # edge information
        bHeader = ["Beams",
                   "beamID, startVertexID, endVertexID, actStress, conStress, "\
                   "actuatorLength(posUp_negBot), actuator first end, "\
                   "actuator second end"]
        bCode = []
        for beam in self.beams:
            if (beam.side): sideFactor = 1.
            else: sideFactor = -1.
            bCode += ["%d, %d, %d, %f, %f, %f, %d, %d" % (beam.id,
                                                      beam.startID,
                                                      beam.endID,
                                                      beam.actStress,
                                                      beam.conStress,
                                                      beam.actLen * sideFactor,
                                                      beam.actStart,
                                                      beam.actEnd)]
        
        return vHeader + vCode + bHeader + bCode

class PlanarBlock(ElemBlock):
    def __init__(self, blockType, id, voxLenCount, voxWidCount, voxHeiCount,
                 width, height, srf):
        super(PlanarBlock, self).__init__(blockType, id, voxLenCount, 
                                          voxWidCount, voxHeiCount)
        # geometry: 3D information
        self.corners = [] # list of Point3D
        self.surface = srf # surface, planar surface of this block
        self.width = width # float, width of this block
        self.height = height # float, height of this block
    
    def genSurface(self):
        # generate the 2D surface of the block from its corner points
        
        self.surface = orientSrf(rs.AddSrfPt(self.corners))

    def genNodes(self):
        # generate the nodes used by this block
        # return:
        #   a list of Nodes of this block
        
        nodes = []
        for i in range(self.nLen):
            u = i / self.eLen
            for j in range(self.nWid):
                v = j / self.eWid
                
                # get reference point coordinates
                coor = rs.SurfaceParameter(self.surface, (u, v))
                refPt = rs.EvaluateSurface(self.surface, coor[0], coor[1])
                
                # compose a node for each layer height
                for k in range(self.nHeight):
                    # get node informaiton
                    z = (k / self.eHeight - .5) * self.height
                    pt = rs.VectorCreate([refPt[0], refPt[1], z], 
                                         [0., 0., 0.])
                    index = IDString.getID(self.type, 0, self.id, i, j, k) # 0:n

                    # save node
                    nodes += [Node(index, pt)]
                    self.nodes += [index]
        
        return nodes

    def genVoxels(self, nMap):
        # generate the voxels for this block
        # parameter:
        #   nMap: a dictionary the maps an node IDString to another
        # return:
        #   a list of Voxels
        
        voxels = []
        t = self.type
        bID = self.id

        for i in range(self.eLen):
            for j in range(self.eWid):
                for k in range(self.eHeight):
                    # get voxel vertices in ccw-bottom-up order
                    vRawID = [IDString.getID(t, 0, bID, i + 1, j + 1, k    ),
                              IDString.getID(t, 0, bID, i    , j + 1, k    ),
                              IDString.getID(t, 0, bID, i    , j    , k    ),
                              IDString.getID(t, 0, bID, i + 1, j    , k    ),
                              IDString.getID(t, 0, bID, i + 1, j + 1, k + 1),
                              IDString.getID(t, 0, bID, i    , j + 1, k + 1),
                              IDString.getID(t, 0, bID, i    , j    , k + 1),
                              IDString.getID(t, 0, bID, i + 1, j    , k + 1)]
                    vertices = [nMap[rawID] for rawID in vRawID]
                    # construct element
                    index = IDString.getID(t, 1, bID, i, j, k) # 1:voxel
                    # save element
                    voxels += [Voxel(index, vertices)]
                    self.elems += [index]
        
        return voxels

    def genNset(self):
        # generate node sets for this block (likely joints)
        # return:
        #   an Nset for this block (for fixed-end assignments)
        
        cenNodes = []

        for nodeID in self.nodes:
            info = IDString.breakID(nodeID)
            layer = info["layer"]
            if((layer - (self.eHeight / 2)) < epsilon): cenNodes += [nodeID]

        return Nset("fixedCenter", cenNodes, self.id)

class Beam(PlanarBlock):
    def __init__(self, id, elemLenCount, elemWidCount, elemHeiCount, width,
                 height, edge, srf, actStress, conStress, actLen, startID, endID):
        super(Beam, self).__init__(1, id, elemLenCount, elemWidCount,
                                    elemHeiCount, width, height, srf)
        # TODO: need to change implemntation to take actuator length as input and stress as a constant
        
        # geometry: design informaiton
        self.startID = startID # the start vertex (joint) index of this beam
        self.endID = endID # the end vertex (joint) index of this beam
        # geometry: skeleton
        self.edge = None # curve, center line of this beam
        self.start = None # Point3D, start point of edge
        self.end = None # Point3D, end point of edge
        self.mid = None # Point3D, mid point of edge
        self.vec = None # Vector3D, normalized vector from start to end
        self.angle = None # float(0-360), angle w.r.t. the x vector
        self.updateSkeleton(edge)
        # geometry: actuator
        self.actLen = None # the length of the actuator
        self.side = None # boolean, true if stress is at top side of the beam
        self.actStartPt = None # Point3D, start of the actuator (on skeleton)
        self.actEndPt = None # Point3D, end of the actuator (on skeleton)
        self.actStart = None # int, the actuator start frame index
        self.actEnd = None # int, the actuator end frame index
        self.updateActuator(actLen)
        
        # TODO: need to change implementation (stress field should be a constant)
        # initial condition: stress field
        self.actStress = actStress # float, stress value along beam direction
        self.conStress = conStress # float, stress value along beam direction
    
    def updateSkeleton(self, edge):
        # update geometrical information for this beam
        # parameter:
        #   edge: line, the edge assigned to this beam
        
        self.edge = edge
        self.start = rs.CurveStartPoint(edge)
        self.end = rs.CurveEndPoint(edge)
        self.mid = rs.CurveMidPoint(edge)
        self.vec = rs.VectorUnitize(rs.VectorCreate(self.end, self.start))
        self.angle = vectorAngleIn2D(self.vec)
    
    def updateActuator(self, actLen):
        # update the actuator info of this beam (orienting from local to global
        # coordinate system)
        # parameter:
        #   a float as the length of the actuator
        
        self.actLen = abs(actLen)
        if(actLen >= 0): side = True # positive, stress to top side
        else: side = False # negative, stress to bottom side
        self.side = side
        
        # get end points of actuator skeleton
        shiftVec = rs.VectorScale(self.vec, self.actLen * .5)
        self.actStartPt = rs.PointAdd(self.mid, -shiftVec)
        self.actEndPt = rs.PointAdd(self.mid, shiftVec)
    
    def sortCorners(self):
        # sort the corner points into order
        
        ordered = [None, None, None, None]
        edgeVec = rs.VectorCreate(self.end, self.start)
        norm = rs.VectorUnitize([edgeVec[1], -1 * edgeVec[0], 0])
        
        for pt in self.corners:
            # check side
            refVec = rs.VectorCreate(pt, self.mid)
            if(rs.VectorDotProduct(norm, refVec) >= 0): side = 0
            else: side = 1
            
            # check end
            startDist = rs.Distance(pt, self.start)
            endDist = rs.Distance(pt, self.end)
            if(startDist <= endDist): end = 0
            else: end = 1
            
            # fill pt into order
            if(side == 0 and end == 0): ordered[0] = pt
            elif(side == 0 and end == 1): ordered[1] = pt
            elif(side == 1 and end == 1): ordered[2] = pt
            elif(side == 1 and end == 0): ordered[3] = pt
            
        self.corners = ordered
    
    def genNodes(self):
        # generate the nodes of this beam
        # return:
        #   a list of Nodes
        
        # get node count along the longitudinal direction
        beamLen = rs.SurfaceArea(self.surface)[0] / self.width
        lengthCount = beamLen / ((self.width / self.eWid) * lengthCountFactor)
        self.eLen = int(int(round(lengthCount / 2)) * 2)
        self.nLen = self.eLen + 1
        
        # generate nodes
        nodes = super(Beam, self).genNodes()
        
        startMinDist, endMinDist = None, None
        startMinFrame, endMinFrame = None, None
        for node in nodes:
            # check for interface nodes
            info = IDString.breakID(node.id)
            localCoor = (info["frame"], info["row"], info["layer"])
            node.interface = self.nodeIsInterface(localCoor)
            
            # check actuator ends
            startDist = rs.Distance(self.actStartPt, node.coor)
            endDist = rs.Distance(self.actEndPt, node.coor)
            if(startMinDist == None or startDist < startMinDist):
                startMinDist = startDist
                startMinFrame = IDString.breakID(node.id)["frame"]
            if(endMinDist == None or endDist < endMinDist):
                endMinDist = endDist
                endMinFrame = IDString.breakID(node.id)["frame"]
        
        if(startMinFrame > endMinFrame): # check frame order
            startMinFrame, endMinFrame = endMinFrame, startMinFrame
        self.actStart = max(startMinFrame, 1)
        self.actEnd = min(endMinFrame, self.nLen - 2)
        return nodes
    
    def nodeIsInterface(self, coor): 
        # checking if a node is at the interface to another block
        # parameters:
        #   coor: coor as a tuple
        # return:
        #   a boolean indicating the interface conditions
        
        lenInterface = coor[0] == 0 or coor[0] == (self.nLen - 1)
        # widInterface = coor[1] == 0 or coor[1] == (self.nWid - 1)
        # heiInterface = coor[2] == 0 or coor[2] == (self.nHeight - 1)

        return lenInterface
    
    def orientStress(self, stress, add):
        # orients a planar stress field from the beam's local to global space
        # parameter:
        #   stress: the stress field (six numbers) at its local space
        #   add: float, 
        #   [sigma11, sigma22, sigma33, sigma12, sigma13, sigma23]
        # return:
        #   the oriented stress field in global space
        
        # theta is the negative value of the beam.angle (w.r.t. x-axis)
        # sigma11 = .5 * stress + .5 * stress * (2 * ((m.cos(theta)) ** 2) - 1)
        
        ang = -1 * (self.angle + add)
        sigma11 = stress * (m.cos(m.radians(ang)) ** 2)
        sigma22 = stress - sigma11
        sigma12 = -1. * stress * (m.sin(m.radians(ang)) * m.cos(m.radians(ang)))
        
        return [sigma11, sigma22, 0., sigma12, 0., 0.]
    
    def genElsets(self):
        # generate the element sets and initial conditions in this block 
        # (actuator and constraint, with and without intial stress)
        # return:
        #   a list of new Elsets and a list of new BCs
        
        elemsTop, elemsBot = [], []
        halfHeight = int(self.eHeight / 2)
        
        # assign voxels to top/bottom
        for elemID in self.elems:
            info = IDString.breakID(elemID)
            
            # identify bottom / top
            layerIndex = info["layer"]
            if (layerIndex >= halfHeight): elemsTop += [elemID]
            else: elemsBot += [elemID]
        
        # assign to actuator/constraint group
        elemsAct, elemsCon, elemsToCheck = [], [], []
        if (self.side): elemsConSide, elemsActSide = elemsBot, elemsTop # top act
        else: elemsConSide, elemsActSide = elemsTop, elemsBot # bot act
        
        for elemID in elemsConSide:
           info = IDString.breakID(elemID)
           rowIndex = info["row"]
           if(rowIndex == 0 or rowIndex == (self.eWid - 1)): # shell
               elemsAct += [elemID]
           else: # infill
               elemsCon += [elemID]
        
        # check if an element is between the actuator interval
        for elemID in elemsActSide:
            info = IDString.breakID(elemID)
            frameIndex = info["frame"]
            rowIndex = info["row"]
            # assign to actuator or constraint group
            if(rowIndex == 0 or rowIndex == (self.eWid - 1)): # shell
                elemsAct += [elemID]
            elif(self.actEnd > frameIndex >= self.actStart): # actuator
                elemsAct += [elemID]
            else: # infill
                elemsCon += [elemID]
        
        # construct elsets
        actElsetName = "%s_%d_act" % ("beam", self.id)
        conElsetName = "%s_%d_con" % ("beam", self.id)
        actElset = Elset(actElsetName, elemsAct, self.id)
        conElset = Elset(conElsetName, elemsCon, self.id)
        
        # construct initial conditions
        actStress = self.orientStress(self.actStress, 0)
        conStress = self.orientStress(self.conStress, 90)
        actBCName = "stress_" + actElsetName
        conBCName = "stress_" + conElsetName
        actStrBC = StressFieldBC(actBCName, actElsetName, actStress)
        conStrBC = StressFieldBC(conBCName, conElsetName, conStress)
        
        return [actElset, conElset], [actStrBC, conStrBC]

class Joint(PlanarBlock):
    def __init__(self, id, voxLenCount, voxWidCount, voxHeiCount,
                 width, height, center, srf, stress, fixed, edges):
         super(Joint, self).__init__(2, id, voxLenCount, voxWidCount, 
                                     voxHeiCount, width, height, srf)
         # geometry: skeleton
         self.center = center # Point3D, center point of this joint
         # boundary condition: fixed joint
         self.fixed = fixed # boolean, indicate wheter this joint is the center
         self.cenCoor = None # Point3D, central node at the middle center
         self.edges = edges # list of indices points to the connected beams
         self.stress = stress # float, stress value

    def sortCorners(self):
        # sort the corner points in CCW order
        
        # sort along a circle at the joint
        prms = []
        circle = rs.AddCircle(self.center, self.width * .5)
        # get curve CP parameter
        for pt in self.corners:
            prm = rs.CurveClosestPoint(circle, pt)
            prms += [prm]
        # sort with curve CP parameter
        temp = [pt for pt in self.corners]
        pairs = zip(temp, prms)
        pairs.sort(key = lambda pair: pair[1])
        result = [pair[0] for pair in pairs]
        self.corners = result

    def genNodes(self):
        # generate the nodes of this joint
        # return:
        #   a list of Nodes
        
        # generate nodes
        nodes = super(Joint, self).genNodes()

        # check for interface nodes
        for node in nodes:
            info = IDString.breakID(node.id)
            localCoor = (info["frame"], info["row"], info["layer"])
            node.interface = self.nIsInterface(localCoor)
        
        # get top center coordinate, 0:node
        cenID = IDString.getID(self.type, 0, self.id, int(self.eLen / 2),
                                                      int(self.eWid / 2),
                                                      int(self.eHeight / 2))
        for node in nodes:
            if(node.id == cenID):
                self.cenCoor = node.coor
        
        return nodes

    def nIsInterface(self, coor):
        # checking if a node is at the interface to another block
        # parameters:
        #   coor: coor as a tuple
        # return:
        #   a boolean indicating the interface conditions
        
        # coor as a tuple
        lenInterface = coor[0] == 0 or coor[0] == (self.nLen - 1)
        widInterface = coor[1] == 0 or coor[1] == (self.nWid - 1)
        # heiInterface = coor[2] == 0 or coor[2] == (self.nHeight - 1)

        return lenInterface or widInterface

    def genElsets(self):
        # generate the element sets in this block (single, no stress)
        # return:
        #   a list of new elsets and a list of new initial conditions (stress)
        
        # construct elsets
        ID = "%s_%d_con" % ("joint", self.id)
        elsetAll = Elset(ID, self.elems, self.id)
        
        # assign initial condition
        stress = [self.stress, self.stress, 0., 0., 0., 0.]
        stressName = "stress_" + ID
        jointStrBC = StressFieldBC(stressName, elsetAll.name, stress)
        
        return [elsetAll], [jointStrBC]

###############################################################################
# Utilities
###############################################################################

def orientSrf(srf):
    # orient a surface so that its normal always points up
    # parameter:
    #   the surface to orient
    # return:
    #   the oriented surface with its normal pointing at positive Z
    
    uDom = rs.SurfaceDomain(srf, 0)
    vDom = rs.SurfaceDomain(srf, 1)
    uCen = (uDom[0] + uDom[1]) * .5
    vCen = (vDom[0] + vDom[1]) * .5
    
    norm = rs.VectorUnitize(rs.SurfaceNormal(srf, [uCen, vCen]))
    dotProd = rs.VectorDotProduct(norm, [0., 0., 1.])
    if(dotProd < 0.): rs.FlipSurface(srf, True)

    return srf

def doubleOffset(edge, width):
    # offset and edge on both sides ( in the xy plane)
    # parameters:
    #   edge: the edge (as a curve or line) to offset
    #   width: the distance of offset
    # return:
    #   two edges on both sides, offsetted with the specified width
    
    # get vector
    start = rs.CurveStartPoint(edge)
    end = rs.CurveEndPoint(edge)
    vec = rs.VectorUnitize(rs.VectorCreate(end, start))
    # get offset direction reference point
    normal = [vec[1], -vec[0], 0.]
    refRight = rs.VectorAdd(start, normal)
    refLeft = rs.VectorAdd(start, rs.VectorReverse(normal))
    
    # offset curve
    edgeRight = rs.OffsetCurve(edge, refRight, width * .5)
    edgeLeft  = rs.OffsetCurve(edge,  refLeft, width * .5)

    return edgeRight, edgeLeft # both are lists

def vectorAngleIn2D(vector):
    # get the angle of a vector w.r.t. the global x-axis
    # parameter:
    #   the vector to measure
    # return:
    #   the angle w.r.t. the globla x-axis in degrees
    
    # check the angle against x and y vectors
    unitVec = rs.VectorUnitize(vector)
    xAbsAngle = rs.VectorAngle([1., 0., 0.], unitVec)
    yAbsAngle = rs.VectorAngle([0., 1., 0.], unitVec)
    
    # check posi-negativity
    if(yAbsAngle >=90.): angle = -xAbsAngle
    else: angle = xAbsAngle
    
    return angle % 360.

def outputElements(gridMesh):
    # output the elements as boxes
    # parameter:
    #   the GridMesh model to output
    # return:
    #   a list of boxes representing the elements of the model
    
    # cubic voxel elements
    output = [rs.AddBox([gridMesh.nodes[nodeID].coor \
                        for nodeID in gridMesh.elems[elemID].vertices]) \
                        for elemID in gridMesh.elems]
    
    return output

def outputElsets(gridMesh):
    # output the element sets as groups of boxes
    # parameter:
    #   the GridMesh model to output
    # return:
    #   a list of boxes representing the elements of the model
    
    # cubic voxel elements
    elems = [rs.AddBox([gridMesh.nodes[nodeID].coor \
                        for nodeID in gridMesh.elems[voxID].vertices])\
                        for voxID in gridMesh.elems]
    elemIDs = [elemID for elemID in gridMesh.elems]
    elemsMap = {}
    for i in range(len(elemIDs)): elemsMap[elemIDs[i]] = elems[i]
    
    act, con = [], []
    for elsetID in gridMesh.elsets:
        setElems = [elemsMap[elemID] for elemID in gridMesh.elsets[elsetID].elems]
        if(elsetID.endswith("con")): con += setElems
        elif(elsetID.endswith("act")): act += setElems
            
    return act, con

def outputNodes(gridMesh):
    # output the elements as points
    # parameter:
    #   the GridMesh model to output
    # return:
    #   a list of Point3D representing the nodes of the model
    
    output = [gridMesh.nodes[nodeID].coor for nodeID in gridMesh.nodes]
    
    return output

def outputBeamSrfs(gridMesh):
    # output the beams as 2D surfaces
    # parameter:
    #   the GridMesh model to output
    # return:
    #   a list of surfaces representing the beams of the model
    
    output = [block.surface for block in gridMesh.beams]
    
    return output

def outputJointSrfs(gridMesh):
    # output the joints as 2D surfaces
    # parameter:
    #   the GridMesh model to output
    # return:
    #   a list of surfaces representing the joints of the model
    
    output = [block.surface for block in gridMesh.joints]
    
    return output

def outputCorners(gridMesh):
    # output the corner points of the model as points
    # parameter:
    #   the GridMesh model to output
    # return:
    #   a list of points representing the block corners of the model
    output = []
    for block in gridMesh.blocks:
        output += block.corners
    #output = [rs.AddPolyline(block.corners + [block.corners[0]]) \
    #          for block in gridMesh.blocks]
    
    return output

###############################################################################
# Main
###############################################################################

def genBlocks(graph, actStr, conStr, w, h, wCount, hCount):
    # generate a GridMesh model with the input edges and joints
    # parameters:
    #   jointCens: list of Point3D, the vertices of the graph
    #   edges: list of lines, the edges of the graph
    #   cells: list of surfaces, the surrounded cells of the graph
    #   fixedID: int, the index of hte fixed joint in the graph
    #   bStr: float, the stress field (local) assigned to the beams
    #   bLen: list of floats, the actuator length assignment (pos-top, neg-bot)
    #   w: float, the width of the beams
    #   h: float, the height of the beams
    #   wCount: int, the number of elements along the width direction of beams
    #   hCount: int, the number of elements along the height direction of beams
    # return:
    #   a GridMesh model constructed with the input graph
    
    beams, joints = [], []
    # construct beams
    lCount = -1 # initialize as -1
    vertices = [v.pt for v in graph.vertices]
    
    for i in range(len(graph.edges)):
        e = graph.edges[i]
        # get start and end point index
        startID = rs.PointArrayClosestPoint(vertices, e.start)
        endID = rs.PointArrayClosestPoint(vertices, e.end)
        edge = rs.AddLine(e.start, e.end)
        srf = rs.AddSrfPt(e.corners)
        beams += [Beam(i, lCount, wCount, hCount, w, h, edge, srf,
                       actStr, conStr, e.actLen, startID, endID)]
        
    # construct joints
    lCount = wCount # same element count on length and width directions
    for i in range(len(graph.vertices)):
        v = graph.vertices[i]
        # check if the joint is the fixed joint
        isFixed = False
        if (i == graph.fixed):
            isFixed = True
        cen = v.pt
        srf = rs.AddSrfPt(v.corners)
        adj = graph.adjVE[i]
        joints += [Joint(i, lCount, wCount, hCount, w, h, v.pt, srf,
                         conStress, isFixed, adj)]
    
    return GridMesh(beams, joints, w, h)

def genInp(gridMesh, path):
    # generate an input file for Abaqus with the input informaiton
    # parameters:
    #   gridMesh: the GridMesh to generate input file for
    # reuturns:
    #   beamSrf: a list of 2D surfaces of the beams
    #   jointSrt: a list of 2D surfaces of hte joints
    
    # generate elements in the part
    # gridMesh.genBlockSrfs() # assign surface
    if(writeInp):
        #=======================================================================
        gridMesh.genNodes() # generate nodes and index map
        gridMesh.genElements() # generate voxels
        gridMesh.genElsets() # generate element sets
        gridMesh.genNsets()
        #=======================================================================
        gridMesh.shift() # shift the mesh to reposition at the origin
        gridMesh.assignIndex() # assign input file index to nodes and elements
        
        # compile input file
        solver = StaticSolver()
        #solver = AutoSolver()
        compiler = InpCompiler()
        compiler.compile(gridMesh, solver)
        compiler.write(path)
    
    # output for debugging
    beamSrf = outputBeamSrfs(gridMesh)
    jointSrf = outputJointSrfs(gridMesh)
    
    return beamSrf, jointSrf

actStress = 0.158
conStress = 0.118


if((genMode == 0 or genMode == 1) and graph != None):
    savePath = path + "job_" + str(int(jobID)) + ".inp"
    gridMesh = genBlocks(graph, actStress, conStress, width, height, widthCount,
                         heightCount)
    beamSrfs, jointSrfs = genInp(gridMesh, savePath)
# ---------- end input_generator ----------
# ---- group: slicer
beam_materials = Panel("")
delete_beams = Panel("")
delete_joints = Panel("")
material = GhPythonScript(graph=graph, materials=beam_materials)  # -> graphOut; inputs materials: list
# ---------- material: Python ----------
__author__ = "Kuanr"
__version__ = "2019.06.26"

import rhinoscriptsyntax as rs

# The material of the block is defined by a single integer:
# 0->PLA, 1->CFPLA
if(graph):
    mat = {}
    
    # parse input to get material assignments
    for assingment in materials:
        try:
            edge, material = assingment.split(':')
            mat[int(edge)] = int(material)
        except:
            continue
    
    # assign material to beams
    for i in range(len(graph.edges)):
        # chekc if the beam index is in the assignments. 
        
        if(i in mat): # If is, assign with assignment
            graph.edges[i].mat = mat[i]
        else: # If not, assign the beam with PLA
            graph.edges[i].mat = 0 # <----- Beam Default Material
    
    # assign material to joints
    for i in range(len(graph.vertices)):
        # assign all joints with CFPLA
        graph.vertices[i].mat = 0 # <----- Joint Default Material
    
graphOut = graph
# ---------- end material ----------
delete = GhPythonScript(graph=material, edgeDel=delete_beams, nodeDel=delete_joints)  # -> graphOut; inputs edgeDel: list, nodeDel: list
# ---------- delete: Python ----------
__author__ = "Kuanr"
__version__ = "2019.06.26"

import rhinoscriptsyntax as rs

if(graph):
    edgeDelCleaned, nodeDelCleaned = [], []
    for id in edgeDel:
        try:
            edgeDelCleaned += [int(id)]
        except:
            continue
    for id in nodeDel:
        try:
            nodeDelCleaned += [int(id)]
        except:
            continue
    
    edgeDel, nodeDel = edgeDelCleaned, nodeDelCleaned
    
    cleanedEdges, cleanedVertices = [], []
    
    for i in range(len(graph.edges)):
        if(i not in edgeDel):
            cleanedEdges += [graph.edges[i]]
    graph.edges = cleanedEdges
    
    
    for i in range(len(graph.vertices)):
        if(i not in nodeDel):
            cleanedVertices += [graph.vertices[i]]
    graph.vertices = cleanedVertices

graphOut = graph
# ---------- end delete ----------
list_3 = ValueList({"In place": 0, "Offset": 1}, selected="In place")
filter = StreamFilter(Gate=genmode, Stream0=graph, Stream1=delete, Stream2=sample)
filter_2 = StreamFilter(Gate=list_3, Stream0=print_offset, Stream1=print_offset)
matcount = Integer(2)
slicer = GhPythonScript(graph=filter, matCount=matcount, buildShift=filter_2, nDia=nozzle_diameter_2, height=grid_height, writeGcode=gengcode)  # -> paths, speeds, LHs, FRAs, mats, zShift
# ---------- slicer: Python ----------
__author__ = "humph"
__version__ = "2019.03.13"

import math
import rhinoscriptsyntax as rs

epsilon = 0.0001

class PathBlock(object): # a gcode path block
    def __init__(self, curves, LHs, FRAs, speeds, center, mats):
        self.refPt = center # Point3D, reference point for sorting blocks
        self.count = len(curves) # Int, number of curves in block
        self.curves = curves # list of Cruves, the extrusion paths of this block
        self.LHs = LHs # list of Floats, layer height of each curve
        self.FRAs = FRAs # list of Floats, flow rate adjustment of each curve
        self.speeds = speeds # list of Floats, print speed of each curve
        self.mats = mats # list of Int, extruder to use
        
    def extract(self, index):
        
        curves = [self.curves[index]]
        LHs = [self.LHs[index]]
        FRAs = [self.FRAs[index]]
        speeds = [self.speeds[index]]
        center = self.refPt
        mats = [self.mats[index]]
        newBlock = PathBlock(curves, LHs, FRAs, speeds, center, mats)
        
        return newBlock
        
class Block(object): # a block to slice
    def __init__(self, srf, axis):
        # Surface, the surface to slice
        self.srf = srf
        # Line, the direction of slicing contour lines
        self.axis = axis
        # Vector3D, constructed from the axis
        self.vec = rs.PointSubtract(rs.CurveStartPoint(axis),
                                    rs.CurveEndPoint(axis))
        # Curve, the outline of the block, constructed from the surface
        self.outline = rs.DuplicateSurfaceBorder(srf)
        # Point3D, center of the block
        self.cen = rs.CurveAreaCentroid(self.outline)[0] # returns a tuple
        # Curve, the inner outline of the block (i.e. innermost shell)
        self.inner = self.outline
        
    def getShells(self, count=1, overlap=0.0):
        # get the shell(s) of a block
        # parameter:
        #   count: Int, the number of shells to generate
        #   overlap: Float, the overlap between shells (0 to 1)
        # return:
        #   a list of curves (shells)
        
        # inward offset for each layer of shell
        shells = []
        offDist = .5 * nDia
        for i in range(count):
            newShells = rs.OffsetCurve(self.outline, self.cen, offDist)
            shells += newShells
            offDist += nDia * (1. - overlap)
        
        # update inner shell
        self.inner = rs.OffsetCurve(shells[-1], self.cen, nDia * .5)
        
        return shells
    
    def rasterize(self, infillOverlap=0.0, shellOverlap=0.0, infillRate=1.0,
                  offset=False, axial=True, join=True):
        # rasterize this block with shells and infills
        # parameter:
        #   infillOverlap: Float, the overlap (0 to 1) between infill lines
        #   shellOverlap: Float, the overlap between shells (0 to 1)
        #   infillRate: Float, the infill rate for slicing (0 to 1)
        #   offset: Bool, to offset the infill by nDia / 2 (for convenience)
        #   axial: Bool, to slice along the axial (or not)
        #   join: Bool, to join the infill lines (or not)
        # return:
        #   a list of curves [shell, infill0, ... infillN]
        
        # get rasterization axis
        interval = (nDia / infillRate) * (1 - (infillOverlap * .5))
        vec = rs.VectorUnitize(self.vec)
        mid = rs.CurveMidPoint(self.axis)
        xAxis = rs.AddLine(mid, rs.PointAdd(mid, vec))
        
        # offset by half a nozzle diameter or flip direction
        if (axial): xAxis = rs.RotateObject(xAxis, mid, 90)
        if (offset):
            shift = rs.PointSubtract(rs.CurveStartPoint(xAxis), 
                                     rs.CurveEndPoint(xAxis))
            shift = rs.VectorScale(shift, interval * .5)
            xAxis = rs.MoveObject(xAxis, shift)
        
        # find the extent of the object in the axial plane
        yAxis = rs.RotateObject(xAxis, mid, 90, copy=True)
        xVec = rs.PointSubtract(rs.CurveEndPoint(xAxis), rs.CurveStartPoint(xAxis))
        yVec = rs.PointSubtract(rs.CurveEndPoint(yAxis), rs.CurveStartPoint(yAxis))
        plane = rs.PlaneFromFrame(rs.CurveStartPoint(xAxis), xVec, yVec)
        
        # stretch the contouring frame to fit the whole object
        extent = rs.PointArrayBoundingBox(rs.CurvePoints(self.outline))
        refDist = max(rs.Distance(extent[0], extent[1]), 
                      rs.Distance(extent[1], extent[2]))
        stretch = (int(math.ceil((refDist / interval))) + 1) * interval
        
        start = rs.PointAdd(rs.VectorScale(xVec, stretch), rs.CurveStartPoint(xAxis))
        end = rs.PointAdd(rs.VectorScale(xVec, -stretch), rs.CurveStartPoint(xAxis))
        cenLine = rs.AddLine(start, end)
        
        # contour
        contours = self.contour(cenLine, interval,
                                shellOverlap=shellOverlap)
            
        # shortcutting 
        if (not join): return contours
        
        # join all curves as a polyline
        pts = []
        for line in contours:
            pts += [rs.CurveStartPoint(line), rs.CurveEndPoint(line)]
        
        return self.infillPolylines(pts)

    def infillPolylines(self, pts):
        # join the infill lines by omitting short print paths or long connectors
        # paramter:
        #   pts: the points to connect into polylines
        # return:
        #   list<Curves>, the connected paths (as much as possible)
        
        lenThres = nDia * 1.5 # threshold to evaluate with curve validity
        
        # construct reverse list
        ptsRev = []
        for i in range(0, len(pts), 2): ptsRev += [pts[i + 1], pts[i]]
        
        line, lineRev = rs.AddPolyline(pts), rs.AddPolyline(ptsRev)
        lineLen, lineRevLen = rs.CurveLength(line), rs.CurveLength(lineRev)
        if(lineLen <= lineRevLen): infillPoly = line
        else: infillPoly = lineRev
        
        return [infillPoly]
        
        segments = []
        # for each possible line, evaluate validity
        for i in range(len(pts) - 1):
            newLine = rs.AddLine(pts[i], pts[i + 1])
            if (i % 2 == 0 and rs.CurveLength(newLine) >= lenThres): # path
                segments += [newLine]
            elif(i % 2 == 1 and rs.CurveLength(newLine) <= lenThres): # connect
                segments += [newLine]
        
        if (len(segments) == 0): return []
        elif(len(segments) == 1): return segments
        else: return [rs.AddPolyline(pts)] # rs.JoinCurves(segments)

    def contour(self, cenLine, interval, shellOverlap=0.0):
        # get the controur (infill) lines for this block
        # parameter:
        #   cenLine: Line, the centerline to contour along with
        #   interval: Float, the distance between contours
        #   shellOverlap: Float, the overlap between shells (0 to 1)
        #   infillOverlap: Float, the overlap (0 to 1) between infill lines
        # return:
        #   a list of curves (contour lines)
        
        # get contour lines (same direction)
        srf = rs.AddPlanarSrf(self.inner)
        start, end = rs.CurveStartPoint(cenLine), rs.CurveEndPoint(cenLine)
        contoursRaw = rs.AddSrfContourCrvs(srf, (start, end), interval)
        
        # alternatively flip and/or trim (or extend) the contour lines
        extLen = nDia * (.5 - shellOverlap)
        flip = False
        contours = []
        for line in contoursRaw:
            if(rs.CurveLength(line) <= nDia * 1.5): continue
            trimmed = rs.ExtendCurveLength(line, 0, 2, -extLen) # both sides
            if(flip): rs.ReverseCurve(trimmed)
            contours += [trimmed]
            flip = not flip
        
        return contours

class Actuator(Block):
    def __init__(self, srf, axis, mat):
        super(Actuator, self).__init__(srf, axis)
        
        self.shellOverlap = 0.3 # Float, overlap between shells
        self.infillOverlap = 0.0 # Float, overlap between infill lines
        self.shellCount = 1 # Int, number of shells for this block
        self.fillSpeed = 3000 # Float, print speed for infill lines (mm/min)
        self.shellSpeed = 3000 # Float, print speed for shells (mm/min)
        # actuator
        self.actLH = 0.25 # Float, actuator layer height
        self.actFRA = 0.95 # Float, actuator print flow rate adjustment
        # constraints
        self.conLH = 0.25 # Float, constraint layer height
        self.conFRA = 0.9 # Float, constraint print flow rate adjustment
        # joints
        self.jointLH = 0.25 # Float, joint layer height
        self.jointFRA = 0.93 # Float, joint print flow rate adjustment
        
        self.mat = mat # Int, material to use
        
    def getBlocks(self):
        # get the actuator and constraint blocks for this block
        # this method slices the surface similar to that of 4DMesh
        # return:
        #   actBlock: the actuator block
        #   conBlock: the constraint block
        
        shell = self.getShells(count=self.shellCount)
        act = self.rasterize(offset=True, shellOverlap=self.shellOverlap)
        con = self.rasterize(axial=False, shellOverlap=self.shellOverlap)
        actBlock = shell + act
        conBlock = shell + con
        return actBlock, conBlock
    
    def joint(self, height):
        # rasterize this block into a joint block (as in 4DMesh)
        # parameter:
        #   height: Float, the total height of this block
        # return:
        #   list<PathBlocks>, the generated Paths for this joint
        
        # get perpendicular infill patterns
        shell = self.getShells(count=self.shellCount)
        aBlock = self.rasterize(shellOverlap=self.shellOverlap)
        aBlockShift = self.rasterize(offset=True,
                                     shellOverlap=self.shellOverlap)
        bBlock = self.rasterize(axial=False, shellOverlap=self.shellOverlap)
        bBlockShift = self.rasterize(axial=False, offset=True, 
                                     shellOverlap=self.shellOverlap)
        if(len(rs.CurvePoints(aBlock)) < len(rs.CurvePoints(aBlockShift))):
            aBlock = aBlockShift
        if(len(rs.CurvePoints(bBlock)) < len(rs.CurvePoints(bBlockShift))):
            bBlock = bBlockShift
            
        aBlock = shell + aBlock
        bBlock = shell + bBlock
        
        # package
        # block, height, FRA
        aLayer = (aBlock, self.jointLH, self.jointFRA)
        bLayer = (bBlock, self.jointLH, self.jointFRA)
    
        return self.stackAlt([aLayer, bLayer], height)
    
    def fullAct(self, height, topSide=True):
        # generate a full actuator block
        # parameter:
        #   height: Float, the total height of this block
        #   topSide: Bool, to generate the actuator at the top (or the bottom)
        # return:
        #   list<PathBlocks>
        
        # get actuator and constraint blocks (and counts)
        actBlock, conBlock = self.getBlocks()
        
        # package parameters
        # block, layerCount, height, FRA
        bot = (conBlock, self.conLH, self.conFRA)
        top = (actBlock, self.actLH, self.actFRA)
        if(not topSide): bot, top = top, bot # swap actuator and constraints
        
        return self.stackBilayer(top, bot)
    
    def stackAlt(self, blocks, height):
        # stack two blocks alternatively into the specified height
        # parameter:
        #   aBlock: Tuple<(Curves, layerHeight, FRA)>, the first block
        #   bBlock: Tuple<(Curves, layerHeight, FRA)>, the second block
        #   height: Float, the height to stack up to
        # return:
        #   list<PathBlocks>
        
        # alternating infill
        curHeight, count, paths = 0., 0, []
        while (curHeight < height and  abs(curHeight - height) > epsilon):
            
            # select pattern based on layer number index
            block = blocks[int(count % len(blocks))]
            blockPaths, layerHeight, FRA = block
            
            # move path to height
            curHeight += layerHeight
            curves = rs.CopyObjects(blockPaths, (0, 0, curHeight))
            
            # construct PathBlock
            center = rs.CurveStartPoint(curves[0])
            LHs = [layerHeight] * len(blockPaths)
            FRAs = [FRA] * len(blockPaths)
            speeds = [self.shellSpeed] + [self.fillSpeed] * (len(blockPaths) - 1)
            mats = [self.mat] * len(blockPaths)
            paths += [PathBlock(curves, LHs, FRAs, speeds, center, mats)]
            
            # update
            count += 1
            
        return paths
    
    def stackBilayer(self, top, bot, height):
        # stack two blocks alternatively into the specified height
        # parameter:
        #   top: Tuple<(Curves, layerHeight, FRA)>, the top block
        #   bot: Tuple<(Curves, layerHeight, FRA)>, the bottom block
        #   height: Float, the height to stack up to
        # return:
        #   list<PathBlocks>
        
        # unpack
        botBlock, botLH, botFRA, botMats = bot
        topBlock, topLH, topFRA, topMats = top
        botCount = int(round(height / 2 / botLH))
        topCount = int(round(height / 2 / topLH))
        
        # generate paths
        curHeight, paths = 0., []
        # bottom
        for i in range(botCount):
            # move path to height
            curHeight += botLH
            curves = rs.CopyObjects(botBlock, rs.AddPoint(0, 0, curHeight))
            # construct PathBlock
            center = rs.CurveStartPoint(curves[0])
            LHs = [botLH] * len(botBlock)
            FRAs = [botFRA] * len(botBlock)
            speeds = [self.shellSpeed] + [self.fillSpeed] * (len(botBlock) - 1)
            mats = botMats
            paths += [PathBlock(curves, LHs, FRAs, speeds, center, mats)]
            
        # top
        for i in range(topCount):
            # move path to height
            curHeight += topLH
            curves = rs.CopyObjects(topBlock, rs.AddPoint(0, 0, curHeight))
            # construct PathBlock
            center = rs.CurveStartPoint(curves[0])
            LHs = [topLH] * len(topBlock)
            FRAs = [topFRA] * len(topBlock)
            mats = topMats
            speeds = [self.shellSpeed] + [self.fillSpeed] * (len(topBlock) - 1)
            paths += [PathBlock(curves, LHs, FRAs, speeds, center, mats)]
        
        return paths

    def lenAct(self, height, actLen, topSide=True):
        # generates a actuator-length modulated beam (as in 4DMesh)
        # parameters:
        #   height: Float, the height of this beam
        #   actLen: Float, the length of the actuator
        #   topSide: Bool, to generate the actuator at the top (or the bottom)
        # return:
        #   list<PathBlocks>, the genreated actuator
        
        # get raw components
        shell = self.getShells(count=self.shellCount)
        # constraint
        con = self.getFullConstraint()
        conR, conL = self.getShortConstraints(actLen)
        actShort = self.getShortActuators(actLen, conR, conL)
        
        # compose blocks
        conBlock = shell + con
        actBlock = shell + conR + conL + actShort
        
        # select materials
        if(self.mat == 1 and actLen == 0): actMat = 1
        else: actMat = 0
        conMat = self.mat
        
        # make sets
        actMats = [actMat] + [conMat] * len(conR + conL) + [actMat + matCount] * len(actShort)
        conMats = [conMat] * len(conBlock)
        # override passive units
        if(actLen == 0): actBlock, actMats = conBlock, conMats
        
        # package variables: (block, height, FRA, material)
        top = (actBlock, self.actLH, self.actFRA, actMats)
        bot = (conBlock, self.conLH, self.conFRA, conMats)
        
        # switch actuator/constraint
        if(not topSide): bot, top = top, bot
        
        return self.stackBilayer(top, bot, height)
    
    def getFullConstraint(self):
        
        # get reference distances
        interval = nDia * (1 - (self.infillOverlap * .5))
        
        # get reference points
        cen = rs.CurveMidPoint(self.axis)
        perp = rs.RotateObject(self.axis, cen, 90, copy=True)
        ptR, ptL = rs.CurveStartPoint(self.axis), rs.CurveEndPoint(self.axis)
        vecR = rs.VectorUnitize(rs.PointSubtract(ptR, cen))
        vecL = rs.VectorUnitize(rs.PointSubtract(ptL, cen))
        
        # get left, right offset distance
        maxDistR, maxDistL = 0, 0
        maxPtR, maxPtL = None, None
        for pt in rs.CurvePoints(self.inner):
            # check side
            vec = rs.VectorUnitize(rs.PointSubtract(pt, cen))
            dotR = rs.VectorDotProduct(vec, vecR)
            dotL = rs.VectorDotProduct(vec, vecL)
            if(dotR > dotL): isRight = True
            else: isRight = False
            # check distance
            dist = rs.LineMinDistanceTo(perp, pt)
            if(isRight and dist > maxDistR): maxDistR, maxPtR = dist, pt
            elif(not isRight and dist > maxDistL): maxDistL, maxPtL = dist, pt
        
        bone = rs.AddLine(rs.PointAdd(cen, rs.VectorScale(vecR, maxDistR)),
                          rs.PointAdd(cen, rs.VectorScale(vecL, maxDistL)))
        boneShift = rs.AddLine(rs.PointAdd(cen, rs.VectorScale(vecR, maxDistR - nDia * .5)),
                               rs.PointAdd(cen, rs.VectorScale(vecL, maxDistL)))
        
        con = self.contour(bone, interval, shellOverlap=self.shellOverlap)
        conShift = self.contour(boneShift, interval, shellOverlap=self.shellOverlap)
        
        if(len(conShift) > len(con)): con = conShift
        
        # convert into polylines
        pts = []
        for line in con: pts += [rs.CurveStartPoint(line), rs.CurveEndPoint(line)]
        poly = self.infillPolylines(pts)
        #ptsShift = []
       # for line in conShift: ptsShift += [rs.CurveStartPoint(line), rs.CurveEndPoint(line)]
       # polyShift = self.infillPolylines(ptsShift)
        
        
        return [poly]
    
    def getShortActuators(self, actLen, conR, conL):
        # get the trimmed actuator based on the specified actuator length
        # parameter:
        #   actLen: Float, the length of the actuator
        # return:
        #   list<Curves>, the short actuator part
        
        # get full-length actuator
        actLong = self.rasterize(shellOverlap=self.shellOverlap,
                                 infillOverlap=self.infillOverlap,
                                 offset=True, join=False)
        
        # get interception lines
        cen = rs.CurveMidPoint(self.axis)
        ptR, ptL = rs.CurveStartPoint(self.axis), rs.CurveEndPoint(self.axis)
        perp = rs.RotateObject(self.axis, cen, 90, copy=True)
        # get length
        if(conR != []):
            conRCP = rs.EvaluateCurve(conR, rs.CurveClosestPoint(conR, cen))
            conRDist = rs.Distance(cen, conRCP)
            actLenR = conRDist - (nDia * (1 - self.shellOverlap))
        else: 
            actLenR = actLen * .5
        if(conL != []):
            conLCP = rs.EvaluateCurve(conL, rs.CurveClosestPoint(conL, cen))
            conLDist = rs.Distance(cen, conLCP)
            actLenL = conLDist - (nDia * (1 - self.shellOverlap))
        else: 
            actLenL = actLen * .5
        
        if(actLen < epsilon): interceptR, interceptL = perp, perp
        else:
            interceptR = rs.OffsetCurve(perp, ptR, actLenR)[0]
            interceptL = rs.OffsetCurve(perp, ptL, actLenL)[0]
        
        # trim actuators
        pts = []
        for i in range(len(actLong)):
            line = actLong[i]
            # first side interception
            pt0Ref = rs.LineLineIntersection(line, interceptR)[0]
            pt0Prm = rs.CurveClosestPoint(line, pt0Ref)
            pt0 = rs.EvaluateCurve(line, pt0Prm) # bounded to the curve domain
            # second side interception
            pt1Ref = rs.LineLineIntersection(line, interceptL)[0]
            pt1Prm = rs.CurveClosestPoint(line, pt1Ref)
            pt1 = rs.EvaluateCurve(line, pt1Prm) # bounded to the curve domain
            
            if(i % 2 != 0): pt0, pt1 = pt1, pt0 # swap for odd lines
            pts += [pt0, pt1]
        
        return [rs.AddPolyline(pts)] # short actuator
    
    def getShortConstraints(self, actLen):
        # get the trimmed constraints based on the specified actuator length
        # parameter:
        #   actLen: Float, the length of the actuator
        # return:
        #   conR: list<Curves>, the short constraint on the right-hand side
        #   conL: list<Curves>, the short constraint on the left-hand side
        
        # get reference points
        cen = rs.CurveMidPoint(self.axis)
        perp = rs.RotateObject(self.axis, cen, 90, copy=True)
        ptR, ptL = rs.CurveStartPoint(self.axis), rs.CurveEndPoint(self.axis)
        vecR = rs.VectorUnitize(rs.PointSubtract(ptR, cen))
        vecL = rs.VectorUnitize(rs.PointSubtract(ptL, cen))
        
        # get reference distances
        interval = nDia * (1 - (self.infillOverlap * .5))
        startDist = actLen * .5 + nDia * (1 - self.shellOverlap)
        endOff = nDia * .5 - self.infillOverlap
        
        # get left, right offset distance
        maxDistR, maxDistL = 0, 0
        maxPtR, maxPtL = None, None
        for pt in rs.CurvePoints(self.inner):
            # check side
            vec = rs.VectorUnitize(rs.PointSubtract(pt, cen))
            dotR = rs.VectorDotProduct(vec, vecR)
            dotL = rs.VectorDotProduct(vec, vecL)
            if(dotR > dotL): isRight = True
            else: isRight = False
            # check distance
            dist = rs.LineMinDistanceTo(perp, pt)
            if(isRight and dist > maxDistR): maxDistR, maxPtR = dist, pt
            elif(not isRight and dist > maxDistL): maxDistL, maxPtL = dist, pt
        
        # get short constraints
        # right
        maxDistR -= endOff
        conR = self.longRas(cen, vecR, startDist, maxDistR, interval, maxPtR)
        # left
        maxDistL -= endOff
        conL = self.longRas(cen, vecL, startDist, maxDistL, interval, maxPtL)
        
        if(actLen >= maxDistR + maxDistL): return [], []
        else: return conR, conL

    def longRas(self, cen, vec, startDist, maxDist, interval, maxPt):
        
        start = rs.PointAdd(cen, rs.VectorScale(vec, startDist))
        end = rs.PointAdd(cen, rs.VectorScale(vec, maxDist))
        endShift = rs.PointAdd(cen, rs.VectorScale(vec, maxDist - nDia * .5))
        # select longest shift
        con = self.contour(rs.AddLine(end, start), interval,
                           shellOverlap=self.shellOverlap)
        conShift = self.contour(rs.AddLine(endShift, start), interval,
                                shellOverlap=self.shellOverlap)
        
        # convert into polylines
        pts = []
        for line in con:
            # print(rs.CurveLength(line))
            pts += [rs.CurveStartPoint(line), rs.CurveEndPoint(line)]
        poly = self.infillPolylines(pts)
        ptsShift = []
        for line in conShift:
            ptsShift += [rs.CurveStartPoint(line), rs.CurveEndPoint(line)]
        polyShift = self.infillPolylines(ptsShift)
        
        # compare dist to ref point
        if(rs.CurveLength(poly) != 0):
            polyCPPrm = rs.CurveClosestPoint(poly, maxPt)
            polyCP = rs.EvaluateCurve(poly, polyCPPrm)
            polyDist = rs.Distance(maxPt, polyCP)
        else: polyDist = None
        if(rs.CurveLength(polyShift) != 0):
            polyShiftCPPrm = rs.CurveClosestPoint(polyShift, maxPt)
            polyShiftCP = rs.EvaluateCurve(polyShift, polyShiftCPPrm)
            polyShiftDist = rs.Distance(maxPt, polyShiftCP)
        else: polyShiftDist = None
        
        # check output condition
        if(polyDist == None and polyShiftDist != None): return polyShift
        elif(polyDist != None and polyShiftDist == None): return poly
        elif(polyDist == None and polyShiftDist == None): return []
        else:
            if(polyShiftDist < polyDist): return polyShift
            else: return poly

def sortPaths(paths):
    # sort a curves by their z, x, y positions (in that order)
    # parameter:
    #   paths: list<PathBlocks>, the list of pathblocks to sort
    # return:
    #   list<pathBlocks>, sorted list of blocks
    
    # check input
    if(len(paths) == 0): return []
    
    # get spatial ranges of curves
    refPts = [path.refPt for path in paths]
    
    # send paths into layer buckets
    layers = {}
    for i in range(len(paths)):
        refPt = paths[i].refPt
        z = round(refPt[2], 2)
        layers[z] = layers.get(z, []) + [paths[i]]
        
    sortedLayers = sorted(layers.keys())
    
    # extract paths from each layer
    sortedPaths = []
    for layerZ in sortedLayers:
        layer = layers[layerZ]
        
        # get bound
        refPts = [path.refPt for path in layer]
        bBox = rs.PointArrayBoundingBox(refPts)
        xMin, yMin, _ = bBox[0]
        xMax, yMax, _ = bBox[6]
        xRange, yRange = xMax - xMin, yMax - yMin
        if(xRange == 0): xRange = 1
        if(yRange == 0): yRange = 1
        
        # assign reference ID to paths
        pathIDPairs = {}
        for i in range(len(layer)):
            pt = layer[i].refPt
            refID = ((pt[0] - xMin + 1) / xRange) * (yRange + 1) + \
                    ((pt[1] - yMin + 1) / yRange)
            pathIDPairs[refID] = layer[i]
            
        # sort paths
        pathIDsSorted = sorted(pathIDPairs.keys())
        sortedBlocks = [pathIDPairs[key] for key in pathIDsSorted]
        
        # get all materials in layer
        allMats = []
        for block in sortedBlocks:
            allMats += block.mats
        allMats = sorted(list(set(allMats)))
        
        # extract paths in the order of material
        layerSorted = []
        for mat in allMats:
            for block in sortedBlocks:
                for i in range(block.count):
                    if(block.mats[i] == mat): # current material
                        newPath = block.extract(i)
                        layerSorted += [newPath]
        
        # dump
        sortedPaths += layerSorted
    
    return sortedPaths

def getJointParts(v):
    
    shellOverlap = 0.3
    
    srf = rs.AddSrfPt(v.corners)
    cen = rs.SurfaceAreaCentroid(srf)[0]
    
    outline = rs.DuplicateSurfaceBorder(srf)[0]
    outline = rs.OffsetCurve(outline, cen, -nDia * shellOverlap)
    jointSrf = rs.AddPlanarSrf(outline)[0]
    bBox = rs.BoundingBox(outline)
    pt0 = rs.PointDivide(rs.PointAdd(bBox[0], bBox[1]), 2)
    pt1 = rs.PointDivide(rs.PointAdd(bBox[1], bBox[2]), 2)
    pt2 = rs.PointDivide(rs.PointAdd(bBox[2], bBox[3]), 2)
    pt3 = rs.PointDivide(rs.PointAdd(bBox[3], bBox[0]), 2)
    line0 = rs.AddLine(pt0, pt2)
    line1 = rs.AddLine(pt1, pt3)
    
    if(rs.CurveLength(line0) > rs.CurveLength(line1)): jointAxis = line0
    else: jointAxis = line1
    
    return jointSrf, jointAxis

# generate beam blocks
if(writeGcode):
    pathBlocks = []
    for i in range(len(graph.edges)):
        e = graph.edges[i]
        srf, axis = rs.AddSrfPt(e.corners), rs.AddLine(e.start, e.end)
        newBlock = Actuator(srf, axis, e.mat)
        actLen = abs(e.actLen) # convert into absolute, plsitive length
        # check side
        if(e.actLen > 0): topSide = True
        else: topSide = False
        # get paths
        pathBlocks += newBlock.lenAct(height, actLen, topSide)
    
    # generate joint blocks
    for i in range(len(graph.vertices)):
        v = graph.vertices[i]
        srf, axis = getJointParts(v)
        newBlock = Actuator(srf, axis, v.mat)
        pathBlocks += newBlock.joint(height)
    
    allMats = []
    for block in pathBlocks:
        allMats += block.mats
    
    # sort paths
    pathsSorted = sortPaths(pathBlocks)
    # output
    paths, LHs, FRAs, speeds, mats = [], [], [], [], []
    for path in pathsSorted:
        paths += rs.CopyObjects(path.curves, buildShift)
        LHs += path.LHs
        FRAs += path.FRAs
        speeds += path.speeds
        mats += [mat % matCount for mat in path.mats]
    
    # add skirt to print
    if(len(paths) != 0 and writeGcode):
        bBox = rs.BoundingBox(paths)
        skirt = rs.AddPolyline(bBox[:4] + [bBox[0]])
        cen = rs.PointDivide(rs.PointAdd(bBox[0], bBox[2]), 2)
        skirt = rs.OffsetCurve(skirt, cen, -20)[0]
        paths = [skirt] + paths
        LHs = [min(LHs)] + LHs
        FRAs = [2.01] + FRAs
        speeds = [1500] + speeds
        mats = [0] + mats
        zShift = rs.coerce3dpoint(buildShift)[2]
# ---------- end slicer ----------
gcode_compiler = PythonScript(
    blocks=slicer.paths,
    speeds=slicer.speeds,
    layerHeights=slicer.LHs,
    FRAs=slicer.FRAs,
    mats=slicer.mats,
    zShift=slicer.zShift,
    blockToCode=blocktocode,
    nozzleDia=nozzle_diameter_2,
    fillamentDia=fillamentdia,
    header=machine_prm.header,
    footer=machine_prm.footer,
    writePath=gcode_save_path_2,
    write=save_gcode_2)  # inputs blocks: list, speeds: list, layerHeights: list, FRAs: list, mats: list
# ---------- gcode_compiler: Python ----------
import time

def writeFile(code, path):
    with open(path, "wt") as f:
        f.write(code)

if(write and len(blocks) > 0 and blocks[0] != None):
    printCode = blockToCode(blocks, nozzleDia, fillamentDia, layerHeights, 
                            FRAs, speeds, mats, zShift)
    # time stamp
    date = time.localtime()
    curTime = "%d %d %d %d:%d %d" % (date.tm_year, date.tm_mon, date.tm_mday, \
                                     date.tm_hour, date.tm_min, date.tm_sec)
    creationTime = "; created on %s\n" % (curTime)
    # combine files
    code = [creationTime, header]
    code += [printCode]
    code += [footer]
    code = '\n'.join(code)
    # write file
    if(writePath.find(".") != -1): # fix file path
        writePath = writePath[:writePath.find(".")]
    writeFile(code, writePath + ".gcode")
# ---------- end gcode_compiler ----------

# ----
setcheckbox_9 = SetCheckBox(CheckBoxToModify=checkbox_11, NewCheckBoxLabel="Load iteration", NewValue=graph_generator.resetIter)
optimgoals = GhPythonScript(SML=simulearn.SML, args=optimization_goals, graph=graph, targets=pt_2)  # -> objectives, optimGoals, optimRepr, goalCoors, reps; inputs targets: list
# ---------- optimgoals: Python ----------
__author__ = "Humphrey Yang"
__version__ = "2020.02.01"

import rhinoscriptsyntax as rs

if(graph):
    json = SML.getJSON(graph)
    modelPts = SML.getModelPoints(json)
    goalPts = SML.getTargetPoints(targets)
else:
    modelPts = []
    goalPts = []

objectives, optimRepr = SML.cleanLines(args)
allPts = SML.getAllPts(modelPts + goalPts)
optimGoals = SML.findPts(objectives, allPts)
goalCoors = SML.goalToArray(goalPts)
reps = SML.getRep(objectives, allPts)
# ---------- end optimgoals ----------

showflat = GhPythonScript(SML=simulearn.SML, graph=graph, viewFlat=view_flat_model)  # -> out, flatModel
# ---------- showflat: Python ----------
__author__ = "Humphrey Yang"
__version__ = "2020.02.06"

import rhinoscriptsyntax as rs

if(viewFlat):
    flatModel = SML.getModel([SML.getJSON(graph)])
# ---------- end showflat ----------
preview_3 = CustomPreview(Geometry=showflat.flatModel, Material=display_color)

save_2 = GhPythonScript(SML=simulearn.SML, graph=graph, name=save_path, save=save)
# ---------- save_2: Python ----------
__author__ = "Humphrey Yang"
__version__ = "2020.02.04"

if(save): 
    SML.saveGraph(graph, name)
# ---------- end save_2 ----------

toolpath = Curve(slicer.paths)
view_toolpath_2 = Boolean(view_toolpath)
dispatch_10 = Dispatch(List=toolpath, DispatchPattern=view_toolpath_2)  # -> ListA, ListB
preview_4 = CustomPreview(Geometry=dispatch_10.ListA, Material=ColourSwatch(SwatchColor=RGB(0, 0, 0)))

takestep = GhPythonScript(SML=simulearn.SML, graph=graph, actions=actiontags, cueUpdate=cue_update)  # -> out, flagIter, resetCue, resetAuto, resetCurIter; inputs actions: tree
# ---------- takestep: Python ----------
__author__ = "Humphrey Yang"
__version__ = "2020.02.08"

import time as t
import rhinoscriptsyntax as rs
# data tree import
import clr
clr.AddReference("Grasshopper")
from Grasshopper.Kernel.Data import GH_Path
from Grasshopper import DataTree

flagIter = []
resetCue = []
resetAuto = []
resetCurIter = []

def formatDate(time):
    
    time = str(time)
    items = []
    
    for s in time.split(' '):
        if(s.isalnum()):
            items += [s]
        elif(':' in s):
            items += s.split(':')
    name = '_'.join(items)
    
    return name

def iterOverride(actions):
    
    goalsSeen = set()
    mods = []
    
    for path in actions.Paths:
        goalID, actionID = path.Indices
        if(goalID in goalsSeen): continue
        else:
            goalsSeen.add(goalID)
            action = actions.Branch(path)[0]
            mods += [action]
    
    return mods

if(cueUpdate): # auto mode
    # get actions to apply
    mods = iterOverride(actions)
    # stack actions
    graphUpdate = SML.getUpdates(mods)
    print(graphUpdate)
    # make copy graph and apply update
    if(graphUpdate != None):
        newGraph = SML.getNewGraph(graph, graphUpdate)
        # save copied graph
        SML.saveGraph(newGraph, SML.batchUpdate)
        # save history
        fileName = SML.iterHistory + formatDate(t.ctime()) + ".json"
        SML.saveGraph(newGraph, fileName)
        print("history saved to: %s" % fileName)
        # flag for updates
        clearResult = True
        flagIter = True
        
    else:
        print("no update, stopping iterations")
        newGraph = graph
        resetAuto = False
        resetCurIter = 0
    resetCue = False
# ---------- end takestep ----------
savesimfile = GhPythonScript(
    graph=graph,
    SML=simulearn.SML,
    optimGoals=optimgoals.optimGoals,
    optimRepr=optimgoals.optimRepr,
    goalCoors=optimgoals.goalCoors,
    iterations=iterations,
    amplitude=stepsize,
    simulate=run_simulation,
    step=step,
    optimize=optimize,
    autoRun=auto_run,
    curIter=current_iteration,
    iterDone=iteration_done)  # -> out, conduitPath, resultPath, settingPath, rankingPath, mode, execute, showSim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; inputs optimGoals: list, optimRepr: list, goalCoors: list
# ---------- savesimfile: Python ----------
__author__ = "humph"
__version__ = "2019.09.15"

import math
import rhinoscriptsyntax as rs

conduitPath = []
resultPath = []
settingPath = []
rankingPath = []
mode = []
execute = False
showSim = []
setAuto = []
setIter = []
setDone = []

class Env(object):
    def __init__(self, conduit, result, setting, ranking, mode):
        self.conduit = conduit
        self.result = result
        self.setting = setting
        self.ranking = ranking
        self.mode = mode

if(iterDone): optimize = True

if(graph):
    # select mode: 0:single, 1:interactive, 1:auto
    if(simulate): mode = 0
    if(step): mode = 1
    if(optimize): mode = 2
    # save file if activated
    conduitPath, resultPath, settingPath, rankingPath = SML.getConduits(mode)
    if(mode == 0):
        print("single graph forward")
        json = SML.getJSON(graph)
        execute = True
    elif(mode == 1): # batch mode (interactive)
        print("batch graph forward: interactive mode")
        graphs, actions = SML.permutate(graph, amplitude)
        json = SML.batchJSON(graphs)
        SML.writeSettings(mode, iterations, optimGoals, 
                          optimRepr, goalCoors, actions)
        execute = True
    elif(mode == 2 and len(optimGoals) > 0): # batch mode (auto)
        print("batch graph forward: automated mode")
        graphs, actions = SML.permutate(graph, amplitude)
        json = SML.batchJSON(graphs)
        SML.writeSettings(mode, iterations, optimGoals, 
                          optimRepr, goalCoors, actions)
        # iteration control logic
        if(int(curIter) < iterations): # loop
            setAuto = True
            setIter = int(curIter) + 1
            execute = True
            setDone = False
            print("looping (iter: %d)..." % int(curIter))
        else:
            print("stoped!")
            setAuto = False
            setIter = 0
            setDone = False
    # output
    if(execute):
        SML.writeJSON(conduitPath, json)
        env = Env(conduitPath, resultPath, settingPath, rankingPath, mode)
        showSim = True
    else:
        if("env" in locals()):
            conduitPath = env.conduit
            resultPath = env.result
            settingPath = env.setting
            rankingPath = env.ranking
            mode = env.mode
# ---------- end savesimfile ----------
setcheckbox_10 = SetCheckBox(CheckBoxToModify=checkbox_11, NewCheckBoxLabel="Load iteration", NewValue=takestep.flagIter)
setcheckbox_11 = SetCheckBox(CheckBoxToModify=checkbox_6, NewCheckBoxLabel="Cue update", NewValue=takestep.resetCue)
setcheckbox_12 = SetCheckBox(CheckBoxToModify=checkbox_14, NewCheckBoxLabel="Auto run", NewValue=takestep.resetAuto)
settextbox_3 = SetTextBoxContents(TextBoxToModify=textbox_4, NewTextBoxContents=takestep.resetCurIter)
runsim = RunSim(
    toolFolder=simulearn.toolFolder,
    conduitPath=savesimfile.conduitPath,
    resultPath=savesimfile.resultPath,
    settingPath=savesimfile.settingPath,
    rankingPath=savesimfile.rankingPath,
    mode=savesimfile.mode,
    execute=savesimfile.execute)  # -> flatten(log), singleCue, batchCue; inputs toolFolder: list, resultPath: list, settingPath: list, rankingPath: list, mode: list, execute: list
# ---------- runsim: Python ----------
""" 
Python Script
Created on  Friday January 2020 02:11:45 
@author:  Humphrey Yang 

[desc]
Description of the plugin Here
Write here any thing... 
[/desc]

ARGUMENTS:
----------
<inp> 
    _input :[required] - [type = int] - [default = None] 
    Descripe your input here 
        * bullet point.
        * bullet point
</inp>
<inp>
    Other inputs go here ...
</inp>

RETURN:
----------
    <out>
        output_ : indicate your output description here.
    </out>
<out>
    cue :[required] - [type = bool] - [default = False]
    Cues the next component to start running
</out>
"""
cue = 1 if (execute) else 0
singleCue = 1 if (cue and mode == 0) else 0
batchCue = 1 if (cue and (mode == 1 or mode == 2)) else 0
log = []

if(execute):
    import sys
    import torch
    import numpy
    sys.path.append(toolFolder)
    import toolForward
    if(mode == 0): # single
        print("run single simulation")
        log = toolForward.main(conduitPath, resultPath)
    elif(mode == 1 or mode == 2): # batch
        print("run batch simulation")
        log = toolForward.main(conduitPath, resultPath, settingPath, rankingPath)
# ---------- end runsim ----------
setcheckbox_13 = SetCheckBox(CheckBoxToModify=checkbox_4, NewCheckBoxLabel="Simulated model", NewValue=savesimfile.showSim)
setcheckbox_14 = SetCheckBox(CheckBoxToModify=checkbox_14, NewCheckBoxLabel="Auto run", NewValue=savesimfile.setAuto)
settextbox_4 = SetTextBoxContents(TextBoxToModify=textbox_4, NewTextBoxContents=savesimfile.setIter)
setcheckbox_15 = SetCheckBox(CheckBoxToModify=checkbox_15, NewCheckBoxLabel="Iteration Done", NewValue=savesimfile.setDone)
rec = DataRecorder(runsim.log, DataLimit=1, RecordData=True)
settextblock_3 = SetTextBlockContents(TextBlockToModify=tb_5, NewTextBlockContents=rec)

cue_load_result = GhPythonScript(singleCue=runsim.singleCue, batchCue=runsim.batchCue)  # -> out, singleSet, singleClear, batchSet, batchClear
# ---------- cue_load_result: Python ----------
__author__ = "Humphrey Yang"
__version__ = "2020.02.07"

import rhinoscriptsyntax as rs

print(singleCue, type(singleCue))

singleSet = []
singleClear = []
batchSet = []
batchClear = []

if(singleCue == '1'):
    singleSet = True
    batchClear = True
elif(batchCue == '1'):
    batchSet = True
    singleClear = True
# ---------- end cue_load_result ----------
setcheckbox_16 = SetCheckBox(CheckBoxToModify=checkbox_10, NewCheckBoxLabel="Load single result", NewValue=cue_load_result.singleSet)
setcheckbox_17 = SetCheckBox(CheckBoxToModify=checkbox_12, NewCheckBoxLabel="Load batch result", NewValue=cue_load_result.batchSet)
setcheckbox_18 = SetCheckBox(CheckBoxToModify=checkbox_5, NewCheckBoxLabel="Clear single result", NewValue=cue_load_result.singleClear)
setcheckbox_19 = SetCheckBox(CheckBoxToModify=checkbox_13, NewCheckBoxLabel="Clear batch result", NewValue=cue_load_result.batchClear)

merge_21 = Merge(Data1=readsingleresult.json, Data2=readbatchresult.json)
item_3 = ListItem(List=merge_21, Index=select_timestep, Wrap=True)
ptview = GhPythonScript(
    SML=simulearn.SML,
    graph=graph,
    json=item_3,
    objectives=optimgoals.objectives,
    targets=pt_2,
    viewBeamPts=view_beam_pts,
    viewJointPts=view_joint_pts,
    viewGoalPts=view_goal_pts,
    viewRep=view_arrows,
    optimRep=optimgoals.reps)  # -> out, sphs, pts, tags, anchor, vector; inputs objectives: list, targets: list, optimRep: list
# ---------- ptview: Python ----------
__author__ = "Humphrey Yang"
__version__ = "2020.02.01"

import rhinoscriptsyntax as rs

def ptBox(pt, l=0.1):
    
    pts = [rs.PointAdd(pt, [-l, -l, -l]),
           rs.PointAdd(pt, [-l,  l, -l]),
           rs.PointAdd(pt, [ l,  l, -l]),
           rs.PointAdd(pt, [ l, -l, -l]),
           rs.PointAdd(pt, [-l, -l,  l]),
           rs.PointAdd(pt, [-l,  l,  l]),
           rs.PointAdd(pt, [ l,  l,  l]),
           rs.PointAdd(pt, [ l, -l,  l])]
           
    return rs.AddBox(pts)

def getPtsTxts(modelPts, goalPts, viewBeamPts, viewJointPts, viewGoalPts):
    
    def checkUnique(pts, pt):
        
        add = False
        if(len(pts) > 0):
            cp = rs.PointCloudClosestPoints(pts, [pt], 0.01)[0]
            if(len(cp) == 0): add = True
        else:
            add = True
        return add
    
    sphs, pts, tags = [], [], []
    # model
    for modelPt in modelPts:
        if((viewBeamPts and modelPt.tag[0] == 'e') or\
           (viewJointPts and modelPt.tag[0] == 'n')):
            pt = rs.AddPoint(modelPt.coor)
            sph = ptBox(pt)
            tag = modelPt.txt
            add = checkUnique(pts, pt)
            if(add):
                pts += [pt]
                sphs += [sph]
                tags += [tag]
    # goal
    if(viewGoalPts):
        for goalPt in goalPts:
            pt = rs.AddPoint(goalPt.coor)
            pts += [pt]
            sphs += [ptBox(pt)]
            tags += [goalPt.txt]
    
    return sphs, pts, tags

pts = []
tags = []

if(json != None): js = json
else: js = SML.getJSON(graph)
modelPts = SML.getModelPoints(js)
goalPts = SML.getTargetPoints(targets)
allPts = SML.getAllPts(modelPts + goalPts)
reps = SML.getRep(objectives, allPts)

sphs, pts, tags = getPtsTxts(modelPts, goalPts, viewBeamPts, viewJointPts, viewGoalPts)

if(viewRep and len(optimRep) != 0 and optimRep[0] != None):
    anchor, vector = [], []
    for i in range(len(optimRep)):
        line = optimRep[i]
        anchor += [rs.CurveStartPoint(line)]
        vector += [rs.VectorSubtract(rs.CurveEndPoint(line), 
                                     rs.CurveStartPoint(line))]
# ---------- end ptview ----------
preview_5 = CustomPreview(Geometry=ptview.sphs, Material=ColourSwatch(SwatchColor=RGB(61, 61, 61)))
vdisex = VectorDisplayEx(Point=ptview.anchor, Vector=ptview.vector, Colour=RGB(0, 0, 0), Width=2)
tag = TextTag(Location=ptview.pts, Text=ptview.tags, Colour=ColourSwatch(SwatchColor=RGB(255, 0, 0)))

takestep_2 = GhPythonScript(SML=simulearn.SML, graph=graph, selection=match, actions=actiontags, update=values_31.Values, cueUpdate=cue_update)  # -> out, flagIter, closeWindow, clearResult; inputs selection: tree, actions: tree
# ---------- takestep_2: Python ----------
__author__ = "Humphrey Yang"
__version__ = "2020.02.08"

import rhinoscriptsyntax as rs
# data tree import
import clr
clr.AddReference("Grasshopper")
from Grasshopper.Kernel.Data import GH_Path
from Grasshopper import DataTree

flagIter = []
closeWindow = []
clearResult = []

if(update): # interative mode]
    # get actions to apply
    mods = SML.getActions(selection, actions)
    # stack actions
    graphUpdate = SML.getUpdates(mods)
    print(graphUpdate)
    # make copy graph and apply update
    if(graphUpdate != None): newGraph = SML.getNewGraph(graph, graphUpdate)
    else: newGraph = graph
    # save copied graph
    SML.saveGraph(newGraph, SML.batchUpdate)
    # flag for updates
    closeWindow = False
    clearResult = True
    flagIter = True
# ---------- end takestep_2 ----------

checker_2 = GhPythonScript(graph=graph, minActLen=minimum_actuator_length, checkModel=check)  # -> tags, txtPts, txts, tagColors, txtColors, test
# ---------- checker_2: Python ----------
__author__ = "humph"
__version__ = "2019.03.13"

import math
import rhinoscriptsyntax as rs

epsilon = 0.0001

class Msg(object):
    def __init__(self, pos, message, tagColor, txtColor):
        self.pos = pos
        self.message = message
        self.tagColor = tagColor
        self.txtColor = txtColor
        
    @staticmethod
    def genMessages(errors):
        
        # convert to dictionary
        tags = {}
        for i in range(len(errors)):
            error = errors[i]
            tags[error.pos] = tags.get(error.pos, []) + [error]
        
        taggers, textPts, texts, tagColors, txtColors = [], [], [], [], []
        for key in tags:
            messages = tags[key]
            # tag
            circles = [rs.AddCircle(key, 10), rs.AddCircle(key, 7.5)]
            tag = rs.AddPlanarSrf(circles)[0]
            rs.MoveObject(tag, (0, 0, 0.1))
            # text
            txt = '\n'.join([msg.message for msg in messages]) # text
            # colors
            tagColor, txtColor, count = [0, 0, 0], [0, 0, 0], 0
            for msg in messages:
                count += 1
                tagColor[0] += msg.tagColor[0]
                tagColor[1] += msg.tagColor[1]
                tagColor[2] += msg.tagColor[2]
                txtColor[0] += msg.txtColor[0]
                txtColor[1] += msg.txtColor[1]
                txtColor[2] += msg.txtColor[2]
            
            tagColor[0] /= count
            tagColor[1] /= count
            tagColor[2] /= count
            txtColor[0] /= count
            txtColor[1] /= count
            txtColor[2] /= count
            # save
            taggers += [tag]
            textPts += [key]
            texts += [txt]
            tagColors += [rs.CreateColor(tagColor + [180])]
            txtColors += [rs.CreateColor(txtColor + [180])]
            
        return taggers, textPts, texts, tagColors, txtColors

class Error(Msg):
    def __init__(self, pos, message):
        tagColor = (255, 0, 0)
        txtColor = (50, 0, 0)
        
        super(Error, self).__init__(pos, message, tagColor, txtColor)

class Warning(Msg):
    def __init__(self, pos, message):
        tagColor = (128, 128, 0)
        txtColor = (50, 50, 0)
        
        super(Warning, self).__init__(pos, message, tagColor, txtColor)

class ConnectivityError(Error):
    def __init__(self, pos, count):
        message = "Error:\n"\
                  "Expecting 2-4 adjacent edges at this node, got %d." % count
                  
        super(ConnectivityError, self).__init__(pos, message)

class BeamLenError(Error):
    def __init__(self, pos, beamLen):
        self.minLen = minActLen
        self.maxLen = 100
        
        message = "Error:\n"\
                  "Expecting a beam length between %.1f to %.1f, got %.1f." % \
                  (self.minLen, self.maxLen, beamLen)
                  
        super(BeamLenError, self).__init__(pos, message)

class OutlineError(Error):
    def __init__(self, pos):
        message = "Error:\n"\
                  "Expecting a quadrilateral surface, got an unusual one"
                  
        super(OutlineError, self).__init__(pos, message)

class FixedEndError(Error):
    def __init__(self, pos, maxID, ID):
        message = "Error:\n"\
                  "Expecting fixed-end index between 0 and %d, got %s." % \
                  (maxID, ID)
                  
        super(FixedEndError, self).__init__(pos, message)

class ActLenWarning(Warning):
    def __init__(self, pos, lower, upper, actLen):
        
        message = "Warning:\n"\
                  "Expecting actuator length betweem %.1f to %.1f,\n"\
                  "got %.1f. (Actuator length clamped)" % \
                  (lower, upper, actLen)
        
        super(ActLenWarning, self).__init__(pos, message)

class ExtraEdgeWarning(Warning):
    def __init__(self, pos):
        message = "Warning:\n"\
                  "This edge does not fit into the grid and is ignored."
        
        super(ExtraEdgeWarning, self).__init__(pos, message)

class Checker(object):
    def __init__(self):
        pass
        
    def check(self):
        raise("checker function not implemented")

class BeamLenCheck(Checker):
    def __init__(self):
        self.lowerBound = 10
        self.upperBound = 100
        self.count = 0
        
    def check(self, graph):
        
        errors = []
        for i in range(len(graph.edges)):
            e = graph.edges[i]
            axis = rs.AddLine(e.start, e.end)
            eLen = rs.CurveLength(axis)
            # check upper
            if(eLen > self.upperBound):
                errors += [BeamLenError(e.mid, eLen)]
                self.count += 1
            # check lower
            srf = rs.AddSrfPt(e.corners)
            edgeLenShort = self.getBeamLen(srf, axis)
            if(edgeLenShort < self.lowerBound):
                errors += [BeamLenError(e.mid, edgeLenShort)]
                self.count += 1
        
        return errors
        
    def getBeamLen(self, srf, axis):
        
        mid = rs.CurveMidPoint(axis)
        ptS = rs.CurveStartPoint(axis)
        ptE = rs.CurveEndPoint(axis)
        corners = rs.CurvePoints(rs.DuplicateSurfaceBorder(srf))
        corners = rs.CullDuplicatePoints(corners)
        
        perp = rs.RotateObject(axis, mid, 90, copy=True)
        sMin, eMin = 999, 999
        for i in range(len(corners)):
            pt = corners[i]
            dist = rs.LineMinDistanceTo(perp, pt)
            distS, distE = rs.Distance(pt, ptS), rs.Distance(pt, ptE)
            
            if(distS < distE and dist < sMin): sMin = dist
            elif(distE < distS and dist < eMin): eMin = dist
            
        
        return sMin + eMin

class ConnectivityCheck(Checker):
    def __init__(self):
        self.lowerBound = 2
        self.upperBound = 4
        self.count = 0
        
    def check(self, graph):
        
        errors = []
        
        for v in graph.vertices:
            # check neighbors
            if(not self.lowerBound <= len(v.corners) <= self.upperBound):
                errors += [ConnectivityError(v.pt, v.deg)]
                self.count += 1
        
        return errors

class ExtraEdgeCheck(Checker):
    def __init__(self):
        self.count = 0
        
    def check(self, graph):
        
        errors = []
        for i in range(len(graph.wasted)):
            e = graph.wasted[i]
            errors += [ExtraEdgeWarning(e.mid)]
            self.count += 1
            
        return errors

class ActLenCheck(Checker):
    def __init__(self):
        self.lower = 10
        self.count = 0
        
    def check(self, graph):
        
        errors = []
        
        for i in range(len(graph.edges)):
            e = graph.edges[i]
            actLen = abs(e.actLen)
            edgeLen = rs.Distance(e.start, e.end)
            if((actLen < self.lower and actLen != 0) or
                actLen > edgeLen):
                errors += [ActLenWarning(e.mid, self.lower, edgeLen, actLen)]
                self.count += 1
        return errors

class OutlineCheck(Checker):
    def __init__(self):
        self.count = 0
    
    def check(self, graph):
        
        errors = []
        
        for v in graph.vertices:
            pts = rs.CullDuplicatePoints(v.corners)
            # check quadrilateral
            if(len(pts) != 4):
                errors += [OutlineError(v.pt)]
                self.count += 1
            
        return errors

class FixedEndCheck(Checker):
    def __init__(self):
        self.count = 0
    
    def check(self, graph):
        
        errors = []
        
        vCount = len(graph.vertices)
        cen = rs.CreatePoint(0, 0, 0)
        for v in graph.vertices: cen = rs.PointAdd(cen, v.pt)
        cen = rs.PointDivide(cen, vCount)
        
        fID = graph.fixed
        if(fID == None or not 0 <= fID < vCount):
            errors += [FixedEndError(cen, vCount - 1, str(fID))]
        
        return errors

if(graph != None and checkModel):
    
    errors = ExtraEdgeCheck().check(graph) + \
             ConnectivityCheck().check(graph) + \
             OutlineCheck().check(graph) + \
             BeamLenCheck().check(graph) + \
             ActLenCheck().check(graph) + \
             FixedEndCheck().check(graph)
    
    tags, txtPts, txts, tagColors, txtColors = Msg.genMessages(errors)
# ---------- end checker_2 ----------
preview_6 = CustomPreview(Geometry=checker_2.tags, Material=checker_2.tagColors)
tag_2 = TextTag3D(Location=checker_2.txtPts, Text=checker_2.txts, Size=1, Colour=checker_2.txtColors, Justification=7)

showdesign = GhPythonScript(graph=graph, dispIndex=text_display, dispSrf=face_display)  # -> tagPos, tagIndex, tagColor, srf, srfColor
# ---------- showdesign: Python ----------
__author__ = "humph"
__version__ = "2019.04.08"

import rhinoscriptsyntax as rs

wid = 7.2
topC = rs.CreateColor(255, 0, 0, 0)
botC = rs.CreateColor(0, 115, 255, 0)
nonC = rs.CreateColor(128, 128, 128, 128)
fixC = rs.CreateColor(0, 255, 0, 128)


def edgeDisp(e):
    
    beam = rs.AddSrfPt(e.corners)
    if(e.actLen == 0): return [beam], [nonC]
    
    vec = rs.VectorUnitize(rs.PointSubtract(e.end, e.mid))
    perp = rs.VectorRotate(vec, 90, (0, 0, 1))
    aLen = abs(e.actLen)
    v0 = rs.VectorAdd(rs.VectorScale(vec, aLen * .5), rs.VectorScale(perp, wid * .5))
    v1 = rs.VectorAdd(rs.VectorScale(vec, aLen * .5), rs.VectorScale(perp, wid * -.5))
    v2 = rs.VectorAdd(rs.VectorScale(vec, aLen * -.5), rs.VectorScale(perp, wid * -.5))
    v3 = rs.VectorAdd(rs.VectorScale(vec, aLen * -.5), rs.VectorScale(perp, wid * .5))
    p0 = rs.PointAdd(e.mid, v0)
    p1 = rs.PointAdd(e.mid, v1)
    p2 = rs.PointAdd(e.mid, v2)
    p3 = rs.PointAdd(e.mid, v3)
    
    c0 = rs.AddPolyline([p0, p1, p2, p3, p0])
    c1 = rs.AddPolyline(e.corners + [e.corners[0]])
    srf = rs.AddPlanarSrf(rs.CurveBooleanIntersection(c0, c1)[0])
    srf = rs.MoveObject(srf, (0, 0, 0.01))
    
    srfs = [beam, srf]
    if(e.actLen > 0): color = [nonC, topC]
    else: color = [nonC, botC]
    
    return srfs, color

def jointDisp(j, fixedID):
    
    if(fixedID == j.index):
        c = fixC
    else:
        c = nonC
    
    return [rs.AddSrfPt(j.corners)], [c]

tagPos, tagIndex, tagColor, srf, srfColor = [], [], [], [], []
if(graph != None):
    
    if(dispIndex):
        tagPos += [v.pt for v in graph.vertices]
        tagIndex += range(len(graph.vertices))
        tagColor += [rs.CreateColor(0, 0, 0)] * len(graph.vertices)
        tagPos += [e.mid for e in graph.edges]
        tagIndex += range(len(graph.edges))
        tagColor += [rs.CreateColor(178, 136, 0)] * len(graph.edges)
    if(dispSrf):
        for v in graph.vertices:
            newS, newC = jointDisp(v, graph.fixed)
            srf += newS
            srfColor += newC
        for e in graph.edges:
            newS, newC = edgeDisp(e)
            srf += newS
            srfColor += newC
# ---------- end showdesign ----------
preview_7 = CustomPreview(Geometry=showdesign.srf, Material=showdesign.srfColor)
tag_3 = TextTag3D(Location=showdesign.tagPos, Text=showdesign.tagIndex, Size=5, Colour=showdesign.tagColor, Justification=5)

setcheckbox_20 = SetCheckBox(CheckBoxToModify=checkbox_11, NewCheckBoxLabel="Load iteration", NewValue=takestep_2.flagIter)
setcheckbox_21 = SetCheckBox(CheckBoxToModify=checkbox_2, NewCheckBoxLabel="Show update window", NewValue=takestep_2.closeWindow)
setcheckbox_22 = SetCheckBox(CheckBoxToModify=checkbox_13, NewCheckBoxLabel="Clear batch result", NewValue=takestep_2.clearResult)

W = Width(450)
H = Height(800)
launchwin_2 = LaunchWindow(
    Show=Button(ExpressionNormal="True", ExpressionPressed="False"),
    Name="SimuLearn",
    Width=W,
    Height=H,
    ChildStatus=1,
    EnableHorizScroll=False)
accent_colors = ValueList({"Amber", "Blue", "Brown", "Cobalt", "Crimson", "Cyan", "Emerald", "Green", "Indigo", "Lime", "Magenta", "Mauve", "Olive", "Orange", "Pink", "Purple", "Red", "Sienna", "Steel", "Taupe", "Teal", "Violet", "Yellow"}, selected="Steel")
number_slider_3 = Slider(1, range=0..2)
winprops = SetWindowProperties(
    Window=launchwin_2,
    Theme=1,
    AccentColor=accent_colors,
    ShowTitleBar=True,
    BackgroundColor=ColourSwatch(SwatchColor=RGB(0, 23, 54)),
    ScaleFactor=number_slider_3)

multiplication = Multiplication(A=W, B=0.85)
image = CreateImage(ImageSource=python.shapeImage, ImageWidth=multiplication)

merge_22 = Merge(Data1=image, Data2=pulldown_2, Data3=textbox_3, Data4=button_7)
expander_9 = CreateExpander(UIElements=merge_22, Header="Grid initialization", Open=True)

merge_23 = Merge(
    Data1=flatten(stack_4),
    Data2=flatten(expander_9),
    Data3=flatten(expander_3),
    Data4=flatten(textbox_5),
    Data5=flatten(expander_4))
expander_10 = CreateExpander(UIElements=merge_23, Header="Design", Open=True)

winprops_2 = SetWindowProperties(Window=launchwin, Theme=0, AccentColor=accent_colors, ShowTitleBar=True, ScaleFactor=number_slider_3)

merge_24 = Merge(
    Data1=flatten(expander_10),
    Data2=flatten(expander_6),
    Data3=flatten(expander_8),
    Data4=flatten(expander_5),
    Data5=flatten(expander),
    Data6=flatten(simplegrid_3))

filter_3 = StreamFilter(Gate=checker.load, Stream0=filepicker_2, Stream1=merge_24)

addelems_2 = AddElements(Window=launchwin_2, Elements=flatten(filter_3), DoVLChecking=False)  # -> AddedElements, ElementNames

# ==== cluster Sample
genmode = ClusterInput()
y_extent = ClusterInput()
x_extent = ClusterInput()
length = ClusterInput()
width = ClusterInput()
shift = ClusterInput()
ratio = ClusterInput()
addition = Addition(A=width, B=20)
addition_2 = Addition(A=length, B=20)
recgrid = Rectangular(Plane=shift, SizeX=addition, SizeY=addition_2, ExtentX=x_extent, ExtentY=y_extent)  # -> Cells, Points
pcen = PolygonCenter(Polyline=recgrid.Cells)  # -> CenterV, CenterE, CenterA
division = Division(A=width, B=2)
rectangle = Rectangle(Plane=pcen.CenterV, XSize=width, YSize=length, Radius=0)  # -> flatten(Rectangle), Length
pt = PointOriented(BasePlane=pcen.CenterV, UComponent=division, VComponent=0, WComponent=0)
pt_2 = PointOriented(BasePlane=pcen.CenterV, UComponent=division, VComponent=length, WComponent=0)
cp = ControlPoints(Curve=rectangle.Rectangle)  # -> flatten(Points), Weights, Knots
ln = Line(StartPoint=pt, EndPoint=pt_2)  # -> flatten(Line)
cullpt = CullDuplicates(Points=cp.Points, Tolerance=0.1, CullMode=3)  # -> Points, Indices, Valence
avr = Average(Input=cullpt.Points)
vec2pt = Vector2Pt(PointA=avr, PointB=shift, Unitize=False)  # -> Vector, Length
move = Move(Geometry=ln, Motion=vec2pt.Vector)  # -> Geometry, Transform
move_2 = Move(Geometry=rectangle.Rectangle, Motion=vec2pt.Vector)  # -> Geometry, Transform
boundary = BoundarySurfaces(Edges=move_2.Geometry)
srf = Surface(boundary)
crv = Curve(move.Geometry)
python = GhPythonScript(srfs=srf, edges=crv, actLens=ratio, genMode=genmode)  # -> out, graph; inputs srfs: list, edges: list, actLens: list
# ---------- python: Python ----------
"""Provides a scripting component.
    Inpu=ts:
        x: The x script variable
        y: The y script variable
    Output:
        a: The a output variable"""
        
__author__ = "humph"
__version__ = "2019.04.08"
        
import math
import rhinoscriptsyntax as rs
        
epsilon = 0.0001

class Graph(object):
    def __init__(self, srfs, edges, actLens):
        self.edges = [Edge(srfs[i], edges[i], actLens[i]) for i in range(len(srfs))]
        self.vertices = []
        pass

class Edge(object):
    def __init__(self, srf, edge, actLen):
        self.start = rs.CurveStartPoint(edge)
        self.end = rs.CurveEndPoint(edge)
        self.srf = srf
        self.corners = rs.CurvePoints(rs.DuplicateSurfaceBorder(srf)[0])[:4]
        self.actLen = float(actLen) * rs.CurveLength(edge)

if(genMode == 2 and len(srfs) != 0 and srfs[0] != None):
    
    graph = Graph(srfs, edges, actLens)
# ---------- end python ----------
graph = ClusterOutput(python.graph)

# ==== cluster Cluster
data = ClusterInput()
int = ClusterInput()
data_2 = Data(data)
int_2 = Integer(int)
lng = ListLength(List=data_2)
division = Division(A=lng, B=int_2)
series = Series(Start=0, Step=division, Count=int_2)
series_2 = Series(Start=series, Step=1, Count=division)
item = ListItem(List=data_2, Index=series_2, Wrap=True)
i = ClusterOutput(item)
